# Grasshopper definition Digital Colonization_2.1.gh (Grasshopper 1.0.7)
# plug-ins: EleFront, MetaHopper

# ---- group: Import
panel = Panel("A:\A.10_Portfolio_Current\2101_XL_DIGITAL COLONIZATION\B.00_Scripts & Tools\Ethnocentrism\Export_to_Rhino\")
ghpython_script = GhPythonScript(
    x=panel,
    z="netlogo_world.csv",
    u="netlogo_identities.csv",
    s="netlogo_empty.csv",
    v="netlogo_connection_identities.csv",
    w="netlogo_connection_groups.csv")  # -> a, b, e, c, d
# ---------- ghpython_script: Python ----------
__author__ = "altai"
__version__ = "2021.07.11"

import rhinoscriptsyntax as rs

a = x + y + z
b = x + y + u
c = x + y + v
d = x + y + w
e = x + y + s
# ---------- end ghpython_script ----------
netlogo_world = GhPythonScript(file_path=ghpython_script.a)  # -> world_x, world_y
# ---------- netlogo_world: Python ----------
__author__ = "altai"
__version__ = "2018.09.22"

import rhinoscriptsyntax as rs
import Rhino as rh
import csv

world_x = []
world_y = []


with open(file_path, 'r') as file:
    for line in file:
        item = line.split(',')
        world_x.append(int(item[0]))
        world_y.append(int(item[1]))
# ---------- end netlogo_world ----------
netlogo_identities = GhPythonScript(file_path=ghpython_script.b)  # -> who, color, xcor, ycor, norm, ptr, group_id
# ---------- netlogo_identities: Python ----------
__author__ = "altai"
__version__ = "2018.09.22"

import rhinoscriptsyntax as rs
import Rhino as rh
import csv

who = []
color = []
xcor = []
ycor = []
norm = []
ptr = []
group_id = []


with open(file_path, 'r') as file:
    for line in file:
        item = line.split(',')
        who.append(int(item[0]))
        color.append(int(item[1]))
        xcor.append(int(item[2]))
        ycor.append(int(item[3]))
        norm.append(str(item[4]))
        ptr.append(float(item[5]))
        group_id.append(int(item[6]))
# ---------- end netlogo_identities ----------
connection_identities = GhPythonScript(file_path=ghpython_script.c)  # -> identity_1, type_1, identity_2, type_2
# ---------- connection_identities: Python ----------
__author__ = "altai"
__version__ = "2018.09.22"

import rhinoscriptsyntax as rs
import Rhino as rh
import csv

identity_1 = []
type_1 = []
identity_2 = []
type_2 = []

with open(file_path, 'r') as file:
    for line in file:
        item = line.split(',')
        identity_1.append(int(item[0]))
        type_1.append(str(item[1]))
        identity_2.append(int(item[2]))
        type_2.append(str(item[3]))
# ---------- end connection_identities ----------

# ----
netlogo_empty = GhPythonScript(file_path=ghpython_script.e)  # -> who, color, xcor, ycor, norm, ptr, group_id
# ---------- netlogo_empty: Python ----------
__author__ = "altai"
__version__ = "2018.09.22"

import rhinoscriptsyntax as rs
import Rhino as rh
import csv

who = []
color = []
xcor = []
ycor = []
norm = []
ptr = []
group_id = []
i = 0


with open(file_path, 'r') as file:
    for line in file:
        i = i-1
        item = line.split(',')
        who.append(i)
        color.append(i)
        xcor.append(int(item[2]))
        ycor.append(int(item[3]))
        norm.append(i)
        ptr.append(float(0))
        group_id.append(i)
# ---------- end netlogo_empty ----------

group_toggle = GroupToggle(ToggleActive=True, ToggleVisible=False)  # disabled
button = Button()

# ---- group: GRID
grid_1 = GRID_1(
    extent_x=netlogo_world.world_x,
    extent_y=netlogo_world.world_y,
    keys=[netlogo_identities.who, netlogo_empty.who],
    color=[netlogo_identities.color, netlogo_empty.color],
    xcor=[netlogo_identities.xcor, netlogo_empty.xcor],
    ycor=[netlogo_identities.ycor, netlogo_empty.ycor],
    norm=[netlogo_identities.norm, netlogo_empty.norm],
    ptr=[netlogo_identities.ptr, netlogo_empty.ptr],
    group_id=[netlogo_identities.group_id, netlogo_empty.group_id])  # -> number_8, number_9, number_10, number_12, text_2, number_7, number_11, geometry_4, geometry_5, geometry_6

# ----
square = Square(Value=grid_1.number_7)

# ---- group: GRID (continued)
grid_2 = GRID_2(
    panel=square,
    mesh=grid_1.geometry_4,
    points=grid_1.geometry_5,
    points_2=grid_1.geometry_6,
    value=Slider(2.5, range=1..3),
    strength="15")  # -> tree, tree_2, center_a, mesh_4, mesh_5, material, material_2
cluster = Cluster_28(geometry=grid_2.tree, value_list=grid_1.number_11)  # -> rebuilt, list

# ----
mesh = Mesh(grid_1.geometry_4)

scale = ValueList({"1:10": 0.065, "1:20": 0.025, "1:50": 0.01, "1:100": 0.005}, selected="1:10")
panel_2 = Panel("""instant message
delayed message
mention
publish
relay
review
discussion
moderate
broadcast
shared economy
curation
search
activity sharing
feed""")

# ---- group: InformationDisplay
cluster_2 = Cluster_2(
    x=scale,
    who=grid_1.number_8,
    color=grid_1.number_9,
    norm=grid_1.text_2,
    ptr=grid_1.number_7,
    group_id=grid_1.number_11,
    cell=grid_2.tree,
    pos=grid_2.center_a,
    integer=connection_identities.identity_1,
    text=connection_identities.type_1,
    integer_2=connection_identities.identity_2,
    x_2=connection_identities.type_2)  # -> simplify(text_info), text_edge, list, list_2, tree, result, result_2, result_3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

# ----
cluster_3 = Cluster_3(
    name=panel_2,
    t1="0.35",
    t2="0.25",
    geometry=cluster_2.tree,
    number=cluster_2.result,
    type=cluster_2.result_2,
    number_2=cluster_2.result_3,
    text=cluster_2.result_4,
    number_3=cluster_2.result_5,
    number_4=cluster_2.result_6,
    geometry_2=cluster_2.result_7,
    geometry_3=cluster_2.result_8,
    vector=cluster_2.R)  # -> list, geometry_17, tree, list_2, list_3, line_3, line_4, list_4
cluster_4 = Cluster_27(number=scale, edge=cluster_2.tree, curve=cluster_3.list, x=cluster_3.geometry_17)  # -> hull, a, preview, preview_2

geometry = Geometry(cluster_4.preview)

# ---- group: instant message
cluster_5 = Cluster_22(
    y="instant message",
    number=scale,
    list=cluster_3.geometry_17,
    x=cluster_3.tree,
    list_2=cluster_3.list_2,
    list_3=cluster_3.list_3,
    list_4=cluster_3.line_3,
    list_5=cluster_3.line_4,
    list_6=cluster_3.list_4)  # -> result, result_2, result_3, type1, type1_edge, type1_line_1, type1_line_2, type1_pos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
instant_message = InstantMessage(
    door_thickness=cluster_5.result_2,
    group_thickness=cluster_5.result,
    door_width=cluster_5.result_3,
    type=cluster_5.type1,
    edge=cluster_5.type1_edge,
    direction=cluster_5.type1_direction,
    type_2=cluster_5.type2,
    edge_2=cluster_5.type2_edge,
    direction_2=cluster_5.type2_direction,
    type_3=cluster_5.type3,
    edge_3=cluster_5.type3_edge,
    direction_3=cluster_5.type3_direction,
    type_4=cluster_5.type4,
    edge_4=cluster_5.type4_edge,
    direction_4=cluster_5.type4_direction,
    type_5=cluster_5.type5,
    edge_5=cluster_5.type5_edge,
    direction_5=cluster_5.type5_direction)  # -> set, set_2, set_3
wall = Wall(number=cluster_5.result, geometry=graft(instant_message.set))
door = Wall(number=cluster_5.result_2, geometry=graft(instant_message.set_2))
dash = DashPattern(Curve=instant_message.set_3, Pattern=cluster_5.result)  # -> Dashes, Gaps

# ---- group: delayed message
cluster_6 = Cluster_22(
    y="delayed message",
    number=scale,
    list=cluster_3.geometry_17,
    x=cluster_3.tree,
    list_2=cluster_3.list_2,
    list_3=cluster_3.list_3,
    list_4=cluster_3.line_3,
    list_5=cluster_3.line_4,
    list_6=cluster_3.list_4)  # -> result, result_2, result_3, type1, type1_edge, type1_line_1, type1_line_2, type1_pos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
delayed_message = DelayedMessage(
    cluster_input=cluster_6.result_2,
    cluster_input_2=cluster_6.result,
    cluster_input_3=cluster_6.result_3,
    type=cluster_6.type1,
    edge=cluster_6.type1_edge,
    line_1=cluster_6.type1_line_1,
    line_2=cluster_6.type1_line_2,
    pos=cluster_6.type1_pos,
    direction=cluster_6.type1_direction,
    type_2=cluster_6.type2,
    edge_2=cluster_6.type2_edge,
    line_1_2=cluster_6.type2_line_1,
    line_2_2=cluster_6.type2_line_2,
    pos_2=cluster_6.type2_pos,
    direction_2=cluster_6.type2_direction,
    type_3=cluster_6.type3,
    edge_3=cluster_6.type3_edge,
    line_1_3=cluster_6.type3_line_1,
    line_2_3=cluster_6.type3_line_2,
    pos_3=cluster_6.type3_pos,
    direction_3=cluster_6.type3_direction,
    type_4=cluster_6.type4,
    edge_4=cluster_6.type4_edge,
    line_1_4=cluster_6.type4_line_1,
    line_2_4=cluster_6.type4_line_2,
    pos_4=cluster_6.type4_pos,
    direction_4=cluster_6.type4_direction,
    type_5=cluster_6.type5,
    edge_5=cluster_6.type5_edge,
    line_1_5=cluster_6.type5_line_1,
    line_2_5=cluster_6.type5_line_2,
    pos_5=cluster_6.type5_pos,
    direction_5=cluster_6.type5_direction)  # -> set, set_2, set_3
wall_2 = Wall(number=cluster_6.result, geometry=graft(delayed_message.set))
door_2 = Wall(number=cluster_6.result_2, geometry=graft(delayed_message.set_2))
dash_2 = DashPattern(Curve=delayed_message.set_3, Pattern=cluster_6.result)  # -> Dashes, Gaps

# ---- group: mention
cluster_7 = Cluster_22(
    y="mention",
    number=scale,
    list=cluster_3.geometry_17,
    x=cluster_3.tree,
    list_2=cluster_3.list_2,
    list_3=cluster_3.list_3,
    list_4=cluster_3.line_3,
    list_5=cluster_3.line_4,
    list_6=cluster_3.list_4)  # -> result, result_2, result_3, type1, type1_edge, type1_line_1, type1_line_2, type1_pos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
mention = Mention(
    cluster_input=cluster_7.result_2,
    cluster_input_2=cluster_7.result,
    cluster_input_3=cluster_7.result_3,
    type=cluster_7.type1,
    edge=cluster_7.type1_edge,
    pos=cluster_7.type1_pos,
    direction=cluster_7.type1_direction,
    type_2=cluster_7.type2,
    edge_2=cluster_7.type2_edge,
    pos_2=cluster_7.type2_pos,
    direction_2=cluster_7.type2_direction,
    type_3=cluster_7.type3,
    edge_3=cluster_7.type3_edge,
    pos_3=cluster_7.type3_pos,
    direction_3=cluster_7.type3_direction,
    type_4=cluster_7.type4,
    edge_4=cluster_7.type4_edge,
    pos_4=cluster_7.type4_pos,
    direction_4=cluster_7.type4_direction,
    type_5=cluster_7.type5,
    edge_5=cluster_7.type5_edge,
    pos_5=cluster_7.type5_pos,
    direction_5=cluster_7.type5_direction)  # -> set, set_2, set_3, set_4
wall_3 = Wall(number=cluster_7.result, geometry=graft(mention.set))
door_3 = Wall(number=cluster_7.result_2, geometry=graft(mention.set_3))
space = DashPattern(Curve=mention.set_2, Pattern=cluster_7.result)  # -> Dashes, Gaps
dash_3 = DashPattern(Curve=mention.set_4, Pattern=cluster_7.result)  # -> Dashes, Gaps

# ---- group: publish
cluster_8 = Cluster_22(
    y="publish",
    number=scale,
    list=cluster_3.geometry_17,
    x=cluster_3.tree,
    list_2=cluster_3.list_2,
    list_3=cluster_3.list_3,
    list_4=cluster_3.line_3,
    list_5=cluster_3.line_4,
    list_6=cluster_3.list_4)  # -> result, result_2, result_3, type1, type1_edge, type1_line_1, type1_line_2, type1_pos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
publish = Publish(
    door_thickness=cluster_8.result_2,
    group_thickness=cluster_8.result,
    door_width=cluster_8.result_3,
    type=cluster_8.type1,
    edge=cluster_8.type1_edge,
    pos=cluster_8.type1_pos,
    direction=cluster_8.type1_direction,
    type_2=cluster_8.type2,
    edge_2=cluster_8.type2_edge,
    pos_2=cluster_8.type2_pos,
    direction_2=cluster_8.type2_direction,
    type_3=cluster_8.type3,
    edge_3=cluster_8.type3_edge,
    pos_3=cluster_8.type3_pos,
    direction_3=cluster_8.type3_direction,
    type_4=cluster_8.type4,
    edge_4=cluster_8.type4_edge,
    pos_4=cluster_8.type4_pos,
    direction_4=cluster_8.type4_direction,
    type_5=cluster_8.type5,
    edge_5=cluster_8.type5_edge,
    pos_5=cluster_8.type5_pos,
    direction_5=cluster_8.type5_direction)  # -> set, set_2, set_3
wall_4 = Wall(number=cluster_8.result, geometry=simplify(graft(publish.set)))
window = Wall(number=cluster_8.result_2, geometry=graft(publish.set_2))
below = Geometry(publish.set_3)

# ---- group: review
cluster_9 = Cluster_22(
    y="review",
    number=scale,
    list=cluster_3.geometry_17,
    x=cluster_3.tree,
    list_2=cluster_3.list_2,
    list_3=cluster_3.list_3,
    list_4=cluster_3.line_3,
    list_5=cluster_3.line_4,
    list_6=cluster_3.list_4)  # -> result, result_2, result_3, type1, type1_edge, type1_line_1, type1_line_2, type1_pos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
review = Review(
    door_thickness=cluster_9.result_2,
    group_thickness=cluster_9.result,
    door_width=cluster_9.result_3,
    type=cluster_9.type1,
    edge=cluster_9.type1_edge,
    line_1=cluster_9.type1_line_1,
    line_2=cluster_9.type1_line_2,
    pos=cluster_9.type1_pos,
    direction=cluster_9.type1_direction,
    type_2=cluster_9.type2,
    edge_2=cluster_9.type2_edge,
    line_1_2=cluster_9.type2_line_1,
    line_2_2=cluster_9.type2_line_2,
    pos_2=cluster_9.type2_pos,
    direction_2=cluster_9.type2_direction,
    type_3=cluster_9.type3,
    edge_3=cluster_9.type3_edge,
    line_1_3=cluster_9.type3_line_1,
    line_2_3=cluster_9.type3_line_2,
    pos_3=cluster_9.type3_pos,
    direction_3=cluster_9.type3_direction,
    type_4=cluster_9.type4,
    edge_4=cluster_9.type4_edge,
    line_1_4=cluster_9.type4_line_1,
    line_2_4=cluster_9.type4_line_2,
    pos_4=cluster_9.type4_pos,
    direction_4=cluster_9.type4_direction,
    type_5=cluster_9.type5,
    edge_5=cluster_9.type5_edge,
    line_1_5=cluster_9.type5_line_1,
    line_2_5=cluster_9.type5_line_2,
    pos_5=cluster_9.type5_pos,
    direction_5=cluster_9.type5_direction)  # -> set, set_2, set_3
wall_5 = Wall(number=cluster_9.result, geometry=simplify(graft(review.set)))
window_2 = Wall(number=cluster_9.result_2, geometry=graft(review.set_2))
below_2 = Geometry(review.set_3)

# ---- group: relay
cluster_10 = Cluster_22(
    y="relay",
    number=scale,
    list=cluster_3.geometry_17,
    x=cluster_3.tree,
    list_2=cluster_3.list_2,
    list_3=cluster_3.list_3,
    list_4=cluster_3.line_3,
    list_5=cluster_3.line_4,
    list_6=cluster_3.list_4)  # -> result, result_2, result_3, type1, type1_edge, type1_line_1, type1_line_2, type1_pos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
relay = Relay(
    door_thickness=cluster_10.result_2,
    group_thickness=cluster_10.result,
    door_width=cluster_10.result_3,
    type=cluster_10.type1,
    edge=cluster_10.type1_edge,
    line1=cluster_10.type1_line_1,
    line2=cluster_10.type1_line_2,
    pos=cluster_10.type1_pos,
    direction=cluster_10.type1_direction,
    type_2=cluster_10.type2,
    edge_2=cluster_10.type2_edge,
    line1_2=cluster_10.type2_line_1,
    line2_2=cluster_10.type2_line_2,
    pos_2=cluster_10.type2_pos,
    direction_2=cluster_10.type2_direction,
    type_3=cluster_10.type3,
    edge_3=cluster_10.type3_edge,
    line1_3=cluster_10.type3_line_1,
    line2_3=cluster_10.type3_line_2,
    pos_3=cluster_10.type3_pos,
    direction_3=cluster_10.type3_direction,
    type_4=cluster_10.type4,
    edge_4=cluster_10.type4_edge,
    line1_4=cluster_10.type4_line_1,
    line2_4=cluster_10.type4_line_2,
    pos_4=cluster_10.type4_pos,
    direction_4=cluster_10.type4_direction,
    type_5=cluster_10.type5,
    edge_5=cluster_10.type5_edge,
    line1_5=cluster_10.type5_line_1,
    line2_5=cluster_10.type5_line_2,
    pos_5=cluster_10.type5_pos,
    direction_5=cluster_10.type5_direction)  # -> set, set_2, set_3, set_4, set_5, set_6
wall_6 = Wall(number=cluster_10.result, geometry=simplify(graft(relay.set)))
wall_thin = Wall(number=expr("x/2", cluster_10.result), geometry=simplify(graft(relay.set_2)))
window_3 = Wall(number=cluster_10.result_2, geometry=graft(relay.set_3))
door_4 = Wall(number=cluster_10.result_2, geometry=graft(relay.set_5))
dash_4 = DashPattern(Curve=relay.set_6, Pattern=cluster_10.result)  # -> Dashes, Gaps
below_3 = Geometry(relay.set_4)

# ---- group: discussion
cluster_11 = Cluster_22(
    y="discussion",
    number=scale,
    list=cluster_3.geometry_17,
    x=cluster_3.tree,
    list_2=cluster_3.list_2,
    list_3=cluster_3.list_3,
    list_4=cluster_3.line_3,
    list_5=cluster_3.line_4,
    list_6=cluster_3.list_4)  # -> result, result_2, result_3, type1, type1_edge, type1_line_1, type1_line_2, type1_pos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
discussion = Discussion(
    door_thickness=cluster_11.result_2,
    group_thickness=cluster_11.result,
    door_width=cluster_11.result_3,
    type=cluster_11.type1,
    edge=cluster_11.type1_edge,
    line_1=cluster_11.type1_line_1,
    line_2=cluster_11.type1_line_2,
    pos=cluster_11.type1_pos,
    direction=cluster_11.type1_direction,
    type_2=cluster_11.type2,
    edge_2=cluster_11.type2_edge,
    line_1_2=cluster_11.type2_line_1,
    line_2_2=cluster_11.type2_line_2,
    pos_2=cluster_11.type2_pos,
    direction_2=cluster_11.type2_direction,
    type_3=cluster_11.type3,
    edge_3=cluster_11.type3_edge,
    line_1_3=cluster_11.type3_line_1,
    line_2_3=cluster_11.type3_line_2,
    pos_3=cluster_11.type3_pos,
    direction_3=cluster_11.type3_direction,
    type_4=cluster_11.type4,
    edge_4=cluster_11.type4_edge,
    line_1_4=cluster_11.type4_line_1,
    line_2_4=cluster_11.type4_line_2,
    pos_4=cluster_11.type4_pos,
    direction_4=cluster_11.type4_direction,
    type_5=cluster_11.type5,
    edge_5=cluster_11.type5_edge,
    line_1_5=cluster_11.type5_line_1,
    line_2_5=cluster_11.type5_line_2,
    pos_5=cluster_11.type5_pos,
    direction_5=cluster_11.type5_direction)  # -> set, set_2
wall_7 = Wall(number=cluster_11.result, geometry=simplify(graft(discussion.set)))
arc = Arc(number=cluster_11.result, geometry=simplify(graft(discussion.set_2)))

# ---- group: moderate
cluster_12 = Cluster_22(
    y="moderate",
    number=scale,
    list=cluster_3.geometry_17,
    x=cluster_3.tree,
    list_2=cluster_3.list_2,
    list_3=cluster_3.list_3,
    list_4=cluster_3.line_3,
    list_5=cluster_3.line_4,
    list_6=cluster_3.list_4)  # -> result, result_2, result_3, type1, type1_edge, type1_line_1, type1_line_2, type1_pos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
review_2 = Review_2(
    door_thickness=cluster_12.result_2,
    group_thickness=cluster_12.result,
    door_width=cluster_12.result_3,
    type=cluster_12.type1,
    edge=cluster_12.type1_edge,
    line_1=cluster_12.type1_line_1,
    line_2=cluster_12.type1_line_2,
    pos=cluster_12.type1_pos,
    direction=cluster_12.type1_direction,
    type_2=cluster_12.type2,
    edge_2=cluster_12.type2_edge,
    line_1_2=cluster_12.type2_line_1,
    line_2_2=cluster_12.type2_line_2,
    pos_2=cluster_12.type2_pos,
    direction_2=cluster_12.type2_direction,
    type_3=cluster_12.type3,
    edge_3=cluster_12.type3_edge,
    line_1_3=cluster_12.type3_line_1,
    line_2_3=cluster_12.type3_line_2,
    pos_3=cluster_12.type3_pos,
    direction_3=cluster_12.type3_direction,
    type_4=cluster_12.type4,
    edge_4=cluster_12.type4_edge,
    line_1_4=cluster_12.type4_line_1,
    line_2_4=cluster_12.type4_line_2,
    pos_4=cluster_12.type4_pos,
    direction_4=cluster_12.type4_direction,
    type_5=cluster_12.type5,
    edge_5=cluster_12.type5_edge,
    line_1_5=cluster_12.type5_line_1,
    line_2_5=cluster_12.type5_line_2,
    pos_5=cluster_12.type5_pos,
    direction_5=cluster_12.type5_direction)  # -> set, set_2, set_3
wall_8 = Wall(number=cluster_12.result)
wall_thin_2 = Wall(number=expr("x/2", cluster_12.result), geometry=simplify(graft(review_2.set)))
arc_2 = Arc(number=cluster_12.result_2, geometry=simplify(graft(review_2.set_2)))
below_4 = Geometry(review_2.set_3)

# ---- group: broadcast
cluster_13 = Cluster_22(
    y="broadcast",
    number=scale,
    list=cluster_3.geometry_17,
    x=cluster_3.tree,
    list_2=cluster_3.list_2,
    list_3=cluster_3.list_3,
    list_4=cluster_3.line_3,
    list_5=cluster_3.line_4,
    list_6=cluster_3.list_4)  # -> result, result_2, result_3, type1, type1_edge, type1_line_1, type1_line_2, type1_pos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
broadcast = Broadcast(
    door_thickness=cluster_13.result_2,
    group_thickness=cluster_13.result,
    door_width=cluster_13.result_3,
    type=cluster_13.type1,
    edge=cluster_13.type1_edge,
    line_1=cluster_13.type1_line_1,
    line_2=cluster_13.type1_line_2,
    pos=cluster_13.type1_pos,
    direction=cluster_13.type1_direction,
    type_2=cluster_13.type2,
    edge_2=cluster_13.type2_edge,
    line_1_2=cluster_13.type2_line_1,
    line_2_2=cluster_13.type2_line_2,
    pos_2=cluster_13.type2_pos,
    direction_2=cluster_13.type2_direction,
    type_3=cluster_13.type3,
    edge_3=cluster_13.type3_edge,
    line_1_3=cluster_13.type3_line_1,
    line_2_3=cluster_13.type3_line_2,
    pos_3=cluster_13.type3_pos,
    direction_3=cluster_13.type3_direction,
    type_4=cluster_13.type4,
    edge_4=cluster_13.type4_edge,
    line_1_4=cluster_13.type4_line_1,
    line_2_4=cluster_13.type4_line_2,
    pos_4=cluster_13.type4_pos,
    direction_4=cluster_13.type4_direction,
    type_5=cluster_13.type5,
    edge_5=cluster_13.type5_edge,
    line_1_5=cluster_13.type5_line_1,
    line_2_5=cluster_13.type5_line_2,
    pos_5=cluster_13.type5_pos,
    direction_5=cluster_13.type5_direction)  # -> set, set_2
arc_3 = Arc(number=cluster_13.result, geometry=simplify(graft(broadcast.set)))
wall_thin_3 = Wall(number=expr("x/2", cluster_13.result), geometry=simplify(graft(broadcast.set_2)))

# ---- group: shared economy
cluster_14 = Cluster_22(
    y="shared economy",
    number=scale,
    list=cluster_3.geometry_17,
    x=cluster_3.tree,
    list_2=cluster_3.list_2,
    list_3=cluster_3.list_3,
    list_4=cluster_3.line_3,
    list_5=cluster_3.line_4,
    list_6=cluster_3.list_4)  # -> result, result_2, result_3, type1, type1_edge, type1_line_1, type1_line_2, type1_pos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
shared_economy = SharedEconomy(
    door_thickness=cluster_14.result_2,
    group_thickness=cluster_14.result,
    door_width=cluster_14.result_3,
    type=cluster_14.type1,
    edge=cluster_14.type1_edge,
    line_1=cluster_14.type1_line_1,
    line_2=cluster_14.type1_line_2,
    pos=cluster_14.type1_pos,
    direction=cluster_14.type1_direction,
    type_2=cluster_14.type2,
    edge_2=cluster_14.type2_edge,
    line_1_2=cluster_14.type2_line_1,
    line_2_2=cluster_14.type2_line_2,
    pos_2=cluster_14.type2_pos,
    direction_2=cluster_14.type2_direction,
    type_3=cluster_14.type3,
    edge_3=cluster_14.type3_edge,
    line_1_3=cluster_14.type3_line_1,
    line_2_3=cluster_14.type3_line_2,
    pos_3=cluster_14.type3_pos,
    direction_3=cluster_14.type3_direction,
    type_4=cluster_14.type4,
    edge_4=cluster_14.type4_edge,
    line_1_4=cluster_14.type4_line_1,
    line_2_4=cluster_14.type4_line_2,
    pos_4=cluster_14.type4_pos,
    direction_4=cluster_14.type4_direction,
    type_5=cluster_14.type5,
    edge_5=cluster_14.type5_edge,
    line_1_5=cluster_14.type5_line_1,
    line_2_5=cluster_14.type5_line_2,
    pos_5=cluster_14.type5_pos,
    direction_5=cluster_14.type5_direction)  # -> set, set_2, set_3
wall_9 = Wall(number=cluster_14.result, geometry=simplify(graft(shared_economy.set)))
wall_thin_4 = Wall(number=expr("x/2", cluster_14.result), geometry=simplify(graft(shared_economy.set_2)))
window_4 = Wall(number=cluster_14.result_2, geometry=graft(shared_economy.set_3))

# ---- group: curation
cluster_15 = Cluster_22(
    y="curation",
    number=scale,
    list=cluster_3.geometry_17,
    x=cluster_3.tree,
    list_2=cluster_3.list_2,
    list_3=cluster_3.list_3,
    list_4=cluster_3.line_3,
    list_5=cluster_3.line_4,
    list_6=cluster_3.list_4)  # -> result, result_2, result_3, type1, type1_edge, type1_line_1, type1_line_2, type1_pos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
curation = Curation(
    door_thickness=cluster_15.result_2,
    group_thickness=cluster_15.result,
    door_width=cluster_15.result_3,
    type=cluster_15.type1,
    edge=cluster_15.type1_edge,
    line_1=cluster_15.type1_line_1,
    line_2=cluster_15.type1_line_2,
    pos=cluster_15.type1_pos,
    direction=cluster_15.type1_direction,
    type_2=cluster_15.type2,
    edge_2=cluster_15.type2_edge,
    line_1_2=cluster_15.type2_line_1,
    line_2_2=cluster_15.type2_line_2,
    pos_2=cluster_15.type2_pos,
    direction_2=cluster_15.type2_direction,
    type_3=cluster_15.type3,
    edge_3=cluster_15.type3_edge,
    line_1_3=cluster_15.type3_line_1,
    line_2_3=cluster_15.type3_line_2,
    pos_3=cluster_15.type3_pos,
    direction_3=cluster_15.type3_direction,
    type_4=cluster_15.type4,
    edge_4=cluster_15.type4_edge,
    line_1_4=cluster_15.type4_line_1,
    line_2_4=cluster_15.type4_line_2,
    pos_4=cluster_15.type4_pos,
    direction_4=cluster_15.type4_direction,
    type_5=cluster_15.type5,
    edge_5=cluster_15.type5_edge,
    line_1_5=cluster_15.type5_line_1,
    line_2_5=cluster_15.type5_line_2,
    pos_5=cluster_15.type5_pos,
    direction_5=cluster_15.type5_direction)  # -> set_2, set
wall_10 = Wall(number=cluster_15.result, geometry=simplify(graft(curation.set_2)))
wall_thin_5 = Wall(number=expr("x/2", cluster_15.result), geometry=simplify(graft(curation.set)))

# ---- group: search
cluster_16 = Cluster_22(
    y="search",
    number=scale,
    list=cluster_3.geometry_17,
    x=cluster_3.tree,
    list_2=cluster_3.list_2,
    list_3=cluster_3.list_3,
    list_4=cluster_3.line_3,
    list_5=cluster_3.line_4,
    list_6=cluster_3.list_4)  # -> result, result_2, result_3, type1, type1_edge, type1_line_1, type1_line_2, type1_pos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
shared_economy_2 = SharedEconomy_2(
    door_thickness=cluster_16.result_2,
    group_thickness=cluster_16.result,
    door_width=cluster_16.result_3,
    type=cluster_16.type1,
    edge=cluster_16.type1_edge,
    line_1=cluster_16.type1_line_1,
    line_2=cluster_16.type1_line_2,
    pos=cluster_16.type1_pos,
    direction=cluster_16.type1_direction,
    type_2=cluster_16.type2,
    edge_2=cluster_16.type2_edge,
    line_1_2=cluster_16.type2_line_1,
    line_2_2=cluster_16.type2_line_2,
    pos_2=cluster_16.type2_pos,
    direction_2=cluster_16.type2_direction,
    type_3=cluster_16.type3,
    edge_3=cluster_16.type3_edge,
    line_1_3=cluster_16.type3_line_1,
    line_2_3=cluster_16.type3_line_2,
    pos_3=cluster_16.type3_pos,
    direction_3=cluster_16.type3_direction,
    type_4=cluster_16.type4,
    edge_4=cluster_16.type4_edge,
    line_1_4=cluster_16.type4_line_1,
    line_2_4=cluster_16.type4_line_2,
    pos_4=cluster_16.type4_pos,
    direction_4=cluster_16.type4_direction,
    type_5=cluster_16.type5,
    edge_5=cluster_16.type5_edge,
    line_1_5=cluster_16.type5_line_1,
    line_2_5=cluster_16.type5_line_2,
    pos_5=cluster_16.type5_pos,
    direction_5=cluster_16.type5_direction)  # -> set_2, set
wall_11 = Wall(number=cluster_16.result, geometry=simplify(graft(shared_economy_2.set_2)))
wall_thin_6 = Wall(number=expr("x/2", cluster_16.result), geometry=simplify(graft(shared_economy_2.set)))

# ---- group: activity sharing
cluster_17 = Cluster_22(
    y="activity sharing",
    number=scale,
    list=cluster_3.geometry_17,
    x=cluster_3.tree,
    list_2=cluster_3.list_2,
    list_3=cluster_3.list_3,
    list_4=cluster_3.line_3,
    list_5=cluster_3.line_4,
    list_6=cluster_3.list_4)  # -> result, result_2, result_3, type1, type1_edge, type1_line_1, type1_line_2, type1_pos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
activity_sharing = ActivitySharing(
    door_thickness=cluster_17.result_2,
    group_thickness=cluster_17.result,
    door_width=cluster_17.result_3,
    type=cluster_17.type1,
    edge=cluster_17.type1_edge,
    line_1=cluster_17.type1_line_1,
    line_2=cluster_17.type1_line_2,
    pos=cluster_17.type1_pos,
    direction=cluster_17.type1_direction,
    type_2=cluster_17.type2,
    edge_2=cluster_17.type2_edge,
    line_1_2=cluster_17.type2_line_1,
    line_2_2=cluster_17.type2_line_2,
    pos_2=cluster_17.type2_pos,
    direction_2=cluster_17.type2_direction,
    type_3=cluster_17.type3,
    edge_3=cluster_17.type3_edge,
    line_1_3=cluster_17.type3_line_1,
    line_2_3=cluster_17.type3_line_2,
    pos_3=cluster_17.type3_pos,
    direction_3=cluster_17.type3_direction,
    type_4=cluster_17.type4,
    edge_4=cluster_17.type4_edge,
    line_1_4=cluster_17.type4_line_1,
    line_2_4=cluster_17.type4_line_2,
    pos_4=cluster_17.type4_pos,
    direction_4=cluster_17.type4_direction,
    type_5=cluster_17.type5,
    edge_5=cluster_17.type5_edge,
    line_1_5=cluster_17.type5_line_1,
    line_2_5=cluster_17.type5_line_2,
    pos_5=cluster_17.type5_pos,
    direction_5=cluster_17.type5_direction)  # -> set, set_2
wall_12 = Wall(number=cluster_17.result, geometry=simplify(graft(activity_sharing.set)))
wall_thin_7 = Wall(number=expr("x/2", cluster_17.result), geometry=simplify(graft(activity_sharing.set_2)))

# ---- group: feed
cluster_18 = Cluster_22(
    y="feed",
    number=scale,
    list=cluster_3.geometry_17,
    x=cluster_3.tree,
    list_2=cluster_3.list_2,
    list_3=cluster_3.list_3,
    list_4=cluster_3.line_3,
    list_5=cluster_3.line_4,
    list_6=cluster_3.list_4)  # -> result, result_2, result_3, type1, type1_edge, type1_line_1, type1_line_2, type1_pos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
feed = Feed(
    door_thickness=cluster_18.result_2,
    group_thickness=cluster_18.result,
    door_width=cluster_18.result_3,
    type=cluster_18.type1,
    edge=cluster_18.type1_edge,
    line_1=cluster_18.type1_line_1,
    line_2=cluster_18.type1_line_2,
    pos=cluster_18.type1_pos,
    direction=cluster_18.type1_direction,
    type_2=cluster_18.type2,
    edge_2=cluster_18.type2_edge,
    line_1_2=cluster_18.type2_line_1,
    line_2_2=cluster_18.type2_line_2,
    pos_2=cluster_18.type2_pos,
    direction_2=cluster_18.type2_direction,
    type_3=cluster_18.type3,
    edge_3=cluster_18.type3_edge,
    line_1_3=cluster_18.type3_line_1,
    line_2_3=cluster_18.type3_line_2,
    pos_3=cluster_18.type3_pos,
    direction_3=cluster_18.type3_direction,
    type_4=cluster_18.type4,
    edge_4=cluster_18.type4_edge,
    line_1_4=cluster_18.type4_line_1,
    line_2_4=cluster_18.type4_line_2,
    pos_4=cluster_18.type4_pos,
    direction_4=cluster_18.type4_direction,
    type_5=cluster_18.type5,
    edge_5=cluster_18.type5_edge,
    line_1_5=cluster_18.type5_line_1,
    line_2_5=cluster_18.type5_line_2,
    pos_5=cluster_18.type5_pos,
    direction_5=cluster_18.type5_direction)  # -> set, set_2
wall_13 = Wall(number=cluster_18.result, geometry=simplify(graft(feed.set)))
wall_thin_8 = Wall(number=expr("x/2", cluster_18.result), geometry=simplify(graft(feed.set_2)))

# ----
ptr_preview = CustomPreview(Geometry=mesh, Material=grid_2.material_2)
ptr_preview_2 = CustomPreview(Geometry=grid_2.mesh_5, Material=grid_2.material_2)
modified_grid = Geometry(cluster_2.tree)
original_grid = Geometry(grid_1.geometry_4)
group_edge = Geometry(cluster.rebuilt)
empty_patch = Geometry([cluster_4.hull, cluster_4.preview, cluster_4.preview_2])
diagonal = Geometry([cluster_3.line_3, cluster_3.line_4])

solid = Merge(
    Data1=flatten(cluster_4.hull),
    Data2=flatten(wall),
    Data3=flatten(wall_2),
    Data4=flatten(wall_3),
    Data5=flatten(wall_4),
    Data6=wall_6,
    Data7=wall_thin,
    Data8=wall_9,
    Data9=wall_thin_4,
    Data10=arc_3,
    Data11=wall_thin_3,
    Data12=wall_thin_2,
    Data13=wall_8,
    Data14=arc,
    Data15=wall_7,
    Data17=wall_5,
    Data18=wall_10,
    Data19=wall_thin_5,
    Data20=wall_11,
    Data21=wall_thin_6,
    Data22=wall_12,
    Data23=wall_thin_7,
    Data24=wall_13,
    Data25=wall_thin_8)  # -> flatten(Result)
empty_edge = Merge(Data1=flatten(cluster_4.preview))  # -> flatten(Result)
edge = Merge(Data1=flatten(cluster_3.geometry_17))  # -> flatten(Result)
dash_5 = Merge(
    Data1=flatten(instant_message.set_3),
    Data2=flatten(delayed_message.set_3),
    Data3=flatten(mention.set_4),
    Data4=flatten(relay.set_6))  # -> flatten(Result)
space_2 = Merge(Data1=flatten(mention.set_2))  # -> flatten(Result)
below_5 = Merge(Data1=flatten(below), Data2=below_3, Data3=below_4, Data4=below_2)  # -> flatten(Result)
profile = Merge(Data1=window, Data2=window_3, Data3=window_4, Data4=arc_2, Data5=window_2)  # -> flatten(Result)
door_5 = Merge(Data1=door, Data2=door_2, Data3=door_3, Data4=door_4)  # -> flatten(Result)
define_layer = DefineLayer(Name="02_Prototype::edge")
define_layer_2 = DefineLayer(Name="02_Prototype::space")
define_layer_3 = DefineLayer(Name="02_Prototype::solid")
define_layer_4 = DefineLayer(Name="02_Prototype::profile")
define_object_attributes = DefineObjectAttributes(Layer=define_layer)
define_object_attributes_2 = DefineObjectAttributes(Layer=define_layer_2)
define_object_attributes_3 = DefineObjectAttributes(Layer=define_layer_3)
define_object_attributes_4 = DefineObjectAttributes(Layer=define_layer_4)
bake_objects = BakeObjects(Geometry=edge, Attributes=define_object_attributes, Bake=button)
bake_objects_2 = BakeObjects(Geometry=space_2, Attributes=define_object_attributes_2, Bake=button)
bake_objects_3 = BakeObjects(Geometry=solid, Attributes=define_object_attributes_3, Bake=button)
bake_objects_4 = BakeObjects(Geometry=profile, Attributes=define_object_attributes_4, Bake=button)
define_layer_5 = DefineLayer(Name="02_Prototype::door")
define_layer_6 = DefineLayer(Name="02_Prototype::dash")
define_layer_7 = DefineLayer(Name="02_Prototype::below")
define_layer_8 = DefineLayer(Name="02_Prototype::empty cell")
define_object_attributes_5 = DefineObjectAttributes(Layer=define_layer_5)
define_object_attributes_6 = DefineObjectAttributes(Layer=define_layer_6)
define_object_attributes_7 = DefineObjectAttributes(Layer=define_layer_7)
define_object_attributes_8 = DefineObjectAttributes(Layer=define_layer_8)
bake_objects_5 = BakeObjects(Geometry=door_5, Attributes=define_object_attributes_5, Bake=button)
bake_objects_6 = BakeObjects(Geometry=dash_5, Attributes=define_object_attributes_6, Bake=button)
bake_objects_7 = BakeObjects(Geometry=below_5, Attributes=define_object_attributes_7, Bake=button)
bake_objects_8 = BakeObjects(Geometry=cluster.list, Attributes=define_object_attributes_8, Bake=button)

colour_swatch = ColourSwatch(SwatchColor=RGB(255, 0, 0))
colour_swatch_2 = ColourSwatch(SwatchColor=RGB(0, 255, 255))
define_layer_9 = DefineLayer(Name="02_Prototype::text_info", Color=colour_swatch)
define_layer_10 = DefineLayer(Name="02_Prototype::text_edge", Color=colour_swatch_2)
define_object_attributes_9 = DefineObjectAttributes(Layer=define_layer_9)
define_object_attributes_10 = DefineObjectAttributes(Layer=define_layer_10)
bake_objects_9 = BakeObjects(Geometry=cluster_2.text_info, Attributes=define_object_attributes_9, Bake=button)  # disabled
bake_objects_10 = BakeObjects(Geometry=cluster_2.text_edge, Attributes=define_object_attributes_10, Bake=button)  # disabled
text_info = CustomPreview(Geometry=cluster_2.text_info, Material=colour_swatch)  # disabled
text_edge = CustomPreview(Geometry=cluster_2.text_edge, Material=colour_swatch_2)  # disabled

# ==== cluster GRID_1
extent_x = ClusterInput()
extent_y = ClusterInput()
keys = ClusterInput()
color = ClusterInput()
xcor = ClusterInput()
ycor = ClusterInput()
norm = ClusterInput()
ptr = ClusterInput()
group_id = ClusterInput()
construct_domain = ConstructDomain(DomainStart=0, DomainEnd=expr("x-1", extent_x))
sort_list = SortList(Keys=keys, ValuesColor=color, ValuesXcor=xcor, ValuesYcor=ycor, ValuesNorm=norm, ValuesPtr=ptr, ValuesGroup_id=group_id)  # -> Keys, ValuesColor, ValuesXcor, ValuesYcor, ValuesNorm, ValuesPtr, ValuesGroup_id
range = Range(Domain=construct_domain, Steps=expr("x-1", extent_x))
integer = Integer(range)
equality = Equality(FirstNumber=sort_list.ValuesXcor, SecondNumber=simplify(graft(integer)))  # -> simplify(Equality), Inequality
cull_pattern = CullPattern(List=sort_list.Keys, CullPattern=equality.Equality)  # -> simplify(List)
member_index = MemberIndex(Set=sort_list.Keys, Member=cull_pattern)  # -> simplify(Index), Count
trim_tree = TrimTree(Tree=member_index.Index, Depth=1)
list_item = ListItem(List=sort_list.ValuesYcor, Index=trim_tree, Wrap=True)
sort_list_2 = SortList(Keys=list_item, ValuesValuesA=trim_tree)  # -> Keys, ValuesValuesA
panel = Panel(sort_list.ValuesPtr)
square = Square(Plane=PlaneXY(-1, -1, 0), Size=1, ExtentX=extent_x, ExtentY=extent_y)  # -> simplify(Cells), simplify(Points)
face_boundaries = FaceBoundaries(Mesh=square.Cells)
trim_tree_2 = TrimTree(Tree=face_boundaries, Depth=1)
polygon_center = PolygonCenter(Polyline=trim_tree_2)  # -> CenterV, CenterE, CenterA
who = ListItem(List=sort_list.Keys, Index=sort_list_2.ValuesValuesA, Wrap=True)
panel_2 = Panel(who)
color_2 = ListItem(List=sort_list.ValuesColor, Index=sort_list_2.ValuesValuesA, Wrap=True)
xcor_2 = ListItem(List=sort_list.ValuesXcor, Index=sort_list_2.ValuesValuesA, Wrap=True)
ycor_2 = ListItem(List=sort_list.ValuesYcor, Index=sort_list_2.ValuesValuesA, Wrap=True)
norm_2 = ListItem(List=sort_list.ValuesNorm, Index=sort_list_2.ValuesValuesA, Wrap=True)
ptr_2 = ListItem(List=sort_list.ValuesPtr, Index=sort_list_2.ValuesValuesA, Wrap=True)
group_id_2 = ListItem(List=sort_list.ValuesGroup_id, Index=sort_list_2.ValuesValuesA, Wrap=True)
number = Number(who)
number_2 = Number(color_2)
number_3 = Number(xcor_2)
number_4 = Number(ycor_2)
text = Text(norm_2)
number_5 = Number(ptr_2)
number_6 = Number(group_id_2)
geometry = Geometry(square.Cells)
geometry_2 = Geometry(square.Points)
geometry_3 = Geometry(polygon_center.CenterA)
geometry_4 = ClusterOutput(geometry)
geometry_5 = ClusterOutput(geometry_2)
text_2 = ClusterOutput(text)
number_7 = ClusterOutput(number_5)
number_8 = ClusterOutput(number)
number_9 = ClusterOutput(number_2)
number_10 = ClusterOutput(number_3)
number_11 = ClusterOutput(number_6)
number_12 = ClusterOutput(number_4)
geometry_6 = ClusterOutput(geometry_3)
panel_3 = Panel(ptr_2)

# ==== cluster GRID_2
value = ClusterInput()
points = ClusterInput()
points_2 = ClusterInput()
mesh = ClusterInput()
panel = ClusterInput()
strength = ClusterInput()
absolute = Absolute(Value=panel)
geometry = Geometry(points)
geometry_2 = Geometry(points_2)
absolute_2 = Absolute(Value=value)
ghpython_script = GhPythonScript(x=absolute, y=absolute_2)  # -> a; inputs y: Int32
# ---------- ghpython_script: Python ----------
__author__ = "altai"
__version__ = "2021.07.11"

import rhinoscriptsyntax as rs

a = pow(x, 1/abs(y))
# ---------- end ghpython_script ----------
mesh_2 = Mesh(mesh)
panel_2 = Panel(panel)
sort_list = SortList(Keys=flatten(ghpython_script))  # -> Keys, ValuesValuesA
mesh_join = MeshJoin(Meshes=flatten(mesh_2))
weld_mesh = WeldMesh(Mesh=mesh_join, Angle=3.141592654)
first_last = FirstLast(List=sort_list.Keys)  # -> FirstValue, LastValue
gradient = Gradient(
    LowerLimit=first_last.FirstValue,
    UpperLimit=first_last.LastValue,
    Parameter=ghpython_script,
    stops=[0.1: RGB(0, 0, 0), 1: RGB(255, 255, 255)])
gradient_2 = Gradient(
    LowerLimit=first_last.FirstValue,
    UpperLimit=first_last.LastValue,
    Parameter=ghpython_script,
    stops=[0.254: RGB(0, 0, 0), 1: RGB(255, 255, 255)])
mesh_spray = MeshSpray(Mesh=weld_mesh, Points=flatten(points_2), Colours=flatten(gradient), SprayMode=0)
explode = Explode(Curve=mesh, Recursive=True)  # -> Segments, Vertices
nakedvertices = NakedVertices(Mesh=mesh_spray)  # -> ClothedIndex, NakedIndex, ClothedPts, NakedPts
meshcorners = MeshCorners(Mesh=mesh_spray, Angle=2.35619449)
removeduplicatelines = RemoveDuplicateLines(Lines=flatten(explode.Segments), Tolerance=0.01)
member_index = MemberIndex(Set=nakedvertices.NakedPts, Member=meshcorners)  # -> flatten(Index), Count
convex_hull = ConvexHull(Points=meshcorners, Plane=PlaneXY(0, 0, 0))  # -> Hull, HullZ, Indices
cull_index = CullIndex(List=nakedvertices.NakedPts, Indices=member_index.Index, Wrap=True)
list_item = ListItem(List=nakedvertices.NakedPts, Index=member_index.Index, Wrap=True)
imagecircles = ImageCircles(Points=flatten(points), Mesh=mesh_spray, Min=0.2, Max=1.5, Strength=100)  # -> flatten(ImageCircles)
constanttension = ConstantTension(Line=removeduplicatelines, Strength=strength)
anchor = Anchor(Point=list_item, Target=list_item, Strength=10000)
oncurve = OnCurve(Points=cull_index, Curve=convex_hull.Hull, Strength=1000)
removeduplicatepts = RemoveDuplicatePts(Points=explode.Vertices, Tolerance=0.01)  # -> simplify(UniquePoints)
zombiesolver = ZombieSolver(GoalObjects=[constanttension, oncurve, anchor, imagecircles], Threshold=0.0001, Tolerance=0.0001, MaxIterations=500)  # -> I, V, O
clone_structure = CloneStructure(List=zombiesolver.V, Structure=graft(points))
member_index_2 = MemberIndex(Set=flatten(points), Member=removeduplicatepts)  # -> Index, Count
trim_tree = TrimTree(Tree=clone_structure, Depth=1)
trim_tree_2 = TrimTree(Tree=member_index_2.Index, Depth=1)
list_item_2 = ListItem(List=flatten(trim_tree), Index=trim_tree_2, Wrap=True)
polyline = PolyLine(Vertices=list_item_2, Closed=True)
create_material = CreateMaterial(Diffuse=gradient, Specular=RGB(255, 255, 255), Emission=RGB(0, 0, 0), Transparency=0, Shine=0)
create_material_2 = CreateMaterial(Diffuse=gradient_2, Specular=RGB(255, 255, 255), Emission=RGB(0, 0, 0), Transparency=0, Shine=0)
trim_tree_3 = TrimTree(Tree=polyline, Depth=1)
polygon_center = PolygonCenter(Polyline=trim_tree_3)  # -> CenterV, CenterE, CenterA
mesh_join_2 = MeshJoin(Meshes=flatten(trim_tree_3))
mesh_3 = Mesh(trim_tree_3)
mesh_spray_2 = MeshSpray(Mesh=mesh_join_2, Points=flatten(polygon_center.CenterA), Colours=flatten(gradient), SprayMode=0)
tree = ClusterOutput(trim_tree_3)
tree_2 = ClusterOutput(trim_tree)
center_a = ClusterOutput(polygon_center.CenterA)
mesh_4 = ClusterOutput(mesh_spray_2)
mesh_5 = ClusterOutput(mesh_3)
material = ClusterOutput(create_material)
material_2 = ClusterOutput(create_material_2)

# ==== cluster Cluster_2
x = ClusterInput()
who = ClusterInput()
color = ClusterInput()
norm = ClusterInput()
ptr = ClusterInput()
group_id = ClusterInput()
cell = ClusterInput()
pos = ClusterInput()
integer = ClusterInput()
text = ClusterInput()
integer_2 = ClusterInput()
x_2 = ClusterInput()
ghpython_script = GhPythonScript(x=text)  # -> a
# ---------- ghpython_script: Python ----------
__author__ = "altai"
__version__ = "2021.08.09"

import rhinoscriptsyntax as rs

a = x.strip()
# ---------- end ghpython_script ----------
ghpython_script_2 = GhPythonScript(x=x_2)  # -> a; same code as ghpython_script
text_2 = Text(text)
text_3 = Text(ghpython_script_2)
sort_list = SortList(
    Keys=flatten(who),
    ValuesColor=flatten(color),
    ValuesNorm=flatten(norm),
    ValuesPtr=flatten(ptr),
    ValuesGroup_id=flatten(group_id),
    ValuesCell=flatten(cell),
    ValuesPos=flatten(pos))  # -> Keys, ValuesColor, ValuesNorm, ValuesPtr, ValuesGroup_id, ValuesCell, ValuesPos
python = GhPythonScript(x=x, who=who, color=color, norm=norm, ptr=ptr, group_id=group_id, cell=cell, pos=pos)  # -> text_pos, text; inputs pos: Point3d
# ---------- python: Python ----------
__author__ = "LYang"
__version__ = "2021.07.12"

import rhinoscriptsyntax as rs
import Rhino

if who >= 0:
    text_pos = Rhino.Geometry.Point3d(pos.X,pos.Y+2.5*x,pos.Z)
    text = "who: " + str(int(who)) + '\n' + "color: " + str(int(color)) + '\n' + "norm: " + str(norm)+ '\n' + "ptr: " + str(ptr)+ '\n' + "group_id: " + str(int(group_id))+ '\n'
# ---------- end python ----------
integer_3 = Integer(integer)
integer_4 = Integer(integer_2)
integer_5 = Integer(sort_list.Keys)
member_index = MemberIndex(Set=integer_5, Member=integer_4)  # -> simplify(Index), Count
who_2 = MemberIndex(Set=integer_5, Member=integer_3)  # -> simplify(Index), Count
text_outlines = TextOutlines(TextContent=python.text, Plane=python.text_pos, Face="Arial", Size=expr("x/1.75", x), Bold=False, Italics=False)  # -> TextCurves, TextBoundingBox
explode = Explode(Curve=sort_list.ValuesCell, Recursive=True)  # -> Segments, Vertices
color_2 = ListItem(List=sort_list.ValuesColor, Index=who_2.Index, Wrap=True)
norm_2 = ListItem(List=sort_list.ValuesNorm, Index=who_2.Index, Wrap=True)
ptr_2 = ListItem(List=sort_list.ValuesPtr, Index=who_2.Index, Wrap=True)
group_id_2 = ListItem(List=sort_list.ValuesGroup_id, Index=who_2.Index, Wrap=True)
cell_2 = ListItem(List=sort_list.ValuesCell, Index=who_2.Index, Wrap=True)
pos_2 = ListItem(List=sort_list.ValuesPos, Index=who_2.Index, Wrap=True)
color_3 = ListItem(List=sort_list.ValuesColor, Index=member_index.Index, Wrap=True)
norm_3 = ListItem(List=sort_list.ValuesNorm, Index=member_index.Index, Wrap=True)
ptr_3 = ListItem(List=sort_list.ValuesPtr, Index=member_index.Index, Wrap=True)
group_id_3 = ListItem(List=sort_list.ValuesGroup_id, Index=member_index.Index, Wrap=True)
group_id_4 = ListItem(List=sort_list.ValuesCell, Index=member_index.Index, Wrap=True)
pos_3 = ListItem(List=sort_list.ValuesPos, Index=member_index.Index, Wrap=True)
line = Line(StartPoint=graft(pos_2), EndPoint=graft(pos_3))  # -> simplify(flatten(Line))
bounding_rectangle = BoundingRectangle(Geometry=text_outlines.TextCurves, Plane=PlaneXY(0, 0, 0), Axis=0, Slide=0, Union=True)  # -> Bounding, DimensionX, DimensionY
dupln = RemoveDuplicateLines(Lines=flatten(explode.Segments), Tolerance=0.01)
center = Center(Geometric=bounding_rectangle.Bounding)  # -> Center, Dimension
ghpython_script_3 = GhPythonScript(
    edge=flatten(dupln),
    con=flatten(line),
    who_1=flatten(who_2.Index),
    type_1=flatten(text_2),
    color_1=flatten(color_2),
    norm_1=flatten(norm_2),
    ptr_1=flatten(ptr_2),
    group_id_1=flatten(group_id_2),
    cell_1=flatten(cell_2),
    pos_1=flatten(pos_2),
    who_2=flatten(member_index.Index),
    type_2=flatten(text_3),
    color_2=flatten(color_3),
    norm_2=flatten(norm_3),
    ptr_2=flatten(ptr_3),
    group_id_2=flatten(group_id_3),
    cell_2=flatten(group_id_4),
    pos_2=flatten(pos_3))  # -> o_edge, o_who_1, o_type_1, o_color_1, o_norm_1, o_ptr_1, o_group_id_1, o_cell_1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; inputs edge: list of Curve, con: list of Curve, who_1: list of Int32, type_1: list, color_1: list of Int32, norm_1: list, ptr_1: list, group_id_1: list of Int32, cell_1: list, pos_1: list of Point3d, who_2: list of Int32, type_2: list, color_2: list of Int32, norm_2: list, ptr_2: list, group_id_2: list of Int32, cell_2: list, pos_2: list of Point3d
# ---------- ghpython_script_3: Python ----------
__author__ = "altai"
__version__ = "2021.07.12"

import rhinoscriptsyntax as rs
import Rhino

o_edge = []
o_who_1 = []
o_type_1 = []
o_color_1 = []
o_norm_1 = []
o_ptr_1 = []
o_group_id_1 = []
o_cell_1 = []
o_pos_1 = []
o_who_2 = []
o_type_2 = []
o_color_2 = []
o_norm_2 = []
o_ptr_2 = []
o_group_id_2 = []
o_cell_2 = []
o_pos_2 = []
found = False

for i in edge:
    for a,b1,b2,b3,b4,b5,b6,b7,b8,c1,c2,c3,c4,c5,c6,c7,c8 in zip(con,who_1,type_1,color_1,norm_1,ptr_1,group_id_1,cell_1,pos_1,who_2,type_2,color_2,norm_2,ptr_2,group_id_2,cell_2,pos_2):
        if rs.CurveCurveIntersection(i,a):
            o_edge.append(i)
            o_who_1.append(b1)
            o_type_1.append(b2)
            o_color_1.append(b3)
            o_norm_1.append(b4)
            o_ptr_1.append(b5)
            o_group_id_1.append(b6)
            o_cell_1.append(b7)
            o_pos_1.append(b8)
            o_who_2.append(c1)
            o_type_2.append(c2)
            o_color_2.append(c3)
            o_norm_2.append(c4)
            o_ptr_2.append(c5)
            o_group_id_2.append(c6)
            o_cell_2.append(c7)
            o_pos_2.append(c8)
            found = True
            break
    if found == False:
            o_edge.append(i)
            o_who_1.append(None)
            o_type_1.append(None)
            o_color_1.append(None)
            o_norm_1.append(None)
            o_ptr_1.append(None)
            o_group_id_1.append(None)
            o_cell_1.append(None)
            o_pos_1.append(None)
            o_who_2.append(None)
            o_type_2.append(None)
            o_color_2.append(None)
            o_norm_2.append(None)
            o_ptr_2.append(None)
            o_group_id_2.append(None)
            o_cell_2.append(None)
            o_pos_2.append(None)
    found = False
# ---------- end ghpython_script_3 ----------
geometry = Geometry(pos)
vector_2pt = Vector2Pt(PointA=center.Center, PointB=graft(geometry), Unitize=False)  # -> Vector, Length
move = Move(Geometry=text_outlines.TextCurves, Motion=vector_2pt.Vector)  # -> Geometry, Transform
cluster = Cluster(B=x, C=ghpython_script_3.o_edge, P=ghpython_script_3.o_pos_1)  # -> V, G
cluster_2 = Cluster(B=x, C=ghpython_script_3.o_edge, P=ghpython_script_3.o_pos_2)  # -> V, G
merge = Merge(Data1=graft(ghpython_script_3.o_who_1), Data2=graft(ghpython_script_3.o_who_2))  # -> simplify(Result)
merge_2 = Merge(Data1=graft(ghpython_script_3.o_type_1), Data2=graft(ghpython_script_3.o_type_2))  # -> simplify(Result)
merge_3 = Merge(Data1=graft(ghpython_script_3.o_color_1), Data2=graft(ghpython_script_3.o_color_2))  # -> simplify(Result)
merge_4 = Merge(Data1=graft(ghpython_script_3.o_norm_1), Data2=graft(ghpython_script_3.o_norm_2))  # -> simplify(Result)
merge_5 = Merge(Data1=graft(ghpython_script_3.o_ptr_1), Data2=graft(ghpython_script_3.o_ptr_2))  # -> simplify(Result)
merge_6 = Merge(Data1=graft(ghpython_script_3.o_group_id_1), Data2=graft(ghpython_script_3.o_group_id_2))  # -> simplify(Result)
merge_7 = Merge(Data1=graft(ghpython_script_3.o_cell_1), Data2=graft(ghpython_script_3.o_cell_2))  # -> simplify(Result)
merge_8 = Merge(Data1=graft(ghpython_script_3.o_pos_1), Data2=graft(ghpython_script_3.o_pos_2))  # -> simplify(Result)
graft_tree = GraftTree(Tree=ghpython_script_3.o_edge, IncludeEmptyLists=True, IncludeNullItems=True)  # -> simplify(Tree)
merge_9 = Merge(Data1=graft(cluster.V), Data2=graft(cluster_2.V))  # -> simplify(Result)
merge_10 = Merge(Data1=graft(cluster.G), Data2=graft(cluster_2.G))  # -> simplify(Result)
tree = ClusterOutput(graft_tree)
result = ClusterOutput(merge)
result_2 = ClusterOutput(merge_2)
result_3 = ClusterOutput(merge_3)
result_4 = ClusterOutput(merge_4)
result_5 = ClusterOutput(merge_5)
result_6 = ClusterOutput(merge_6)
result_7 = ClusterOutput(merge_7)
result_8 = ClusterOutput(merge_8)
R = ClusterOutput(merge_9)
text_outlines_2 = TextOutlines(TextContent=merge_2, Plane=merge_10, Face="Arial", Size=expr("x/1.75", x), Bold=False, Italics=False)  # -> TextCurves, TextBoundingBox
panel = Panel(merge_2)
bounding_rectangle_2 = BoundingRectangle(Geometry=text_outlines_2.TextCurves, Plane=PlaneXY(0, 0, 0), Axis=0, Slide=0, Union=True)  # -> Bounding, DimensionX, DimensionY
center_2 = Center(Geometric=bounding_rectangle_2.Bounding)  # -> Center, Dimension
list_item = ListItem(List=merge_2, Index=0, Wrap=True)
vector_2pt_2 = Vector2Pt(PointA=center_2.Center, PointB=graft(merge_10), Unitize=False)  # -> Vector, Length
ghpython_script_4 = GhPythonScript(x=list_item)  # -> flatten(a)
# ---------- ghpython_script_4: Python ----------
__author__ = "altai"
__version__ = "2021.09.01"

import rhinoscriptsyntax as rs

if x == "inter_comp" or x == "inter_coop":
    a = True
else:
    a = False
# ---------- end ghpython_script_4 ----------
ghpython_script_5 = GhPythonScript(x=list_item)  # -> flatten(a)
# ---------- ghpython_script_5: Python ----------
__author__ = "altai"
__version__ = "2021.09.01"

import rhinoscriptsyntax as rs

if x == "intra_comp" or x == "intra_coop":
    a = True
else:
    a = False
# ---------- end ghpython_script_5 ----------
move_2 = Move(Geometry=text_outlines_2.TextCurves, Motion=vector_2pt_2.Vector)  # -> Geometry, Transform
cull_pattern = CullPattern(List=flatten(graft_tree), CullPattern=ghpython_script_4)
cull_pattern_2 = CullPattern(List=flatten(graft_tree), CullPattern=ghpython_script_5)
text_info = ClusterOutput(move.Geometry)
text_edge = ClusterOutput(move_2.Geometry)
list = ClusterOutput(cull_pattern)
list_2 = ClusterOutput(cull_pattern_2)

# ==== cluster Wall
number = ClusterInput()
geometry = ClusterInput()
number_2 = Number(number)
geometry_2 = Geometry(geometry)
end_points = EndPoints(Curve=geometry_2)  # -> Start, End
vector_2pt = Vector2Pt(PointA=end_points.Start, PointB=end_points.End, Unitize=True)  # -> Vector, Length
reverse = Reverse(Vector=vector_2pt.Vector)
multiplication = Multiplication(A=vector_2pt.Vector, B=number_2)
multiplication_2 = Multiplication(A=reverse, B=number_2)
offset_curve = OffsetCurve(Distance=1, Corners=1)
move = Move(Geometry=end_points.End, Motion=multiplication)  # -> Geometry, Transform
move_2 = Move(Geometry=end_points.Start, Motion=multiplication_2)  # -> Geometry, Transform
curve_middle = CurveMiddle(Curve=geometry_2)
line = Line(StartPoint=move.Geometry, EndPoint=move_2.Geometry)  # -> simplify(Line)
vector_2pt_2 = Vector2Pt(PointA=curve_middle, PointB=move.Geometry, Unitize=False)  # -> Vector, Length
rotate = Rotate(Geometry=vector_2pt_2.Vector, Angle=0.7853981634, Plane=curve_middle)  # -> Geometry, Transform
length = Length(Curve=line)
construct_plane = ConstructPlane(Origin=curve_middle, XAxis=vector_2pt_2.Vector, YAxis=rotate.Geometry)
construct_domain = ConstructDomain(DomainStart=expr("0-0.5*x", length), DomainEnd=expr("0.5*x", length))
construct_domain_2 = ConstructDomain(DomainStart=expr("0-x", number_2), DomainEnd=number_2)
rectangle = Rectangle(Plane=construct_plane, XSize=construct_domain, YSize=construct_domain_2, Radius=0)  # -> Rectangle, Length
rectangle_2 = ClusterOutput(rectangle.Rectangle)

# ==== cluster Cluster_3
geometry = ClusterInput()
geometry_2 = ClusterInput()
geometry_3 = ClusterInput()
number = ClusterInput()
number_2 = ClusterInput()
number_3 = ClusterInput()
number_4 = ClusterInput()
name = ClusterInput()
t1 = ClusterInput()
t2 = ClusterInput()
type = ClusterInput()
text = ClusterInput()
vector = ClusterInput()
geometry_4 = Geometry(geometry)
geometry_5 = Geometry(geometry_2)
geometry_6 = Geometry(geometry_3)
number_5 = Number(number)
number_6 = Number(number_2)
number_7 = Number(number_3)
number_8 = Number(number_4)
type_2 = Text(type)
text_2 = Text(text)
vector_2 = Vector(vector)
g = GhPythonScript(direction=vector_2)  # -> bo; inputs direction: list
# ---------- g: Python ----------
__author__ = "altai"
__version__ = "2021.07.30"


import rhinoscriptsyntax as rs
if not direction[0] == None:
    bo = True
# ---------- end g ----------
edge = CullPattern(List=geometry_4, CullPattern=g)
who = CullPattern(List=number_5, CullPattern=g)
type_3 = CullPattern(List=type_2, CullPattern=g)
color = CullPattern(List=number_6, CullPattern=g)
norm = CullPattern(List=text_2, CullPattern=g)
ptr = CullPattern(List=number_7, CullPattern=g)
group_id = CullPattern(List=number_8, CullPattern=g)
cell = CullPattern(List=geometry_5, CullPattern=g)
pos = CullPattern(List=geometry_6, CullPattern=g)
direction = CullPattern(List=vector_2, CullPattern=g)
pos_1 = ListItem(List=pos, Index=0, Wrap=True)
pos_2 = ListItem(List=pos, Index=1, Wrap=True)
clean_tree = CleanTree(RemoveNulls=True, RemoveInvalid=True, RemoveEmpty=False, Tree=pos_1)
clean_tree_2 = CleanTree(RemoveNulls=True, RemoveInvalid=True, RemoveEmpty=False, Tree=pos_2)
end_points = EndPoints(Curve=edge)  # -> Start, End
distance = Distance(PointA=clean_tree, PointB=clean_tree_2)
length = Length(Curve=edge)
sort_list = SortList(Keys=flatten(length))  # -> Keys, ValuesValuesA
line = Line(StartPoint=[end_points.Start, end_points.End], EndPoint=clean_tree)
line_2 = Line(StartPoint=[end_points.Start, end_points.End], EndPoint=clean_tree_2)
edge_distance = Division(A=length, B=distance)
geometry_7 = Geometry(edge)
ghpython_script = GhPythonScript(name=name, x=geometry_7, length=length, length_list=sort_list.Keys, ratio=edge_distance, t1=t1, t2=t2)  # -> simplify(flatten(out)), wide_short, wide_long, wide_mid, deep_short, deep_long, deep_mid, square_short, square_long, square_mid; inputs name: list, length_list: list
# ---------- ghpython_script: Python ----------
__author__ = "altai"
__version__ = "2021.08.02"

import rhinoscriptsyntax as rs
import random
import itertools


choice=[]
def cal(mul):
    for m,n in zip(name,mul):
        choice.extend(itertools.repeat(m,n))
    return random.sample(choice,1)

if not ratio == None:
    if ratio > (1 + t1):
        if length < length_list[int(t2*len(length_list))]:
            out = cal([1,5,5,1,0,0,0,0,0,0,0,0,0,0])
            wide_short= x
        elif length > length_list[int((1-t2)*len(length_list))]:
            out = cal([0,6,6,0,0,0,0,3,3,4,0,0,3,0])
            wide_long = x
        else:
            out = cal([1,3,3,1,0,0,0,1,1,2,0,0,2,0])
            wide_mid = x
    elif ratio < (1 - t1): 
        if length < length_list[int(t2*len(length_list))]:
            out = cal([5,1,1,5,3,0,0,1,1,0,0,0,1,3])
            deep_short = x
        elif length > length_list[int((1-t2)*len(length_list))]:
            out = cal([1,1,1,1,4,2,0,0,0,0,0,0,2,4])
            deep_long = x
        else:
            out = cal([1,1,1,1,4,1,0,0,0,0,0,0,3,2])
            deep_mid = x
    else:
        if length < length_list[int(t2*len(length_list))]:
            out = cal([1,1,1,1,0,0,0,0,0,0,0,0,0,1])
            square_short = x
        elif length > length_list[int((1-t2)*len(length_list))]:
            out = cal([1,1,1,1,1,1,1,1,1,1,1,1,1,1])
            square_long = x
        else:
            out = cal([1,1,1,1,1,1,1,1,1,1,1,1,1,1])
            square_mid = x
# ---------- end ghpython_script ----------
graft_tree = GraftTree(Tree=ghpython_script.out, IncludeEmptyLists=True, IncludeNullItems=True)  # -> simplify(Tree)
geometry_8 = Geometry(ghpython_script.wide_short)
geometry_9 = Geometry(ghpython_script.wide_long)
geometry_10 = Geometry(ghpython_script.wide_mid)
geometry_11 = Geometry(ghpython_script.deep_short)
geometry_12 = Geometry(ghpython_script.deep_long)
geometry_13 = Geometry(ghpython_script.deep_mid)
geometry_14 = Geometry(ghpython_script.square_short)
geometry_15 = Geometry(ghpython_script.square_long)
geometry_16 = Geometry(ghpython_script.square_mid)
clean_tree_3 = CleanTree(RemoveNulls=True, RemoveInvalid=True, RemoveEmpty=False, Tree=graft_tree)
list = ClusterOutput(cell)
geometry_17 = ClusterOutput(geometry_7)
tree = ClusterOutput(clean_tree_3)
list_2 = ClusterOutput(type_3)
list_3 = ClusterOutput(pos)
line_3 = ClusterOutput(line)
line_4 = ClusterOutput(line_2)
list_4 = ClusterOutput(direction)

# ==== cluster InstantMessage
door_thickness = ClusterInput()
group_thickness = ClusterInput()
door_width = ClusterInput()
type = ClusterInput()
edge = ClusterInput()
direction = ClusterInput()
type_2 = ClusterInput()
edge_2 = ClusterInput()
direction_2 = ClusterInput()
type_3 = ClusterInput()
edge_3 = ClusterInput()
direction_3 = ClusterInput()
type_4 = ClusterInput()
edge_4 = ClusterInput()
direction_4 = ClusterInput()
type_5 = ClusterInput()
edge_5 = ClusterInput()
direction_5 = ClusterInput()
cluster = Cluster_6(cluster_input=door_thickness, cluster_input_2=group_thickness, x=door_width, tree=type, geometry=edge, s1=direction)  # -> wall_infra, wall_infra_2, gate_infra, wall_infra_3, door, dash, wall_inter, wall_inter_2, gate_inter
cluster_2 = Cluster_6(
    cluster_input=door_thickness,
    cluster_input_2=group_thickness,
    x=door_width,
    tree=type_2,
    geometry=edge_2,
    s1=direction_2)  # -> wall_infra, wall_infra_2, gate_infra, wall_infra_3, door, dash, wall_inter, wall_inter_2, gate_inter
cluster_3 = Cluster_6(
    cluster_input=door_thickness,
    cluster_input_2=group_thickness,
    x=door_width,
    tree=type_3,
    geometry=edge_3,
    s1=direction_3)  # -> wall_infra, wall_infra_2, gate_infra, wall_infra_3, door, dash, wall_inter, wall_inter_2, gate_inter
cluster_4 = Cluster_6(
    cluster_input=door_thickness,
    cluster_input_2=group_thickness,
    x=door_width,
    tree=type_4,
    geometry=edge_4,
    s1=direction_4)  # -> wall_infra, wall_infra_2, gate_infra, wall_infra_3, door, dash, wall_inter, wall_inter_2, gate_inter
cluster_5 = Cluster_6(
    cluster_input=door_thickness,
    cluster_input_2=group_thickness,
    x=door_width,
    tree=type_5,
    geometry=edge_5,
    s1=direction_5)  # -> wall_infra, wall_infra_2, gate_infra, wall_infra_3, door, dash, wall_inter, wall_inter_2, gate_inter
dup = GgRemoveDuplicates(
    Curves=flatten([cluster.wall_infra, cluster_2.wall_infra_2, cluster_3.wall_infra_3, cluster_4.wall_inter, cluster_5.wall_inter_2]),
    Tol=1e-06)
dup_2 = GgRemoveDuplicates(Curves=flatten([cluster_2.gate_infra, cluster_3.door, cluster_5.gate_inter]), Tol=1e-06)
dup_3 = GgRemoveDuplicates(Curves=flatten(cluster_3.dash), Tol=1e-06)
set = ClusterOutput(dup)
set_2 = ClusterOutput(dup_2)
set_3 = ClusterOutput(dup_3)

# ==== cluster DelayedMessage
cluster_input = ClusterInput()
cluster_input_2 = ClusterInput()
cluster_input_3 = ClusterInput()
type = ClusterInput()
edge = ClusterInput()
line_1 = ClusterInput()
line_2 = ClusterInput()
pos = ClusterInput()
direction = ClusterInput()
type_2 = ClusterInput()
edge_2 = ClusterInput()
line_1_2 = ClusterInput()
line_2_2 = ClusterInput()
pos_2 = ClusterInput()
direction_2 = ClusterInput()
type_3 = ClusterInput()
edge_3 = ClusterInput()
line_1_3 = ClusterInput()
line_2_3 = ClusterInput()
pos_3 = ClusterInput()
direction_3 = ClusterInput()
type_4 = ClusterInput()
edge_4 = ClusterInput()
line_1_4 = ClusterInput()
line_2_4 = ClusterInput()
pos_4 = ClusterInput()
direction_4 = ClusterInput()
type_5 = ClusterInput()
edge_5 = ClusterInput()
line_1_5 = ClusterInput()
line_2_5 = ClusterInput()
pos_5 = ClusterInput()
direction_5 = ClusterInput()
cluster = Cluster_7(
    cluster_input=cluster_input,
    cluster_input_2=cluster_input_2,
    x=cluster_input_3,
    tree=type,
    tree_2=edge,
    tree_3=line_1,
    tree_4=line_2,
    point=pos,
    vector=direction)  # -> result_3, result_4, geometry_6, result, result_2, inside, result_5, result_6, gate_inter
cluster_2 = Cluster_7(
    cluster_input=cluster_input,
    cluster_input_2=cluster_input_2,
    x=cluster_input_3,
    tree=type_2,
    tree_2=edge_2,
    tree_3=line_1_2,
    tree_4=line_2_2,
    point=pos_2,
    vector=direction_2)  # -> result_3, result_4, geometry_6, result, result_2, inside, result_5, result_6, gate_inter
cluster_3 = Cluster_7(
    cluster_input=cluster_input,
    cluster_input_2=cluster_input_2,
    x=cluster_input_3,
    tree=type_3,
    tree_2=edge_3,
    tree_3=line_1_3,
    tree_4=line_2_3,
    point=pos_3,
    vector=direction_3)  # -> result_3, result_4, geometry_6, result, result_2, inside, result_5, result_6, gate_inter
cluster_4 = Cluster_7(
    cluster_input=cluster_input,
    cluster_input_2=cluster_input_2,
    x=cluster_input_3,
    tree=type_4,
    tree_2=edge_4,
    tree_3=line_1_4,
    tree_4=line_2_4,
    point=pos_4,
    vector=direction_4)  # -> result_3, result_4, geometry_6, result, result_2, inside, result_5, result_6, gate_inter
cluster_5 = Cluster_7(
    cluster_input=cluster_input,
    cluster_input_2=cluster_input_2,
    x=cluster_input_3,
    tree=type_5,
    tree_2=edge_5,
    tree_3=line_1_5,
    tree_4=line_2_5,
    point=pos_5,
    vector=direction_5)  # -> result_3, result_4, geometry_6, result, result_2, inside, result_5, result_6, gate_inter
dup = GgRemoveDuplicates(
    Curves=flatten([cluster.result_3, cluster_2.result_4, cluster_3.result, cluster_4.result_5, cluster_5.result_6]),
    Tol=1e-06)
dup_2 = GgRemoveDuplicates(Curves=flatten([cluster_2.geometry_6, cluster_3.result_2, cluster_5.gate_inter]), Tol=1e-06)
dup_3 = GgRemoveDuplicates(Curves=flatten(cluster_3.inside), Tol=1e-06)
set = ClusterOutput(dup)
set_2 = ClusterOutput(dup_2)
set_3 = ClusterOutput(dup_3)

# ==== cluster Mention
cluster_input = ClusterInput()
cluster_input_2 = ClusterInput()
cluster_input_3 = ClusterInput()
type = ClusterInput()
edge = ClusterInput()
pos = ClusterInput()
direction = ClusterInput()
type_2 = ClusterInput()
edge_2 = ClusterInput()
pos_2 = ClusterInput()
direction_2 = ClusterInput()
type_3 = ClusterInput()
edge_3 = ClusterInput()
pos_3 = ClusterInput()
direction_3 = ClusterInput()
type_4 = ClusterInput()
edge_4 = ClusterInput()
pos_4 = ClusterInput()
direction_4 = ClusterInput()
type_5 = ClusterInput()
edge_5 = ClusterInput()
pos_5 = ClusterInput()
direction_5 = ClusterInput()
cluster = Cluster_8(
    cluster_input=cluster_input,
    cluster_input_2=cluster_input_2,
    A=cluster_input_3,
    tree=type,
    tree_2=edge,
    point=pos,
    vector=direction)  # -> outside, curves, outside_2, geometry_3, curves_2, outside_3, line_7, inside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
cluster_2 = Cluster_8(
    cluster_input=cluster_input,
    cluster_input_2=cluster_input_2,
    A=cluster_input_3,
    tree=type_2,
    tree_2=edge_2,
    point=pos_2,
    vector=direction_2)  # -> outside, curves, outside_2, geometry_3, curves_2, outside_3, line_7, inside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
cluster_3 = Cluster_8(
    cluster_input=cluster_input,
    cluster_input_2=cluster_input_2,
    A=cluster_input_3,
    tree=type_3,
    tree_2=edge_3,
    point=pos_3,
    vector=direction_3)  # -> outside, curves, outside_2, geometry_3, curves_2, outside_3, line_7, inside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
cluster_4 = Cluster_8(
    cluster_input=cluster_input,
    cluster_input_2=cluster_input_2,
    A=cluster_input_3,
    tree=type_4,
    tree_2=edge_4,
    point=pos_4,
    vector=direction_4)  # -> outside, curves, outside_2, geometry_3, curves_2, outside_3, line_7, inside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
cluster_5 = Cluster_8(
    cluster_input=cluster_input,
    cluster_input_2=cluster_input_2,
    A=cluster_input_3,
    tree=type_5,
    tree_2=edge_5,
    point=pos_5,
    vector=direction_5)  # -> outside, curves, outside_2, geometry_3, curves_2, outside_3, line_7, inside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
dup = GgRemoveDuplicates(
    Curves=flatten([cluster.outside, cluster_2.outside_2, cluster_3.outside_3, cluster_4.wall_inter, cluster_5.wall_inter_2]),
    Tol=1e-06)
dup_2 = GgRemoveDuplicates(
    Curves=flatten([cluster.curves, cluster_2.curves_2, cluster_3.curves_3, cluster_4.curves_4, cluster_5.curves_5]),
    Tol=1e-06)
dup_3 = GgRemoveDuplicates(Curves=flatten([cluster_3.line_7, cluster_2.geometry_3, cluster.geometry_3, cluster_5.gate_inter]), Tol=1e-06)
dup_4 = GgRemoveDuplicates(Curves=flatten(cluster_3.inside), Tol=1e-06)
set = ClusterOutput(dup)
set_2 = ClusterOutput(dup_2)
set_3 = ClusterOutput(dup_3)
set_4 = ClusterOutput(dup_4)

# ==== cluster Publish
door_thickness = ClusterInput()
group_thickness = ClusterInput()
door_width = ClusterInput()
type = ClusterInput()
edge = ClusterInput()
pos = ClusterInput()
direction = ClusterInput()
type_2 = ClusterInput()
edge_2 = ClusterInput()
pos_2 = ClusterInput()
direction_2 = ClusterInput()
type_3 = ClusterInput()
edge_3 = ClusterInput()
pos_3 = ClusterInput()
direction_3 = ClusterInput()
type_4 = ClusterInput()
edge_4 = ClusterInput()
pos_4 = ClusterInput()
direction_4 = ClusterInput()
type_5 = ClusterInput()
edge_5 = ClusterInput()
pos_5 = ClusterInput()
direction_5 = ClusterInput()
cluster = Cluster_11(
    cluster_input=door_thickness,
    cluster_input_2=group_thickness,
    x=door_width,
    tree=type,
    geometry=edge,
    s1=pos,
    vector=direction)  # -> _1_wall, _1_window, _1_below, _2_wall, _2_window, _3_wall, _3_window, _4_wall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
cluster_2 = Cluster_11(
    cluster_input=door_thickness,
    cluster_input_2=group_thickness,
    x=door_width,
    tree=type_2,
    geometry=edge_2,
    s1=pos_2,
    vector=direction_2)  # -> _1_wall, _1_window, _1_below, _2_wall, _2_window, _3_wall, _3_window, _4_wall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
cluster_3 = Cluster_11(
    cluster_input=door_thickness,
    cluster_input_2=group_thickness,
    x=door_width,
    tree=type_3,
    geometry=edge_3,
    s1=pos_3,
    vector=direction_3)  # -> _1_wall, _1_window, _1_below, _2_wall, _2_window, _3_wall, _3_window, _4_wall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
cluster_4 = Cluster_11(
    cluster_input=door_thickness,
    cluster_input_2=group_thickness,
    x=door_width,
    tree=type_4,
    geometry=edge_4,
    s1=pos_4,
    vector=direction_4)  # -> _1_wall, _1_window, _1_below, _2_wall, _2_window, _3_wall, _3_window, _4_wall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
cluster_5 = Cluster_11(
    cluster_input=door_thickness,
    cluster_input_2=group_thickness,
    x=door_width,
    tree=type_5,
    geometry=edge_5,
    s1=pos_5,
    vector=direction_5)  # -> _1_wall, _1_window, _1_below, _2_wall, _2_window, _3_wall, _3_window, _4_wall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
dup = GgRemoveDuplicates(Curves=flatten([cluster._1_wall, cluster_2._2_wall, cluster_3._3_wall, cluster_4._4_wall, cluster_5._5_wall]), Tol=1e-06)
dup_2 = GgRemoveDuplicates(
    Curves=flatten([cluster._1_window, cluster_2._2_window, cluster_3._3_window, cluster_4._4_window, cluster_5._5_window]),
    Tol=1e-06)
dup_3 = GgRemoveDuplicates(Curves=flatten([cluster._1_below, cluster_4._4_below]), Tol=1e-06)
set = ClusterOutput(dup)
set_2 = ClusterOutput(dup_2)
set_3 = ClusterOutput(dup_3)

# ==== cluster Relay
door_thickness = ClusterInput()
group_thickness = ClusterInput()
door_width = ClusterInput()
type = ClusterInput()
edge = ClusterInput()
line1 = ClusterInput()
line2 = ClusterInput()
pos = ClusterInput()
direction = ClusterInput()
type_2 = ClusterInput()
edge_2 = ClusterInput()
line1_2 = ClusterInput()
line2_2 = ClusterInput()
pos_2 = ClusterInput()
direction_2 = ClusterInput()
type_3 = ClusterInput()
edge_3 = ClusterInput()
line1_3 = ClusterInput()
line2_3 = ClusterInput()
pos_3 = ClusterInput()
direction_3 = ClusterInput()
type_4 = ClusterInput()
edge_4 = ClusterInput()
line1_4 = ClusterInput()
line2_4 = ClusterInput()
pos_4 = ClusterInput()
direction_4 = ClusterInput()
type_5 = ClusterInput()
edge_5 = ClusterInput()
line1_5 = ClusterInput()
line2_5 = ClusterInput()
pos_5 = ClusterInput()
direction_5 = ClusterInput()
cluster = Cluster_15(
    cluster_input=door_thickness,
    cluster_input_2=group_thickness,
    radius=door_width,
    tree_3=type,
    s1=edge,
    tree=line1,
    tree_2=line2,
    s2=pos,
    vector=direction)  # -> _1_wall, _1_wall_thin, _1_window, _1_below, _1_door, _1_dash, _2_wall, _2_wall_thin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
cluster_2 = Cluster_15(
    cluster_input=door_thickness,
    cluster_input_2=group_thickness,
    radius=door_width,
    tree_3=type_2,
    s1=edge_2,
    tree=line1_2,
    tree_2=line2_2,
    s2=pos_2,
    vector=direction_2)  # -> _1_wall, _1_wall_thin, _1_window, _1_below, _1_door, _1_dash, _2_wall, _2_wall_thin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
cluster_3 = Cluster_15(
    cluster_input=door_thickness,
    cluster_input_2=group_thickness,
    radius=door_width,
    tree_3=type_3,
    s1=edge_3,
    tree=line1_3,
    tree_2=line2_3,
    s2=pos_3,
    vector=direction_3)  # -> _1_wall, _1_wall_thin, _1_window, _1_below, _1_door, _1_dash, _2_wall, _2_wall_thin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
cluster_4 = Cluster_15(
    cluster_input=door_thickness,
    cluster_input_2=group_thickness,
    radius=door_width,
    tree_3=type_4,
    s1=edge_4,
    tree=line1_4,
    tree_2=line2_4,
    s2=pos_4,
    vector=direction_4)  # -> _1_wall, _1_wall_thin, _1_window, _1_below, _1_door, _1_dash, _2_wall, _2_wall_thin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
cluster_5 = Cluster_15(
    cluster_input=door_thickness,
    cluster_input_2=group_thickness,
    radius=door_width,
    tree_3=type_5,
    s1=edge_5,
    tree=line1_5,
    tree_2=line2_5,
    s2=pos_5,
    vector=direction_5)  # -> _1_wall, _1_wall_thin, _1_window, _1_below, _1_door, _1_dash, _2_wall, _2_wall_thin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
dup = GgRemoveDuplicates(Curves=flatten([cluster._1_wall, cluster_2._2_wall, cluster_3._3_wall, cluster_4._4_wall, cluster_5._5_wall]), Tol=1e-06)
dup_2 = GgRemoveDuplicates(
    Curves=flatten([cluster._1_wall_thin, cluster_2._2_wall_thin, cluster_3._3_wall_thin, cluster_4._4_wall_thin, cluster_5._5_wall_thin]),
    Tol=1e-06)
dup_3 = GgRemoveDuplicates(
    Curves=flatten([cluster._1_window, cluster_2._2_window, cluster_3._3_window, cluster_4._4_window, cluster_5._5_window]),
    Tol=1e-06)
dup_4 = GgRemoveDuplicates(Curves=flatten([cluster._1_below, cluster_4._4_below]), Tol=1e-06)
dup_5 = GgRemoveDuplicates(Curves=flatten([cluster._1_door, cluster_2._2_door, cluster_3._3_door, cluster_5._5_door]), Tol=1e-06)
dup_6 = GgRemoveDuplicates(Curves=flatten([cluster_2._2_dash, cluster_3._3_dash, cluster._1_dash]), Tol=1e-06)
set = ClusterOutput(dup)
set_2 = ClusterOutput(dup_2)
set_3 = ClusterOutput(dup_3)
set_4 = ClusterOutput(dup_4)
set_5 = ClusterOutput(dup_5)
set_6 = ClusterOutput(dup_6)

# ==== cluster Review
door_thickness = ClusterInput()
group_thickness = ClusterInput()
door_width = ClusterInput()
type = ClusterInput()
edge = ClusterInput()
line_1 = ClusterInput()
line_2 = ClusterInput()
pos = ClusterInput()
direction = ClusterInput()
type_2 = ClusterInput()
edge_2 = ClusterInput()
line_1_2 = ClusterInput()
line_2_2 = ClusterInput()
pos_2 = ClusterInput()
direction_2 = ClusterInput()
type_3 = ClusterInput()
edge_3 = ClusterInput()
line_1_3 = ClusterInput()
line_2_3 = ClusterInput()
pos_3 = ClusterInput()
direction_3 = ClusterInput()
type_4 = ClusterInput()
edge_4 = ClusterInput()
line_1_4 = ClusterInput()
line_2_4 = ClusterInput()
pos_4 = ClusterInput()
direction_4 = ClusterInput()
type_5 = ClusterInput()
edge_5 = ClusterInput()
line_1_5 = ClusterInput()
line_2_5 = ClusterInput()
pos_5 = ClusterInput()
direction_5 = ClusterInput()
cluster = Cluster_16(
    cluster_input=door_thickness,
    cluster_input_2=group_thickness,
    B=door_width,
    tree=type,
    geometry_3=edge,
    geometry=line_1,
    geometry_2=line_2,
    s1=pos,
    vector=direction)  # -> _1_wall, _1_window, _1_below, _2_wall, _2_window, _3_wall, _3_window, _4_wall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
cluster_2 = Cluster_16(
    cluster_input=door_thickness,
    cluster_input_2=group_thickness,
    B=door_width,
    tree=type_2,
    geometry_3=edge_2,
    geometry=line_1_2,
    geometry_2=line_2_2,
    s1=pos_2,
    vector=direction_2)  # -> _1_wall, _1_window, _1_below, _2_wall, _2_window, _3_wall, _3_window, _4_wall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
cluster_3 = Cluster_16(
    cluster_input=door_thickness,
    cluster_input_2=group_thickness,
    B=door_width,
    tree=type_3,
    geometry_3=edge_3,
    geometry=line_1_3,
    geometry_2=line_2_3,
    s1=pos_3,
    vector=direction_3)  # -> _1_wall, _1_window, _1_below, _2_wall, _2_window, _3_wall, _3_window, _4_wall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
cluster_4 = Cluster_16(
    cluster_input=door_thickness,
    cluster_input_2=group_thickness,
    B=door_width,
    tree=type_4,
    geometry_3=edge_4,
    geometry=line_1_4,
    geometry_2=line_2_4,
    s1=pos_4,
    vector=direction_4)  # -> _1_wall, _1_window, _1_below, _2_wall, _2_window, _3_wall, _3_window, _4_wall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
cluster_5 = Cluster_16(
    cluster_input=door_thickness,
    cluster_input_2=group_thickness,
    B=door_width,
    tree=type_5,
    geometry_3=edge_5,
    geometry=line_1_5,
    geometry_2=line_2_5,
    s1=pos_5,
    vector=direction_5)  # -> _1_wall, _1_window, _1_below, _2_wall, _2_window, _3_wall, _3_window, _4_wall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
dup = GgRemoveDuplicates(Curves=flatten([cluster._1_wall, cluster_2._2_wall, cluster_3._3_wall, cluster_4._4_wall, cluster_5._5_wall]), Tol=1e-06)
dup_2 = GgRemoveDuplicates(
    Curves=flatten([cluster._1_window, cluster_2._2_window, cluster_3._3_window, cluster_4._4_window, cluster_5._5_window]),
    Tol=1e-06)
dup_3 = GgRemoveDuplicates(Curves=flatten([cluster._1_below, cluster_4._4_below]), Tol=1e-06)
set = ClusterOutput(dup)
set_2 = ClusterOutput(dup_2)
set_3 = ClusterOutput(dup_3)

# ==== cluster Arc
number = ClusterInput()
geometry = ClusterInput()
number_2 = Number(number)
geometry_2 = Geometry(geometry)
subtraction = Subtraction(A=0, B=number_2)
offset_curve = OffsetCurve(Curve=simplify(graft(geometry_2)), Distance=[number_2, subtraction], Corners=1)  # -> simplify(Curve)
trim_tree = TrimTree(Tree=offset_curve, Depth=1)  # -> simplify(Tree)
list_item = ListItem(List=trim_tree, Index=0, Wrap=True)  # -> Item, Item1
flip_curve = FlipCurve(Curve=list_item.Item, Guide=list_item.Item1)  # -> Curve, Flag
end_points = EndPoints(Curve=flip_curve.Curve)  # -> Start, End
end_points_2 = EndPoints(Curve=list_item.Item1)  # -> Start, End
line = Line(StartPoint=end_points.Start, EndPoint=end_points_2.Start)
line_2 = Line(StartPoint=end_points.End, EndPoint=end_points_2.End)
merge = Merge(Data1=trim_tree, Data2=line, Data3=line_2)
join_curves = JoinCurves(Curves=merge, Preserve=False)  # -> simplify(Curves)
curves = ClusterOutput(join_curves)

# ==== cluster Discussion
door_thickness = ClusterInput()
group_thickness = ClusterInput()
door_width = ClusterInput()
type = ClusterInput()
edge = ClusterInput()
line_1 = ClusterInput()
line_2 = ClusterInput()
pos = ClusterInput()
direction = ClusterInput()
type_2 = ClusterInput()
edge_2 = ClusterInput()
line_1_2 = ClusterInput()
line_2_2 = ClusterInput()
pos_2 = ClusterInput()
direction_2 = ClusterInput()
type_3 = ClusterInput()
edge_3 = ClusterInput()
line_1_3 = ClusterInput()
line_2_3 = ClusterInput()
pos_3 = ClusterInput()
direction_3 = ClusterInput()
type_4 = ClusterInput()
edge_4 = ClusterInput()
line_1_4 = ClusterInput()
line_2_4 = ClusterInput()
pos_4 = ClusterInput()
direction_4 = ClusterInput()
type_5 = ClusterInput()
edge_5 = ClusterInput()
line_1_5 = ClusterInput()
line_2_5 = ClusterInput()
pos_5 = ClusterInput()
direction_5 = ClusterInput()
cluster = Cluster_18(
    cluster_input=door_thickness,
    cluster_input_2=group_thickness,
    B=door_width,
    tree=type,
    geometry_3=edge,
    geometry=line_1,
    geometry_2=line_2,
    s4=pos,
    vector=direction)  # -> _1_wall, _1_arc, _2_wall, _2_arc, _3_wall, _3_arc, _4_wall, _4_arc, _5_wall, _5_arc
cluster_2 = Cluster_18(
    cluster_input=door_thickness,
    cluster_input_2=group_thickness,
    B=door_width,
    tree=type_2,
    geometry_3=edge_2,
    geometry=line_1_2,
    geometry_2=line_2_2,
    s4=pos_2,
    vector=direction_2)  # -> _1_wall, _1_arc, _2_wall, _2_arc, _3_wall, _3_arc, _4_wall, _4_arc, _5_wall, _5_arc
cluster_3 = Cluster_18(
    cluster_input=door_thickness,
    cluster_input_2=group_thickness,
    B=door_width,
    tree=type_3,
    geometry_3=edge_3,
    geometry=line_1_3,
    geometry_2=line_2_3,
    s4=pos_3,
    vector=direction_3)  # -> _1_wall, _1_arc, _2_wall, _2_arc, _3_wall, _3_arc, _4_wall, _4_arc, _5_wall, _5_arc
cluster_4 = Cluster_18(
    cluster_input=door_thickness,
    cluster_input_2=group_thickness,
    B=door_width,
    tree=type_4,
    geometry_3=edge_4,
    geometry=line_1_4,
    geometry_2=line_2_4,
    s4=pos_4,
    vector=direction_4)  # -> _1_wall, _1_arc, _2_wall, _2_arc, _3_wall, _3_arc, _4_wall, _4_arc, _5_wall, _5_arc
cluster_5 = Cluster_18(
    cluster_input=door_thickness,
    cluster_input_2=group_thickness,
    B=door_width,
    tree=type_5,
    geometry_3=edge_5,
    geometry=line_1_5,
    geometry_2=line_2_5,
    s4=pos_5,
    vector=direction_5)  # -> _1_wall, _1_arc, _2_wall, _2_arc, _3_wall, _3_arc, _4_wall, _4_arc, _5_wall, _5_arc
dup = GgRemoveDuplicates(Curves=flatten([cluster._1_wall, cluster_2._2_wall, cluster_3._3_wall, cluster_4._4_wall, cluster_5._5_wall]), Tol=1e-06)
dup_2 = GgRemoveDuplicates(Curves=flatten([cluster._1_arc, cluster_2._2_arc, cluster_3._3_arc, cluster_4._4_arc, cluster_5._5_arc]), Tol=1e-06)
set = ClusterOutput(dup)
set_2 = ClusterOutput(dup_2)

# ==== cluster Review_2
door_thickness = ClusterInput()
group_thickness = ClusterInput()
door_width = ClusterInput()
type = ClusterInput()
edge = ClusterInput()
line_1 = ClusterInput()
line_2 = ClusterInput()
pos = ClusterInput()
direction = ClusterInput()
type_2 = ClusterInput()
edge_2 = ClusterInput()
line_1_2 = ClusterInput()
line_2_2 = ClusterInput()
pos_2 = ClusterInput()
direction_2 = ClusterInput()
type_3 = ClusterInput()
edge_3 = ClusterInput()
line_1_3 = ClusterInput()
line_2_3 = ClusterInput()
pos_3 = ClusterInput()
direction_3 = ClusterInput()
type_4 = ClusterInput()
edge_4 = ClusterInput()
line_1_4 = ClusterInput()
line_2_4 = ClusterInput()
pos_4 = ClusterInput()
direction_4 = ClusterInput()
type_5 = ClusterInput()
edge_5 = ClusterInput()
line_1_5 = ClusterInput()
line_2_5 = ClusterInput()
pos_5 = ClusterInput()
direction_5 = ClusterInput()
cluster = Cluster_19(
    cluster_input=door_thickness,
    B=group_thickness,
    B_2=door_width,
    tree=type,
    geometry_3=edge,
    geometry=line_1,
    geometry_2=line_2,
    s4=pos,
    vector=direction)  # -> _1_wall_thin, _1_window, _1_below, _2_wall_thin, _2_window, _3_wall_thin, _3_window, _4_window, _4_below, _5_window
cluster_2 = Cluster_19(
    cluster_input=door_thickness,
    B=group_thickness,
    B_2=door_width,
    tree=type_2,
    geometry_3=edge_2,
    geometry=line_1_2,
    geometry_2=line_2_2,
    s4=pos_2,
    vector=direction_2)  # -> _1_wall_thin, _1_window, _1_below, _2_wall_thin, _2_window, _3_wall_thin, _3_window, _4_window, _4_below, _5_window
cluster_3 = Cluster_19(
    cluster_input=door_thickness,
    B=group_thickness,
    B_2=door_width,
    tree=type_3,
    geometry_3=edge_3,
    geometry=line_1_3,
    geometry_2=line_2_3,
    s4=pos_3,
    vector=direction_3)  # -> _1_wall_thin, _1_window, _1_below, _2_wall_thin, _2_window, _3_wall_thin, _3_window, _4_window, _4_below, _5_window
cluster_4 = Cluster_19(
    cluster_input=door_thickness,
    B=group_thickness,
    B_2=door_width,
    tree=type_4,
    geometry_3=edge_4,
    geometry=line_1_4,
    geometry_2=line_2_4,
    s4=pos_4,
    vector=direction_4)  # -> _1_wall_thin, _1_window, _1_below, _2_wall_thin, _2_window, _3_wall_thin, _3_window, _4_window, _4_below, _5_window
cluster_5 = Cluster_19(
    cluster_input=door_thickness,
    B=group_thickness,
    B_2=door_width,
    tree=type_5,
    geometry_3=edge_5,
    geometry=line_1_5,
    geometry_2=line_2_5,
    s4=pos_5,
    vector=direction_5)  # -> _1_wall_thin, _1_window, _1_below, _2_wall_thin, _2_window, _3_wall_thin, _3_window, _4_window, _4_below, _5_window
dup = GgRemoveDuplicates(Curves=flatten([cluster._1_wall_thin, cluster_2._2_wall_thin, cluster_3._3_wall_thin]), Tol=1e-06)
dup_2 = GgRemoveDuplicates(
    Curves=flatten([cluster._1_window, cluster_2._2_window, cluster_3._3_window, cluster_4._4_window, cluster_5._5_window]),
    Tol=1e-06)
dup_3 = GgRemoveDuplicates(Curves=flatten([cluster._1_below, cluster_4._4_below]), Tol=1e-06)
set = ClusterOutput(dup)
set_2 = ClusterOutput(dup_2)
set_3 = ClusterOutput(dup_3)

# ==== cluster Broadcast
door_thickness = ClusterInput()
group_thickness = ClusterInput()
door_width = ClusterInput()
type = ClusterInput()
edge = ClusterInput()
line_1 = ClusterInput()
line_2 = ClusterInput()
pos = ClusterInput()
direction = ClusterInput()
type_2 = ClusterInput()
edge_2 = ClusterInput()
line_1_2 = ClusterInput()
line_2_2 = ClusterInput()
pos_2 = ClusterInput()
direction_2 = ClusterInput()
type_3 = ClusterInput()
edge_3 = ClusterInput()
line_1_3 = ClusterInput()
line_2_3 = ClusterInput()
pos_3 = ClusterInput()
direction_3 = ClusterInput()
type_4 = ClusterInput()
edge_4 = ClusterInput()
line_1_4 = ClusterInput()
line_2_4 = ClusterInput()
pos_4 = ClusterInput()
direction_4 = ClusterInput()
type_5 = ClusterInput()
edge_5 = ClusterInput()
line_1_5 = ClusterInput()
line_2_5 = ClusterInput()
pos_5 = ClusterInput()
direction_5 = ClusterInput()
cluster = Cluster_20(
    cluster_input=door_thickness,
    B=group_thickness,
    B_2=door_width,
    tree=type,
    geometry_3=edge,
    geometry=line_1,
    geometry_2=line_2,
    s4=pos,
    vector=direction)  # -> _1_wall, _1_wall_thin, _2_wall, _2_wall_thin, _3_wall, _3_wall_thin, _4_wall, _4_wall_thin, _5_wall, _5_wall_thin
cluster_2 = Cluster_20(
    cluster_input=door_thickness,
    B=group_thickness,
    B_2=door_width,
    tree=type_2,
    geometry_3=edge_2,
    geometry=line_1_2,
    geometry_2=line_2_2,
    s4=pos_2,
    vector=direction_2)  # -> _1_wall, _1_wall_thin, _2_wall, _2_wall_thin, _3_wall, _3_wall_thin, _4_wall, _4_wall_thin, _5_wall, _5_wall_thin
cluster_3 = Cluster_20(
    cluster_input=door_thickness,
    B=group_thickness,
    B_2=door_width,
    tree=type_3,
    geometry_3=edge_3,
    geometry=line_1_3,
    geometry_2=line_2_3,
    s4=pos_3,
    vector=direction_3)  # -> _1_wall, _1_wall_thin, _2_wall, _2_wall_thin, _3_wall, _3_wall_thin, _4_wall, _4_wall_thin, _5_wall, _5_wall_thin
cluster_4 = Cluster_20(
    cluster_input=door_thickness,
    B=group_thickness,
    B_2=door_width,
    tree=type_4,
    geometry_3=edge_4,
    geometry=line_1_4,
    geometry_2=line_2_4,
    s4=pos_4,
    vector=direction_4)  # -> _1_wall, _1_wall_thin, _2_wall, _2_wall_thin, _3_wall, _3_wall_thin, _4_wall, _4_wall_thin, _5_wall, _5_wall_thin
cluster_5 = Cluster_20(
    cluster_input=door_thickness,
    B=group_thickness,
    B_2=door_width,
    tree=type_5,
    geometry_3=edge_5,
    geometry=line_1_5,
    geometry_2=line_2_5,
    s4=pos_5,
    vector=direction_5)  # -> _1_wall, _1_wall_thin, _2_wall, _2_wall_thin, _3_wall, _3_wall_thin, _4_wall, _4_wall_thin, _5_wall, _5_wall_thin
dup = GgRemoveDuplicates(Curves=flatten([cluster._1_wall, cluster_2._2_wall, cluster_3._3_wall, cluster_4._4_wall, cluster_5._5_wall]), Tol=1e-06)
dup_2 = GgRemoveDuplicates(
    Curves=flatten([cluster._1_wall_thin, cluster_2._2_wall_thin, cluster_3._3_wall_thin, cluster_4._4_wall_thin, cluster_5._5_wall_thin]),
    Tol=1e-06)
set = ClusterOutput(dup)
set_2 = ClusterOutput(dup_2)

# ==== cluster SharedEconomy
door_thickness = ClusterInput()
group_thickness = ClusterInput()
door_width = ClusterInput()
type = ClusterInput()
edge = ClusterInput()
line_1 = ClusterInput()
line_2 = ClusterInput()
pos = ClusterInput()
direction = ClusterInput()
type_2 = ClusterInput()
edge_2 = ClusterInput()
line_1_2 = ClusterInput()
line_2_2 = ClusterInput()
pos_2 = ClusterInput()
direction_2 = ClusterInput()
type_3 = ClusterInput()
edge_3 = ClusterInput()
line_1_3 = ClusterInput()
line_2_3 = ClusterInput()
pos_3 = ClusterInput()
direction_3 = ClusterInput()
type_4 = ClusterInput()
edge_4 = ClusterInput()
line_1_4 = ClusterInput()
line_2_4 = ClusterInput()
pos_4 = ClusterInput()
direction_4 = ClusterInput()
type_5 = ClusterInput()
edge_5 = ClusterInput()
line_1_5 = ClusterInput()
line_2_5 = ClusterInput()
pos_5 = ClusterInput()
direction_5 = ClusterInput()
cluster = Cluster_21(
    cluster_input=door_thickness,
    cluster_input_2=group_thickness,
    radius=door_width,
    tree=type,
    geometry=edge,
    geometry_2=line_1,
    geometry_3=line_2,
    geometry_4=pos,
    vector=direction)  # -> _1_wall, _1_wall_thin, _2_wall, _2_wall_thin, _3_wall, _3_wall_thin, _3_window, _4_wall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
cluster_2 = Cluster_21(
    cluster_input=door_thickness,
    cluster_input_2=group_thickness,
    radius=door_width,
    tree=type_2,
    geometry=edge_2,
    geometry_2=line_1_2,
    geometry_3=line_2_2,
    geometry_4=pos_2,
    vector=direction_2)  # -> _1_wall, _1_wall_thin, _2_wall, _2_wall_thin, _3_wall, _3_wall_thin, _3_window, _4_wall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
cluster_3 = Cluster_21(
    cluster_input=door_thickness,
    cluster_input_2=group_thickness,
    radius=door_width,
    tree=type_3,
    geometry=edge_3,
    geometry_2=line_1_3,
    geometry_3=line_2_3,
    geometry_4=pos_3,
    vector=direction_3)  # -> _1_wall, _1_wall_thin, _2_wall, _2_wall_thin, _3_wall, _3_wall_thin, _3_window, _4_wall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
cluster_4 = Cluster_21(
    cluster_input=door_thickness,
    cluster_input_2=group_thickness,
    radius=door_width,
    tree=type_4,
    geometry=edge_4,
    geometry_2=line_1_4,
    geometry_3=line_2_4,
    geometry_4=pos_4,
    vector=direction_4)  # -> _1_wall, _1_wall_thin, _2_wall, _2_wall_thin, _3_wall, _3_wall_thin, _3_window, _4_wall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
cluster_5 = Cluster_21(
    cluster_input=door_thickness,
    cluster_input_2=group_thickness,
    radius=door_width,
    tree=type_5,
    geometry=edge_5,
    geometry_2=line_1_5,
    geometry_3=line_2_5,
    geometry_4=pos_5,
    vector=direction_5)  # -> _1_wall, _1_wall_thin, _2_wall, _2_wall_thin, _3_wall, _3_wall_thin, _3_window, _4_wall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
dup = GgRemoveDuplicates(Curves=flatten([cluster._1_wall, cluster_2._2_wall, cluster_3._3_wall, cluster_4._4_wall, cluster_5._5_wall]), Tol=1e-06)
dup_2 = GgRemoveDuplicates(
    Curves=flatten([cluster._1_wall_thin, cluster_2._2_wall_thin, cluster_3._3_wall_thin, cluster_4._4_wall_thin, cluster_5._5_wall_thin]),
    Tol=1e-06)
dup_3 = GgRemoveDuplicates(Curves=flatten(cluster_3._3_window), Tol=1e-06)
set = ClusterOutput(dup)
set_2 = ClusterOutput(dup_2)
set_3 = ClusterOutput(dup_3)

# ==== cluster Cluster_22
y = ClusterInput()
number = ClusterInput()
list = ClusterInput()
x = ClusterInput()
list_2 = ClusterInput()
list_3 = ClusterInput()
list_4 = ClusterInput()
list_5 = ClusterInput()
list_6 = ClusterInput()
boolean = GhPythonScript(y=y, x=x)  # -> out
# ---------- boolean: Python ----------
__author__ = "altai"
__version__ = "2021.08.08"

import rhinoscriptsyntax as rs

if x == y:
    out = True
else:
    out = False
# ---------- end boolean ----------
panel = Panel(boolean)
type = CullPattern(List=list_2, CullPattern=boolean)
edge = CullPattern(List=list, CullPattern=boolean)
line_1 = CullPattern(List=list_4, CullPattern=boolean)
line_2 = CullPattern(List=list_5, CullPattern=boolean)
pos = CullPattern(List=list_3, CullPattern=boolean)
direction = CullPattern(List=list_6, CullPattern=boolean)
clean_tree = CleanTree(
    RemoveNulls=True,
    RemoveInvalid=True,
    RemoveEmpty=True,
    Tree=type,
    SynchronousTree1=edge,
    SynchronousTree2=line_1,
    SynchronousTree3=line_2,
    SynchronousTree4=pos,
    SynchronousTree5=direction)  # -> Tree, SynchronousTree1, SynchronousTree2, SynchronousTree3, SynchronousTree4, SynchronousTree5
ghpython_script = GhPythonScript(
    type=clean_tree.Tree,
    edge=clean_tree.SynchronousTree1,
    line_1=clean_tree.SynchronousTree2,
    line_2=clean_tree.SynchronousTree3,
    pos=clean_tree.SynchronousTree4,
    direction=clean_tree.SynchronousTree5)  # -> type1, type1_edge, type1_line_1, type1_line_2, type1_pos, type1_direction, type2, type2_edge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; inputs type: list, line_1: list, line_2: list, pos: list, direction: list
# ---------- ghpython_script: Python ----------
__author__ = "altai"
__version__ = "2021.08.08"

import rhinoscriptsyntax as rs

if type[0] == "intra_coop" and type[1] == "intra_coop":
    type1 = type
    type1_edge = edge
    type1_line_1 = line_1
    type1_line_2 = line_2
    type1_pos = pos
    type1_direction = direction
elif type[0] == "intra_comp" and type[1] == "intra_comp":
    type2 = type
    type2_edge = edge
    type2_line_1 = line_1
    type2_line_2 = line_2
    type2_pos = pos
    type2_direction = direction
elif not type[0] == type[1]:
    type3 = type
    type3_edge = edge
    type3_line_1 = line_1
    type3_line_2 = line_2
    type3_pos = pos
    type3_direction = direction
elif type[0] == "inter_coop" and type[1] == "inter_coop":
    type4 = type
    type4_edge = edge
    type4_line_1 = line_1
    type4_line_2 = line_2
    type4_pos = pos
    type4_direction = direction
elif type[0] == "inter_comp" and type[1] == "inter_comp":
    type5 = type
    type5_edge = edge
    type5_line_1 = line_1
    type5_line_2 = line_2
    type5_pos = pos
    type5_direction = direction
# ---------- end ghpython_script ----------
number_2 = Number(number)
group_thickness = Division(A=number_2, B=4)
door_width = Multiplication(A=number_2, B=2)
door_thickness = Division(A=group_thickness, B=4)
result = ClusterOutput(group_thickness)
result_2 = ClusterOutput(door_thickness)
result_3 = ClusterOutput(door_width)
type1 = ClusterOutput(ghpython_script.type1)
type1_edge = ClusterOutput(ghpython_script.type1_edge)
type1_line_1 = ClusterOutput(ghpython_script.type1_line_1)
type1_line_2 = ClusterOutput(ghpython_script.type1_line_2)
type1_pos = ClusterOutput(ghpython_script.type1_pos)
type1_direction = ClusterOutput(ghpython_script.type1_direction)
type2 = ClusterOutput(ghpython_script.type2)
type2_edge = ClusterOutput(ghpython_script.type2_edge)
type2_direction = ClusterOutput(ghpython_script.type2_direction)
type3 = ClusterOutput(ghpython_script.type3)
type3_edge = ClusterOutput(ghpython_script.type3_edge)
type3_direction = ClusterOutput(ghpython_script.type3_direction)
type4 = ClusterOutput(ghpython_script.type4)
type4_edge = ClusterOutput(ghpython_script.type4_edge)
type4_direction = ClusterOutput(ghpython_script.type4_direction)
type5 = ClusterOutput(ghpython_script.type5)
type5_edge = ClusterOutput(ghpython_script.type5_edge)
type5_direction = ClusterOutput(ghpython_script.type5_direction)
type4_line_1 = ClusterOutput(ghpython_script.type4_line_1)
type4_line_2 = ClusterOutput(ghpython_script.type4_line_2)
type4_pos = ClusterOutput(ghpython_script.type4_pos)
type5_line_1 = ClusterOutput(ghpython_script.type5_line_1)
type5_line_2 = ClusterOutput(ghpython_script.type5_line_2)
type5_pos = ClusterOutput(ghpython_script.type5_pos)
type2_line_1 = ClusterOutput(ghpython_script.type2_line_1)
type2_line_2 = ClusterOutput(ghpython_script.type2_line_2)
type2_pos = ClusterOutput(ghpython_script.type2_pos)
type3_line_1 = ClusterOutput(ghpython_script.type3_line_1)
type3_line_2 = ClusterOutput(ghpython_script.type3_line_2)
type3_pos = ClusterOutput(ghpython_script.type3_pos)

# ==== cluster Curation
door_thickness = ClusterInput()
group_thickness = ClusterInput()
door_width = ClusterInput()
type = ClusterInput()
edge = ClusterInput()
line_1 = ClusterInput()
line_2 = ClusterInput()
pos = ClusterInput()
direction = ClusterInput()
type_2 = ClusterInput()
edge_2 = ClusterInput()
line_1_2 = ClusterInput()
line_2_2 = ClusterInput()
pos_2 = ClusterInput()
direction_2 = ClusterInput()
type_3 = ClusterInput()
edge_3 = ClusterInput()
line_1_3 = ClusterInput()
line_2_3 = ClusterInput()
pos_3 = ClusterInput()
direction_3 = ClusterInput()
type_4 = ClusterInput()
edge_4 = ClusterInput()
line_1_4 = ClusterInput()
line_2_4 = ClusterInput()
pos_4 = ClusterInput()
direction_4 = ClusterInput()
type_5 = ClusterInput()
edge_5 = ClusterInput()
line_1_5 = ClusterInput()
line_2_5 = ClusterInput()
pos_5 = ClusterInput()
direction_5 = ClusterInput()
cluster = Cluster_23(
    door_thickness=door_thickness,
    radius=group_thickness,
    y=door_width,
    tree=type,
    geometry=edge,
    geometry_2=line_1,
    geometry_3=line_2,
    geometry_4=pos,
    vector=direction)  # -> _1_wall, _1_wall_thin, _2_wall, _2_wall_thin, _3_wall, _3_wall_thin, _4_wall, _5_wall, _5_wall_thin
cluster_2 = Cluster_23(
    door_thickness=door_thickness,
    radius=group_thickness,
    y=door_width,
    tree=type_2,
    geometry=edge_2,
    geometry_2=line_1_2,
    geometry_3=line_2_2,
    geometry_4=pos_2,
    vector=direction_2)  # -> _1_wall, _1_wall_thin, _2_wall, _2_wall_thin, _3_wall, _3_wall_thin, _4_wall, _5_wall, _5_wall_thin
cluster_3 = Cluster_23(
    door_thickness=door_thickness,
    radius=group_thickness,
    y=door_width,
    tree=type_3,
    geometry=edge_3,
    geometry_2=line_1_3,
    geometry_3=line_2_3,
    geometry_4=pos_3,
    vector=direction_3)  # -> _1_wall, _1_wall_thin, _2_wall, _2_wall_thin, _3_wall, _3_wall_thin, _4_wall, _5_wall, _5_wall_thin
cluster_4 = Cluster_23(
    door_thickness=door_thickness,
    radius=group_thickness,
    y=door_width,
    tree=type_4,
    geometry=edge_4,
    geometry_2=line_1_4,
    geometry_3=line_2_4,
    geometry_4=pos_4,
    vector=direction_4)  # -> _1_wall, _1_wall_thin, _2_wall, _2_wall_thin, _3_wall, _3_wall_thin, _4_wall, _5_wall, _5_wall_thin
cluster_5 = Cluster_23(
    door_thickness=door_thickness,
    radius=group_thickness,
    y=door_width,
    tree=type_5,
    geometry=edge_5,
    geometry_2=line_1_5,
    geometry_3=line_2_5,
    geometry_4=pos_5,
    vector=direction_5)  # -> _1_wall, _1_wall_thin, _2_wall, _2_wall_thin, _3_wall, _3_wall_thin, _4_wall, _5_wall, _5_wall_thin
dup = GgRemoveDuplicates(Curves=flatten([cluster._1_wall, cluster_2._2_wall, cluster_3._3_wall, cluster_4._4_wall, cluster_5._5_wall]), Tol=1e-06)
dup_2 = GgRemoveDuplicates(
    Curves=flatten([cluster._1_wall_thin, cluster_2._2_wall_thin, cluster_3._3_wall_thin, cluster_5._5_wall_thin]),
    Tol=1e-06)
set = ClusterOutput(dup_2)
set_2 = ClusterOutput(dup)

# ==== cluster SharedEconomy_2
door_thickness = ClusterInput()
group_thickness = ClusterInput()
door_width = ClusterInput()
type = ClusterInput()
edge = ClusterInput()
line_1 = ClusterInput()
line_2 = ClusterInput()
pos = ClusterInput()
direction = ClusterInput()
type_2 = ClusterInput()
edge_2 = ClusterInput()
line_1_2 = ClusterInput()
line_2_2 = ClusterInput()
pos_2 = ClusterInput()
direction_2 = ClusterInput()
type_3 = ClusterInput()
edge_3 = ClusterInput()
line_1_3 = ClusterInput()
line_2_3 = ClusterInput()
pos_3 = ClusterInput()
direction_3 = ClusterInput()
type_4 = ClusterInput()
edge_4 = ClusterInput()
line_1_4 = ClusterInput()
line_2_4 = ClusterInput()
pos_4 = ClusterInput()
direction_4 = ClusterInput()
type_5 = ClusterInput()
edge_5 = ClusterInput()
line_1_5 = ClusterInput()
line_2_5 = ClusterInput()
pos_5 = ClusterInput()
direction_5 = ClusterInput()
cluster = Cluster_24(
    door_thickness=door_thickness,
    radius=group_thickness,
    y=door_width,
    tree=type,
    geometry=edge,
    geometry_2=line_1,
    geometry_3=line_2,
    geometry_4=pos,
    vector=direction)  # -> _1_wall, _1_wall_thin, _2_wall, _2_wall_thin, _3_wall, _3_wall_thin, _4_wall_thin, _5_wall_thin
cluster_2 = Cluster_24(
    door_thickness=door_thickness,
    radius=group_thickness,
    y=door_width,
    tree=type_2,
    geometry=edge_2,
    geometry_2=line_1_2,
    geometry_3=line_2_2,
    geometry_4=pos_2,
    vector=direction_2)  # -> _1_wall, _1_wall_thin, _2_wall, _2_wall_thin, _3_wall, _3_wall_thin, _4_wall_thin, _5_wall_thin
cluster_3 = Cluster_24(
    door_thickness=door_thickness,
    radius=group_thickness,
    y=door_width,
    tree=type_3,
    geometry=edge_3,
    geometry_2=line_1_3,
    geometry_3=line_2_3,
    geometry_4=pos_3,
    vector=direction_3)  # -> _1_wall, _1_wall_thin, _2_wall, _2_wall_thin, _3_wall, _3_wall_thin, _4_wall_thin, _5_wall_thin
cluster_4 = Cluster_24(
    door_thickness=door_thickness,
    radius=group_thickness,
    y=door_width,
    tree=type_4,
    geometry=edge_4,
    geometry_2=line_1_4,
    geometry_3=line_2_4,
    geometry_4=pos_4,
    vector=direction_4)  # -> _1_wall, _1_wall_thin, _2_wall, _2_wall_thin, _3_wall, _3_wall_thin, _4_wall_thin, _5_wall_thin
cluster_5 = Cluster_24(
    door_thickness=door_thickness,
    radius=group_thickness,
    y=door_width,
    tree=type_5,
    geometry=edge_5,
    geometry_2=line_1_5,
    geometry_3=line_2_5,
    geometry_4=pos_5,
    vector=direction_5)  # -> _1_wall, _1_wall_thin, _2_wall, _2_wall_thin, _3_wall, _3_wall_thin, _4_wall_thin, _5_wall_thin
dup = GgRemoveDuplicates(Curves=flatten([cluster._1_wall, cluster_2._2_wall, cluster_3._3_wall]), Tol=1e-06)
dup_2 = GgRemoveDuplicates(
    Curves=flatten([cluster._1_wall_thin, cluster_2._2_wall_thin, cluster_3._3_wall_thin, cluster_5._5_wall_thin, cluster_4._4_wall_thin]),
    Tol=1e-06)
set = ClusterOutput(dup_2)
set_2 = ClusterOutput(dup)

# ==== cluster ActivitySharing
door_thickness = ClusterInput()
group_thickness = ClusterInput()
door_width = ClusterInput()
type = ClusterInput()
edge = ClusterInput()
line_1 = ClusterInput()
line_2 = ClusterInput()
pos = ClusterInput()
direction = ClusterInput()
type_2 = ClusterInput()
edge_2 = ClusterInput()
line_1_2 = ClusterInput()
line_2_2 = ClusterInput()
pos_2 = ClusterInput()
direction_2 = ClusterInput()
type_3 = ClusterInput()
edge_3 = ClusterInput()
line_1_3 = ClusterInput()
line_2_3 = ClusterInput()
pos_3 = ClusterInput()
direction_3 = ClusterInput()
type_4 = ClusterInput()
edge_4 = ClusterInput()
line_1_4 = ClusterInput()
line_2_4 = ClusterInput()
pos_4 = ClusterInput()
direction_4 = ClusterInput()
type_5 = ClusterInput()
edge_5 = ClusterInput()
line_1_5 = ClusterInput()
line_2_5 = ClusterInput()
pos_5 = ClusterInput()
direction_5 = ClusterInput()
cluster = Cluster_25(
    panel=door_thickness,
    radius=group_thickness,
    radius_2=door_width,
    tree=type,
    geometry=edge,
    geometry_2=line_1,
    geometry_3=line_2,
    geometry_4=pos,
    vector=direction)  # -> _1_wall, _2_wall, _2_wall_thin, _3_wall, _4_wall, _5_wall, _5_wall_thin
cluster_2 = Cluster_25(
    panel=door_thickness,
    radius=group_thickness,
    radius_2=door_width,
    tree=type_2,
    geometry=edge_2,
    geometry_2=line_1_2,
    geometry_3=line_2_2,
    geometry_4=pos_2,
    vector=direction_2)  # -> _1_wall, _2_wall, _2_wall_thin, _3_wall, _4_wall, _5_wall, _5_wall_thin
cluster_3 = Cluster_25(
    panel=door_thickness,
    radius=group_thickness,
    radius_2=door_width,
    tree=type_3,
    geometry=edge_3,
    geometry_2=line_1_3,
    geometry_3=line_2_3,
    geometry_4=pos_3,
    vector=direction_3)  # -> _1_wall, _2_wall, _2_wall_thin, _3_wall, _4_wall, _5_wall, _5_wall_thin
cluster_4 = Cluster_25(
    panel=door_thickness,
    radius=group_thickness,
    radius_2=door_width,
    tree=type_4,
    geometry=edge_4,
    geometry_2=line_1_4,
    geometry_3=line_2_4,
    geometry_4=pos_4,
    vector=direction_4)  # -> _1_wall, _2_wall, _2_wall_thin, _3_wall, _4_wall, _5_wall, _5_wall_thin
cluster_5 = Cluster_25(
    panel=door_thickness,
    radius=group_thickness,
    radius_2=door_width,
    tree=type_5,
    geometry=edge_5,
    geometry_2=line_1_5,
    geometry_3=line_2_5,
    geometry_4=pos_5,
    vector=direction_5)  # -> _1_wall, _2_wall, _2_wall_thin, _3_wall, _4_wall, _5_wall, _5_wall_thin
dup = GgRemoveDuplicates(Curves=flatten([cluster._1_wall, cluster_2._2_wall, cluster_3._3_wall, cluster_4._4_wall, cluster_5._5_wall]), Tol=1e-06)
dup_2 = GgRemoveDuplicates(Curves=flatten([cluster_2._2_wall_thin, cluster_5._5_wall_thin]), Tol=1e-06)
set = ClusterOutput(dup)
set_2 = ClusterOutput(dup_2)

# ==== cluster Feed
door_thickness = ClusterInput()
group_thickness = ClusterInput()
door_width = ClusterInput()
type = ClusterInput()
edge = ClusterInput()
line_1 = ClusterInput()
line_2 = ClusterInput()
pos = ClusterInput()
direction = ClusterInput()
type_2 = ClusterInput()
edge_2 = ClusterInput()
line_1_2 = ClusterInput()
line_2_2 = ClusterInput()
pos_2 = ClusterInput()
direction_2 = ClusterInput()
type_3 = ClusterInput()
edge_3 = ClusterInput()
line_1_3 = ClusterInput()
line_2_3 = ClusterInput()
pos_3 = ClusterInput()
direction_3 = ClusterInput()
type_4 = ClusterInput()
edge_4 = ClusterInput()
line_1_4 = ClusterInput()
line_2_4 = ClusterInput()
pos_4 = ClusterInput()
direction_4 = ClusterInput()
type_5 = ClusterInput()
edge_5 = ClusterInput()
line_1_5 = ClusterInput()
line_2_5 = ClusterInput()
pos_5 = ClusterInput()
direction_5 = ClusterInput()
cluster = Cluster_26(
    panel=door_thickness,
    radius=group_thickness,
    y=door_width,
    tree=type,
    geometry=edge,
    geometry_2=line_1,
    geometry_3=line_2,
    geometry_4=pos,
    vector=direction)  # -> _1_wall, _1_wall_thin, _2_wall, _2_wall_thin, _3_wall, _3_wall_thin, _4_wall, _4_wall_thin, _5_wall, _5_wall_thin
cluster_2 = Cluster_26(
    panel=door_thickness,
    radius=group_thickness,
    y=door_width,
    tree=type_2,
    geometry=edge_2,
    geometry_2=line_1_2,
    geometry_3=line_2_2,
    geometry_4=pos_2,
    vector=direction_2)  # -> _1_wall, _1_wall_thin, _2_wall, _2_wall_thin, _3_wall, _3_wall_thin, _4_wall, _4_wall_thin, _5_wall, _5_wall_thin
cluster_3 = Cluster_26(
    panel=door_thickness,
    radius=group_thickness,
    y=door_width,
    tree=type_3,
    geometry=edge_3,
    geometry_2=line_1_3,
    geometry_3=line_2_3,
    geometry_4=pos_3,
    vector=direction_3)  # -> _1_wall, _1_wall_thin, _2_wall, _2_wall_thin, _3_wall, _3_wall_thin, _4_wall, _4_wall_thin, _5_wall, _5_wall_thin
cluster_4 = Cluster_26(
    panel=door_thickness,
    radius=group_thickness,
    y=door_width,
    tree=type_4,
    geometry=edge_4,
    geometry_2=line_1_4,
    geometry_3=line_2_4,
    geometry_4=pos_4,
    vector=direction_4)  # -> _1_wall, _1_wall_thin, _2_wall, _2_wall_thin, _3_wall, _3_wall_thin, _4_wall, _4_wall_thin, _5_wall, _5_wall_thin
cluster_5 = Cluster_26(
    panel=door_thickness,
    radius=group_thickness,
    y=door_width,
    tree=type_5,
    geometry=edge_5,
    geometry_2=line_1_5,
    geometry_3=line_2_5,
    geometry_4=pos_5,
    vector=direction_5)  # -> _1_wall, _1_wall_thin, _2_wall, _2_wall_thin, _3_wall, _3_wall_thin, _4_wall, _4_wall_thin, _5_wall, _5_wall_thin
dup = GgRemoveDuplicates(Curves=flatten([cluster._1_wall, cluster_2._2_wall, cluster_3._3_wall, cluster_4._4_wall, cluster_5._5_wall]), Tol=1e-06)
dup_2 = GgRemoveDuplicates(
    Curves=flatten([cluster._1_wall_thin, cluster_2._2_wall_thin, cluster_3._3_wall_thin, cluster_4._4_wall_thin, cluster_5._5_wall_thin]),
    Tol=1e-06)
set = ClusterOutput(dup)
set_2 = ClusterOutput(dup_2)

# ==== cluster Cluster_27
number = ClusterInput()
x = ClusterInput()
curve = ClusterInput()
edge = ClusterInput()
explode = Explode(Curve=curve, Recursive=True)  # -> Segments, Vertices
number_2 = Number(number)
ggremoveduplicates = GgRemoveDuplicates(Curves=flatten(explode.Segments), Tol=1e-06)
division = Division(A=number_2, B=3)
difference = GhPythonScript(x=flatten(x), y=flatten(ggremoveduplicates))  # -> flatten(a); inputs x: list of Curve, y: list of Curve; same code as difference
solid = Wall(number=expr("2*x", division), geometry=graft(difference))
emptypatches = EmptyPatches(x=ggremoveduplicates, geometry=edge, pattern=number_2)  # -> dashes, a
patches = Patches(curve=x, pattern=number_2)
a = ClusterOutput(difference)
preview = ClusterOutput(emptypatches.dashes)
preview_2 = ClusterOutput(patches)
hull = ClusterOutput(solid)

# ==== cluster Cluster_28
geometry = ClusterInput()
value_list = ClusterInput()
sort_duplicate_values = SortDuplicateValues(ValueList=flatten(value_list))  # -> UniqueValues, Indices
larger_than = LargerThan(FirstNumber=sort_duplicate_values.UniqueValues, SecondNumber=0)  # -> LargerThan, OrEqualTo
smaller_than = SmallerThan(FirstNumber=sort_duplicate_values.UniqueValues, SecondNumber=0)  # -> SmallerThan, OrEqualTo
cull_pattern = CullPattern(List=sort_duplicate_values.UniqueValues, CullPattern=larger_than.OrEqualTo)
cull_pattern_2 = CullPattern(List=sort_duplicate_values.UniqueValues, CullPattern=smaller_than.SmallerThan)
sort_list = SortList(Keys=cull_pattern)  # -> Keys, ValuesValuesA
sort_list_2 = SortList(Keys=cull_pattern_2)  # -> Keys, ValuesValuesA
equality = Equality(FirstNumber=flatten(value_list), SecondNumber=graft(sort_list.Keys))  # -> simplify(Equality), Inequality
equality_2 = Equality(FirstNumber=flatten(value_list), SecondNumber=graft(sort_list_2.Keys))  # -> simplify(Equality), Inequality
project = Project(Geometry=geometry, Plane=PlaneXY(0, 0, 0))  # -> Geometry, Transform
project_2 = Project(Geometry=geometry, Plane=PlaneXY(0, 0, 0))  # -> Geometry, Transform
cull_pattern_3 = CullPattern(List=flatten(project.Geometry), CullPattern=equality.Equality)
cull_pattern_4 = CullPattern(List=flatten(project_2.Geometry), CullPattern=equality_2.Equality)
mesh_join = MeshJoin(Meshes=cull_pattern_3)
rebuild_mesh = RebuildMesh(
    Mesh=mesh_join,
    RebuildNormals=True,
    CullUnused=True,
    UnifyNormals=False,
    FlipNormals=False,
    IdenticalCombine=True,
    WeldVertices=0.1)
rebuilt = ClusterOutput(rebuild_mesh)
list = ClusterOutput(cull_pattern_4)

# ==== cluster Cluster
B = ClusterInput()
C = ClusterInput()
P = ClusterInput()
line = Line(C)
midpt = CurveMiddle(Curve=C)
scale = Scale(Geometry=line, Center=midpt, Factor=10)  # -> Geometry, Transform
crv_cp = CurveClosestPoint(Point=P, Curve=scale.Geometry)  # -> Point, Parameter, Distance
vec2pt = Vector2Pt(PointA=P, PointB=crv_cp.Point, Unitize=True)  # -> Vector, Length
multiplication = Multiplication(A=vec2pt.Vector, B=B)
division = Division(A=multiplication, B=2)
rev = Reverse(Vector=division)
move = Move(Geometry=midpt, Motion=rev)  # -> Geometry, Transform
cvec = ClosestVector(
    Reference=rev,
    Targets=[Vector(0, 10.64926005, 0), Vector(0, -11.47133931, 0), Vector(21.27767446, 0, 0), Vector(-19.02680742, 0, 0)],
    KeepLength=False)  # -> Closest, Index, Angle
null = NullItem(Item=rev)  # -> NullFlags, InvalidFlags, Description
mindex = MemberIndex(Set=null.InvalidFlags, Member=True)  # -> Index, Count
replace = ReplaceItems(List=cvec.Index, Indices=mindex.Index, Wrap=False)
align_plane = AlignPlane(Plane=move.Geometry, Direction=rev)  # -> Plane, Angle
python = GhPythonScript(x=replace)  # -> a
# ---------- python: Python ----------
__author__ = "LYang"
__version__ = "2021.07.12"

import rhinoscriptsyntax as rs
if x == None:
    a = None
if x == 0:
    a = "-0.5*Pi"
if x == 1:
    a = "0.5*Pi"
if x == 2:
    a = "0.5*Pi"
if x == 3:
    a = "-0.5*Pi"
# ---------- end python ----------
rotate = Rotate(Geometry=align_plane.Plane, Angle=python, Plane=move.Geometry)  # -> Geometry, Transform
V = ClusterOutput(rev)
G = ClusterOutput(rotate.Geometry)

# ==== cluster Cluster_6
cluster_input = ClusterInput()
cluster_input_2 = ClusterInput()
x = ClusterInput()
tree = ClusterInput()
geometry = ClusterInput()
s1 = ClusterInput()
geometry_2 = Geometry(geometry)
panel = Panel(tree)
clean_tree = CleanTree(RemoveNulls=True, RemoveInvalid=True, RemoveEmpty=True, Tree=tree, SynchronousTree1=s1)  # -> simplify(Tree), SynchronousTree1
length = Length(Curve=geometry_2)
ghpython_script = GhPythonScript(x=x, y=length)  # -> n
# ---------- ghpython_script: Python ----------
__author__ = "altai"
__version__ = "2021.08.08"

import rhinoscriptsyntax as rs
import random

a = []
n = 0

if y:
    n = random.randint(1,int(1+y/(6*x)))
# ---------- end ghpython_script ----------
ghpython_script_2 = GhPythonScript(x=clean_tree.Tree, z=clean_tree.SynchronousTree1, y="intra_comp")  # -> simplify(a); inputs x: list, z: list of Vector3d
# ---------- ghpython_script_2: Python ----------
__author__ = "altai"
__version__ = "2021.08.09"

import rhinoscriptsyntax as rs


if not x[0] == x[1]:
    if x[0] == "intra_comp":
        a = z[0]
    if x[1] == "intra_comp":
        a = z[1]
# ---------- end ghpython_script_2 ----------
clean_tree_2 = CleanTree(RemoveNulls=True, RemoveInvalid=True, RemoveEmpty=False, Tree=ghpython_script)
opening_large = Opening_large(A="0.8", cluster_input=cluster_input_2, cluster_input_2=cluster_input, geometry=geometry)  # -> tree, outside
clean_tree_3 = CleanTree(RemoveNulls=True, RemoveInvalid=True, RemoveEmpty=True, Tree=ghpython_script_2)
divide_curve = DivideCurve(Curve=geometry_2, Count=expr("x+1", clean_tree_2), Kinks=False)  # -> simplify(Points), Tangents, Parameters
cull_index = CullIndex(List=divide_curve.Points, Indices=[0, -1], Wrap=True)  # -> simplify(List)
circle = Circle(Plane=cull_index, Radius=x)  # -> simplify(Circle)
trim_with_regions = TrimWithRegions(Curve=geometry_2, Regions=circle)  # -> simplify(Inside), simplify(Wall_infra)
cluster = Cluster_4(A=cluster_input_2, A_2=cluster_input, geometry=trim_with_regions.Inside)  # -> tree, s1
cluster_2 = Cluster_5(tree=cluster.tree, A=cluster.s1, vector=clean_tree_3)  # -> line_3, inside
wall_infra = ClusterOutput(trim_with_regions.Wall_infra)
wall_infra_2 = ClusterOutput(trim_with_regions.Wall_infra)
gate_infra = ClusterOutput(cluster.tree)
wall_infra_3 = ClusterOutput(trim_with_regions.Wall_infra)
door = ClusterOutput(cluster_2.line_3)
dash = ClusterOutput(cluster_2.inside)
wall_inter = ClusterOutput(opening_large.outside)
wall_inter_2 = ClusterOutput(opening_large.outside)
gate_inter = ClusterOutput(opening_large.tree)

# ==== cluster Cluster_7
vector = ClusterInput()
x = ClusterInput()
tree = ClusterInput()
cluster_input = ClusterInput()
cluster_input_2 = ClusterInput()
tree_2 = ClusterInput()
tree_3 = ClusterInput()
tree_4 = ClusterInput()
point = ClusterInput()
vector_2 = Vector(vector)
clean_tree = CleanTree(RemoveNulls=True, RemoveInvalid=True, RemoveEmpty=True, Tree=tree_2)  # -> simplify(Tree)
clean_tree_2 = CleanTree(RemoveNulls=True, RemoveInvalid=True, RemoveEmpty=True, Tree=tree_3)  # -> simplify(Tree)
clean_tree_3 = CleanTree(RemoveNulls=True, RemoveInvalid=True, RemoveEmpty=True, Tree=tree_4)  # -> simplify(Tree)
point_2 = Point(point)
clean_tree_4 = CleanTree(RemoveNulls=True, RemoveInvalid=True, RemoveEmpty=True, Tree=tree, SynchronousTree1=point_2, SynchronousTree2=vector_2)  # -> simplify(Tree), SynchronousTree1, SynchronousTree2
geometry = Geometry(clean_tree)
geometry_2 = Geometry(clean_tree_2)
geometry_3 = Geometry(clean_tree_3)
divide_curve = DivideCurve(Curve=geometry_2, Count=4, Kinks=False)  # -> simplify(Points), Tangents, Parameters
divide_curve_2 = DivideCurve(Curve=geometry_3, Count=4, Kinks=False)  # -> simplify(Points), Tangents, Parameters
ghpython_script = GhPythonScript(x=clean_tree_4.Tree, z=clean_tree_4.SynchronousTree1, u=clean_tree_4.SynchronousTree2, y="intra_comp")  # -> simplify(a), simplify(b); inputs x: list, z: list of Point3d, u: list of Vector3d
# ---------- ghpython_script: Python ----------
__author__ = "altai"
__version__ = "2021.08.09"

import rhinoscriptsyntax as rs


if not x[0] == x[1]:
    if x[0] == "intra_comp":
        a = z[0]
        b = u[0]
    if x[1] == "intra_comp":
        a = z[1]
        b = u[1]
# ---------- end ghpython_script ----------
list_item = ListItem(List=divide_curve.Points, Index=1, Wrap=True)
list_item_2 = ListItem(List=divide_curve_2.Points, Index=1, Wrap=True)
clean_tree_5 = CleanTree(RemoveNulls=True, RemoveInvalid=True, RemoveEmpty=True, Tree=ghpython_script.a, SynchronousTree1=ghpython_script.b)  # -> Tree, SynchronousTree1
trim_tree = TrimTree(Tree=list_item, Depth=1)
trim_tree_2 = TrimTree(Tree=list_item_2, Depth=1)
first_last = FirstLast(List=trim_tree)  # -> FirstValue, LastValue
first_last_2 = FirstLast(List=trim_tree_2)  # -> FirstValue, LastValue
line = Line(StartPoint=trim_tree, EndPoint=trim_tree_2)
line_2 = Line(StartPoint=first_last.FirstValue, EndPoint=first_last.LastValue)
line_3 = Line(StartPoint=first_last_2.FirstValue, EndPoint=first_last_2.LastValue)
merge = Merge(Data1=line_2, Data2=line_3)
geometry_4 = Geometry(merge)
merge_2 = Merge(Data1=geometry_4, Data2=line)
curve_middle = CurveMiddle(Curve=geometry_4)
join_curves = JoinCurves(Curves=merge_2, Preserve=False)  # -> simplify(Curves)
length = Length(Curve=geometry_4)
closest_point = ClosestPoint(Point=clean_tree_5.Tree, Cloud=curve_middle)  # -> ClosestPoint, CPIndex, Distance
ghpython_script_2 = GhPythonScript(x=x, y=length)  # -> n; same code as ghpython_script
trim_with_regions = TrimWithRegions(Curve=geometry, Regions=simplify(join_curves))  # -> simplify(Inside), simplify(Outside)
clean_tree_6 = CleanTree(RemoveNulls=True, RemoveInvalid=True, RemoveEmpty=False, Tree=ghpython_script_2)
cull_index = CullIndex(List=geometry_4, Indices=closest_point.CPIndex, Wrap=True)
list_item_3 = ListItem(List=geometry_4, Index=closest_point.CPIndex, Wrap=True)
geometry_5 = Geometry(trim_with_regions.Outside)
divide_curve_3 = DivideCurve(Curve=geometry_4, Count=expr("x+1", clean_tree_6), Kinks=False)  # -> simplify(Points), Tangents, Parameters
length_2 = Length(Curve=cull_index)
length_3 = Length(Curve=list_item_3)
cull_index_2 = CullIndex(List=divide_curve_3.Points, Indices=[0, -1], Wrap=True)  # -> simplify(List)
ghpython_script_3 = GhPythonScript(x=x, y=length_2)  # -> n; same code as ghpython_script
ghpython_script_4 = GhPythonScript(x=x, y=length_3)  # -> n; same code as ghpython_script
circle = Circle(Plane=cull_index_2, Radius=x)  # -> simplify(Circle)
clean_tree_7 = CleanTree(RemoveNulls=True, RemoveInvalid=True, RemoveEmpty=False, Tree=ghpython_script_3)
clean_tree_8 = CleanTree(RemoveNulls=True, RemoveInvalid=True, RemoveEmpty=False, Tree=ghpython_script_4)
trim_with_regions_2 = TrimWithRegions(Curve=graft(geometry_4), Regions=circle)  # -> simplify(Inside), simplify(Outside)
divide_curve_4 = DivideCurve(Curve=cull_index, Count=expr("x+1", clean_tree_7), Kinks=False)  # -> simplify(Points), Tangents, Parameters
divide_curve_5 = DivideCurve(Curve=list_item_3, Count=expr("x+1", clean_tree_8), Kinks=False)  # -> simplify(Points), Tangents, Parameters
cluster = Cluster_4(A=cluster_input_2, A_2=cluster_input, geometry=trim_with_regions_2.Inside)  # -> tree, s1
cull_index_3 = CullIndex(List=divide_curve_4.Points, Indices=[0, -1], Wrap=True)  # -> simplify(List)
cull_index_4 = CullIndex(List=divide_curve_5.Points, Indices=[0, -1], Wrap=True)  # -> simplify(List)
circle_2 = Circle(Plane=cull_index_3, Radius=x)  # -> simplify(Circle)
circle_3 = Circle(Plane=cull_index_4, Radius=x)  # -> simplify(Circle)
trim_with_regions_3 = TrimWithRegions(Curve=graft(cull_index), Regions=circle_2)  # -> simplify(Inside), simplify(Outside)
trim_with_regions_4 = TrimWithRegions(Curve=graft(list_item_3), Regions=circle_3)  # -> simplify(Inside), simplify(Outside)
cluster_2 = Cluster_4(A=cluster_input_2, A_2=cluster_input, geometry=trim_with_regions_4.Inside)  # -> tree, s1
opening_large = Opening_large_2(A="0.8", cluster_input=cluster_input_2, cluster_input_2=cluster_input, geometry=geometry_4)  # -> tree, outside
multiplication = Multiplication(A=x, B=clean_tree_5.SynchronousTree1)
cluster_3 = Cluster_4(A=cluster_input_2, A_2=cluster_input, geometry=trim_with_regions_3.Inside)  # -> tree, s1
cluster_4 = Cluster_5(tree=cluster_2.tree, A=cluster_2.s1, vector=multiplication)  # -> line_3, inside
merge_3 = Merge(Data1=opening_large.outside, Data2=line, Data3=geometry_5)  # -> simplify(Result)
merge_4 = Merge(Data1=trim_with_regions_2.Outside, Data2=line, Data3=geometry_5)  # -> simplify(Result)
merge_5 = Merge(Data1=cluster_3.tree, Data2=cluster_2.tree)
merge_6 = Merge(Data1=trim_with_regions_3.Outside, Data2=trim_with_regions_4.Outside, Data3=line, Data4=geometry_5)  # -> simplify(Result)
merge_7 = Merge(Data1=cluster_3.tree, Data2=cluster_4.line_3)
result = ClusterOutput(merge_6)
result_2 = ClusterOutput(merge_7)
inside = ClusterOutput(cluster_4.inside)
result_3 = ClusterOutput(merge_4)
result_4 = ClusterOutput(merge_4)
geometry_6 = ClusterOutput(cluster.tree)
result_5 = ClusterOutput(merge_3)
result_6 = ClusterOutput(merge_3)
gate_inter = ClusterOutput(opening_large.tree)

# ==== cluster Cluster_8
A = ClusterInput()
vector = ClusterInput()
tree = ClusterInput()
cluster_input = ClusterInput()
cluster_input_2 = ClusterInput()
tree_2 = ClusterInput()
point = ClusterInput()
unit_vector = UnitVector(Vector=vector)  # -> simplify(Vector)
clean_tree = CleanTree(RemoveNulls=True, RemoveInvalid=True, RemoveEmpty=True, Tree=tree_2)  # -> simplify(Tree)
point_2 = Point(point)
clean_tree_2 = CleanTree(
    RemoveNulls=True,
    RemoveInvalid=True,
    RemoveEmpty=True,
    Tree=tree,
    SynchronousTree1=point_2,
    SynchronousTree2=unit_vector)  # -> simplify(Tree), simplify(SynchronousTree1), simplify(SynchronousTree2)
panel = Panel(tree)
geometry = Geometry(clean_tree)
ghpython_script = GhPythonScript(x=clean_tree_2.Tree, z=clean_tree_2.SynchronousTree1, u=clean_tree_2.SynchronousTree2, y="intra_comp")  # -> simplify(a), b; inputs x: list, z: list of Point3d, u: list of Vector3d; same code as ghpython_script
length = Length(Curve=geometry)
clean_tree_3 = CleanTree(RemoveNulls=True, RemoveInvalid=True, RemoveEmpty=True, Tree=ghpython_script.a, SynchronousTree1=ghpython_script.b)  # -> Tree, SynchronousTree1
ghpython_script_2 = GhPythonScript(x=A, y=length)  # -> n; same code as ghpython_script
clean_tree_4 = CleanTree(RemoveNulls=True, RemoveInvalid=True, RemoveEmpty=False, Tree=ghpython_script_2)
divide_curve = DivideCurve(Curve=geometry, Count=expr("x+1", clean_tree_4), Kinks=False)  # -> simplify(Points), Tangents, Parameters
opening_large = Opening_large_3(A="0.75", cluster_input=cluster_input_2, cluster_input_2=cluster_input, geometry=geometry)  # -> tree, inside, outside
multiplication = Multiplication(A=A, B=simplify(0))
multiplication_2 = Multiplication(A=A, B=simplify(clean_tree_3.SynchronousTree1))
cull_index = CullIndex(List=divide_curve.Points, Indices=[0, -1], Wrap=True)  # -> simplify(List)
circle = Circle(Plane=cull_index, Radius=A)  # -> simplify(Circle)
geometry_2 = Geometry(opening_large.outside)
panel_2 = Panel(multiplication_2)
trim_with_regions = TrimWithRegions(Curve=graft(geometry), Regions=circle)  # -> simplify(Inside), simplify(Outside)
multiplication_3 = Multiplication(A=A, B=clean_tree_2.SynchronousTree2)
multiplication_4 = Multiplication(A=A, B=clean_tree_2.SynchronousTree2)
list_item = ListItem(List=multiplication_3, Index=0, Wrap=True)
list_item_2 = ListItem(List=multiplication_3, Index=1, Wrap=True)
move = Move(Geometry=trim_with_regions.Inside, Motion=multiplication)  # -> Geometry, Transform
move_2 = Move(Geometry=trim_with_regions.Inside, Motion=multiplication_2)  # -> Geometry, Transform
list_item_3 = ListItem(List=multiplication_4, Index=0, Wrap=True)
list_item_4 = ListItem(List=multiplication_4, Index=1, Wrap=True)
move_3 = Move(Geometry=trim_with_regions.Inside, Motion=list_item)  # -> Geometry, Transform
move_4 = Move(Geometry=trim_with_regions.Inside, Motion=list_item_2)  # -> Geometry, Transform
move_5 = Move(Geometry=opening_large.inside, Motion=list_item_3)  # -> Geometry, Transform
move_6 = Move(Geometry=opening_large.inside, Motion=list_item_4)  # -> Geometry, Transform
cluster = Cluster_4(A=cluster_input_2, A_2=cluster_input, geometry=trim_with_regions.Inside)  # -> tree, s1
end_points = EndPoints(Curve=move.Geometry)  # -> Start, End
end_points_2 = EndPoints(Curve=move_2.Geometry)  # -> Start, End
end_points_3 = EndPoints(Curve=move_3.Geometry)  # -> Start, End
end_points_4 = EndPoints(Curve=move_4.Geometry)  # -> Start, End
end_points_5 = EndPoints(Curve=move_5.Geometry)  # -> Start, End
end_points_6 = EndPoints(Curve=move_6.Geometry)  # -> Start, End
line = Line(StartPoint=end_points.Start, EndPoint=end_points_2.Start)
line_2 = Line(StartPoint=end_points.End, EndPoint=end_points_2.End)
line_3 = Line(StartPoint=end_points_3.Start, EndPoint=end_points_4.Start)
line_4 = Line(StartPoint=end_points_3.End, EndPoint=end_points_4.End)
line_5 = Line(StartPoint=end_points_5.Start, EndPoint=end_points_6.Start)
line_6 = Line(StartPoint=end_points_5.End, EndPoint=end_points_6.End)
merge = Merge(Data1=move.Geometry, Data2=move_2.Geometry, Data3=line, Data4=line_2)
merge_2 = Merge(Data1=move_3.Geometry, Data2=line_3, Data3=line_4, Data4=move_4.Geometry)
merge_3 = Merge(Data1=move_5.Geometry, Data2=line_5, Data3=line_6, Data4=move_6.Geometry)
cluster_2 = Cluster_5(tree=cluster.tree, A=cluster.s1, vector=multiplication_2)  # -> line_3, inside
join_curves = JoinCurves(Curves=merge, Preserve=False)
join_curves_2 = JoinCurves(Curves=merge_2, Preserve=False)  # -> simplify(Curves)
join_curves_3 = JoinCurves(Curves=merge_3, Preserve=False)  # -> simplify(Curves)
outside = ClusterOutput(trim_with_regions.Outside)
curves = ClusterOutput(join_curves_2)
outside_2 = ClusterOutput(trim_with_regions.Outside)
geometry_3 = ClusterOutput(cluster.tree)
curves_2 = ClusterOutput(join_curves_2)
outside_3 = ClusterOutput(trim_with_regions.Outside)
line_7 = ClusterOutput(cluster_2.line_3)
inside = ClusterOutput(cluster_2.inside)
curves_3 = ClusterOutput(join_curves)
wall_inter = ClusterOutput(opening_large.outside)
curves_4 = ClusterOutput(join_curves_3)
wall_inter_2 = ClusterOutput(opening_large.outside)
gate_inter = ClusterOutput(opening_large.tree)
curves_5 = ClusterOutput(join_curves_3)

# ==== cluster Cluster_11
cluster_input = ClusterInput()
cluster_input_2 = ClusterInput()
x = ClusterInput()
tree = ClusterInput()
geometry = ClusterInput()
s1 = ClusterInput()
vector = ClusterInput()
geometry_2 = Geometry(geometry)
unit_vector = UnitVector(Vector=vector)  # -> simplify(Vector)
length = Length(Curve=geometry_2)
clean_tree = CleanTree(RemoveNulls=True, RemoveInvalid=True, RemoveEmpty=True, Tree=tree, SynchronousTree1=s1, SynchronousTree2=unit_vector)  # -> simplify(Tree), simplify(SynchronousTree1), simplify(SynchronousTree2)
ghpython_script = GhPythonScript(x=x, y=length)  # -> n; same code as ghpython_script
clean_tree_2 = CleanTree(RemoveNulls=True, RemoveInvalid=True, RemoveEmpty=False, Tree=ghpython_script)
ghpython_script_2 = GhPythonScript(x=clean_tree.Tree, z=clean_tree.SynchronousTree1, u=clean_tree.SynchronousTree2, y="intra_comp")  # -> simplify(a), b; inputs x: list, z: list of Point3d, u: list of Vector3d; same code as ghpython_script
opening_large = Opening_large_4(A="0.8", cluster_input=cluster_input_2, cluster_input_2=cluster_input, geometry=geometry)  # -> tree, s2, outside
subtraction = Subtraction(A=0, B=cluster_input_2)
divide_curve = DivideCurve(Curve=geometry_2, Count=expr("x+1", clean_tree_2), Kinks=False)  # -> simplify(Points), Tangents, Parameters
clean_tree_3 = CleanTree(RemoveNulls=True, RemoveInvalid=True, RemoveEmpty=True, Tree=ghpython_script_2.a, SynchronousTree1=ghpython_script_2.b)  # -> Tree, SynchronousTree1
cull_index = CullIndex(List=divide_curve.Points, Indices=[0, -1], Wrap=True)  # -> simplify(List)
division = Division(A=subtraction, B=2)
dash = Dash(cluster_input=cluster_input, curve=opening_large.tree, B=cluster_input_2)
offset_curve = OffsetCurve(Curve=opening_large.s2, Distance=[cluster_input_2, subtraction], Corners=1)
circle = Circle(Plane=cull_index, Radius=x)  # -> simplify(Circle)
multiplication = Multiplication(A=clean_tree_3.SynchronousTree1, B=division)
reverse = Reverse(Vector=multiplication)
trim_with_regions = TrimWithRegions(Curve=geometry_2, Regions=circle)  # -> simplify(Inside), simplify(Wall_infra)
offset_curve_2 = OffsetCurve(Curve=graft(dash), Distance=expr("X/2", [cluster_input_2, subtraction]), Corners=1)
cluster = Cluster_4(A=cluster_input_2, A_2=cluster_input, geometry=trim_with_regions.Inside)  # -> tree, s1
move = Move(Geometry=cluster.tree, Motion=multiplication)  # -> Geometry, Transform
move_2 = Move(Geometry=cluster.tree, Motion=reverse)  # -> Geometry, Transform
trim_tree = TrimTree(Tree=offset_curve_2, Depth=2)
offset_curve_3 = OffsetCurve(Curve=trim_with_regions.Inside, Distance=[cluster_input_2, subtraction], Corners=1)
dash_2 = Dash(cluster_input=cluster_input, curve=move.Geometry, B=cluster_input_2)
dash_3 = Dash(cluster_input=cluster_input, curve=cluster.tree, B=cluster_input_2)
offset_curve_4 = OffsetCurve(Curve=graft(dash_3), Distance=expr("X/2", [cluster_input_2, subtraction]), Corners=1)
_1_wall = ClusterOutput(trim_with_regions.Wall_infra)
_1_window = ClusterOutput(cluster.tree)
_1_below = ClusterOutput(offset_curve_3)
_2_wall = ClusterOutput(trim_with_regions.Wall_infra)
_2_window = ClusterOutput(offset_curve_4)
_3_window = ClusterOutput([move_2.Geometry, dash_2])
_4_wall = ClusterOutput(opening_large.outside)
_4_window = ClusterOutput(opening_large.tree)
_4_below = ClusterOutput(offset_curve)
_5_wall = ClusterOutput(opening_large.outside)
_5_window = ClusterOutput(trim_tree)
_3_wall = ClusterOutput(trim_with_regions.Wall_infra)

# ==== cluster Cluster_15
tree = ClusterInput()
clean_tree = CleanTree(RemoveNulls=True, RemoveInvalid=True, RemoveEmpty=True, Tree=tree)  # -> simplify(Tree)
tree_2 = ClusterInput()
clean_tree_2 = CleanTree(RemoveNulls=True, RemoveInvalid=True, RemoveEmpty=True, Tree=tree_2)  # -> simplify(Tree)
cluster_input = ClusterInput()
cluster_input_2 = ClusterInput()
radius = ClusterInput()
tree_3 = ClusterInput()
s1 = ClusterInput()
s2 = ClusterInput()
vector = ClusterInput()
divide_curve = DivideCurve(Curve=clean_tree, Count=4, Kinks=False)  # -> simplify(Points), Tangents, Parameters
divide_curve_2 = DivideCurve(Curve=clean_tree_2, Count=4, Kinks=False)  # -> simplify(Points), Tangents, Parameters
unit_vector = UnitVector(Vector=vector)  # -> simplify(Vector)
clean_tree_3 = CleanTree(
    RemoveNulls=True,
    RemoveInvalid=True,
    RemoveEmpty=True,
    Tree=tree_3,
    SynchronousTree1=s1,
    SynchronousTree2=s2,
    SynchronousTree3=unit_vector)  # -> simplify(Tree), SynchronousTree1, simplify(SynchronousTree2), simplify(SynchronousTree3)
list_item = ListItem(List=divide_curve.Points, Index=3, Wrap=True)
list_item_2 = ListItem(List=divide_curve_2.Points, Index=3, Wrap=True)
subtraction = Subtraction(A=0, B=cluster_input_2)
trim_tree = TrimTree(Tree=list_item, Depth=1)
trim_tree_2 = TrimTree(Tree=list_item_2, Depth=1)
geometry = Geometry(clean_tree_3.SynchronousTree1)
first_last = FirstLast(List=trim_tree)  # -> FirstValue, LastValue
first_last_2 = FirstLast(List=trim_tree_2)  # -> FirstValue, LastValue
line = Line(StartPoint=first_last.FirstValue, EndPoint=first_last.LastValue)
line_2 = Line(StartPoint=first_last_2.FirstValue, EndPoint=first_last_2.LastValue)
flip_curve = FlipCurve(Curve=line, Guide=geometry)  # -> Curve, Flag
flip_curve_2 = FlipCurve(Curve=line_2, Guide=geometry)  # -> Curve, Flag
end_points = EndPoints(Curve=flip_curve.Curve)  # -> Start, End
end_points_2 = EndPoints(Curve=flip_curve_2.Curve)  # -> Start, End
end_points_3 = EndPoints(Curve=geometry)  # -> Start, End
line_3 = Line(StartPoint=end_points.Start, EndPoint=end_points_3.Start)
line_4 = Line(StartPoint=end_points.End, EndPoint=end_points_3.End)
line_5 = Line(StartPoint=end_points_2.Start, EndPoint=end_points_3.Start)
line_6 = Line(StartPoint=end_points_2.End, EndPoint=end_points_3.End)
panel = Panel("""0
0.1
0.25
0.3
0.7
0.75
0.9""")
merge = Merge(Data1=line_3, Data2=line_4)
merge_2 = Merge(Data1=line_5, Data2=line_6)
curve_middle = CurveMiddle(Curve=merge)
curve_middle_2 = CurveMiddle(Curve=merge_2)
length = Length(Curve=clean_tree_3.SynchronousTree1)
circle = Circle(Plane=curve_middle, Radius=radius)  # -> simplify(Circle)
circle_2 = Circle(Plane=curve_middle_2, Radius=radius)  # -> simplify(Circle)
multiplication = Multiplication(A=panel, B=length)
trim_with_regions = TrimWithRegions(Curve=merge, Regions=circle)  # -> simplify(Inside), simplify(Wall_infra)
trim_with_regions_2 = TrimWithRegions(Curve=merge_2, Regions=circle_2)  # -> simplify(Inside), simplify(Wall_infra)
merge_3 = Merge(Data1=curve_middle, Data2=curve_middle_2)
shatter = Shatter(Curve=clean_tree_3.SynchronousTree1, Parameters=multiplication)  # -> simplify(Segments)
ghpython_script = GhPythonScript(x=clean_tree_3.Tree, z=clean_tree_3.SynchronousTree2, u=clean_tree_3.SynchronousTree3, y="intra_comp")  # -> simplify(a), c, b; inputs x: list, z: list of Point3d, u: list of Vector3d
# ---------- ghpython_script: Python ----------
__author__ = "altai"
__version__ = "2021.08.09"

import rhinoscriptsyntax as rs


if not x[0] == x[1]:
    if x[0] == "intra_comp":
        a = z[0]
        c = z[1] 
        b = u[0]
    if x[1] == "intra_comp":
        a = z[1]
        c = z[0]
        b = u[1]
# ---------- end ghpython_script ----------
trim_tree_3 = TrimTree(Tree=trim_with_regions.Inside, Depth=1)
trim_tree_4 = TrimTree(Tree=trim_with_regions_2.Inside, Depth=1)
merge_4 = Merge(Data1=trim_with_regions.Wall_infra, Data2=trim_with_regions_2.Wall_infra)
list_item_3 = ListItem(List=shatter, Index=0, Wrap=True)  # -> Item, Item1, Item2, Item3, Item4, Item5, Item6
clean_tree_4 = CleanTree(
    RemoveNulls=True,
    RemoveInvalid=True,
    RemoveEmpty=True,
    Tree=ghpython_script.a,
    SynchronousTree1=ghpython_script.c,
    SynchronousTree2=ghpython_script.b)  # -> Tree, SynchronousTree1, SynchronousTree2
closest_points = ClosestPoints(Point=clean_tree_4.Tree, Cloud=merge_3, Count=2)  # -> simplify(ClosestPoint), simplify(CPIndex), Distance
merge_5 = Merge(Data1=trim_tree_3, Data2=trim_tree_4)
merge_6 = Merge(Data1=list_item_3.Item1, Data2=list_item_3.Item3, Data3=list_item_3.Item5)
merge_7 = Merge(Data1=list_item_3.Item, Data2=list_item_3.Item2, Data3=list_item_3.Item4, Data4=list_item_3.Item6)
list_item_4 = ListItem(List=merge_7, Index=[1, 2], Wrap=True)
curve_middle_3 = CurveMiddle(Curve=list_item_4)
list_item_5 = ListItem(List=curve_middle_3, Index=0, Wrap=True)
list_item_6 = ListItem(List=curve_middle_3, Index=1, Wrap=True)
line_7 = Line(StartPoint=list_item_5, EndPoint=list_item_6)
list_item_7 = ListItem(List=merge_5, Index=closest_points.CPIndex, Wrap=True)
cull_index = CullIndex(List=merge_5, Indices=closest_points.CPIndex, Wrap=True)
division = Division(A=subtraction, B=2)
geometry_2 = Geometry(clean_tree_3.SynchronousTree2)
curve_middle_4 = CurveMiddle(Curve=list_item_7)
curve_middle_5 = CurveMiddle(Curve=cull_index)
list_item_8 = ListItem(List=merge_6, Index=1, Wrap=True)
list_item_9 = ListItem(List=geometry_2, Index=0, Wrap=True)
list_item_10 = ListItem(List=geometry_2, Index=1, Wrap=True)
curve_middle_6 = CurveMiddle(Curve=trim_tree_3)
curve_middle_7 = CurveMiddle(Curve=trim_tree_4)
scale = Scale(Geometry=list_item_7, Center=curve_middle_4, Factor=100)  # -> Geometry, Transform
scale_2 = Scale(Geometry=cull_index, Center=curve_middle_5, Factor=100)  # -> Geometry, Transform
cluster = Cluster_12(A=cluster_input_2, A_2=cluster_input, geometry=list_item_8)  # -> tree, s1
curve_middle_8 = CurveMiddle(Curve=line_7)
length_2 = Length(Curve=line_7)
cluster_2 = Cluster_12(A=cluster_input_2, A_2=cluster_input, geometry=line_7)  # -> tree, s1
offset_curve = OffsetCurve(Curve=list_item_8, Distance=[cluster_input_2, subtraction], Corners=1)
multiplication_2 = Multiplication(A=clean_tree_4.SynchronousTree2, B=division)
scale_3 = Scale(Geometry=trim_tree_3, Center=curve_middle_6, Factor=100)  # -> Geometry, Transform
scale_4 = Scale(Geometry=trim_tree_4, Center=curve_middle_7, Factor=100)  # -> Geometry, Transform
curve_closest_point = CurveClosestPoint(Point=clean_tree_4.SynchronousTree1, Curve=scale.Geometry)  # -> Point, Parameter, Distance
curve_closest_point_2 = CurveClosestPoint(Point=clean_tree_4.Tree, Curve=scale_2.Geometry)  # -> Point, Parameter, Distance
reverse = Reverse(Vector=multiplication_2)
circle_3 = Circle(Plane=curve_middle_8, Radius=expr("x/2", length_2))
curve_closest_point_3 = CurveClosestPoint(Point=list_item_10, Curve=scale_3.Geometry)  # -> Point, Parameter, Distance
curve_closest_point_4 = CurveClosestPoint(Point=list_item_9, Curve=scale_4.Geometry)  # -> Point, Parameter, Distance
dash = Dash(cluster_input=cluster_input, curve=cluster.tree, B=cluster_input_2)
cluster_3 = Cluster_14(B=cluster_input_2, A=cluster_input, geometry=list_item_7)  # -> tree, s1
cluster_4 = Cluster_14(B=cluster_input_2, A=cluster_input, geometry=cull_index)  # -> tree, s1
vector_2pt = Vector2Pt(PointA=curve_closest_point_2.Point, PointB=clean_tree_4.Tree, Unitize=True)  # -> Vector, Length
move = Move(Geometry=cluster.tree, Motion=multiplication_2)  # -> Geometry, Transform
move_2 = Move(Geometry=cluster.tree, Motion=reverse)  # -> Geometry, Transform
vector_2pt_2 = Vector2Pt(PointA=curve_closest_point.Point, PointB=clean_tree_4.SynchronousTree1, Unitize=True)  # -> Vector, Length
dash_2 = Dash(cluster_input=cluster_input, curve=cluster_2.tree, B=cluster_input_2)
trim_with_regions_3 = TrimWithRegions(Curve=merge_7, Regions=circle_3)  # -> simplify(Inside), simplify(Wall_infra)
cluster_5 = Cluster_14(B=cluster_input_2, A=cluster_input, geometry=trim_tree_3)  # -> tree, s1
cluster_6 = Cluster_14(B=cluster_input_2, A=cluster_input, geometry=trim_tree_4)  # -> tree, s1
vector_2pt_3 = Vector2Pt(PointA=curve_closest_point_4.Point, PointB=list_item_9, Unitize=True)  # -> Vector, Length
vector_2pt_4 = Vector2Pt(PointA=curve_closest_point_3.Point, PointB=list_item_10, Unitize=True)  # -> Vector, Length
reverse_2 = Reverse(Vector=vector_2pt_2.Vector)
reverse_3 = Reverse(Vector=vector_2pt.Vector)
cluster_7 = Cluster_12(A=cluster_input_2, A_2=cluster_input, geometry=merge_5)  # -> tree, s1
offset_curve_2 = OffsetCurve(Curve=graft(dash_2), Distance=expr("X/2", [cluster_input_2, subtraction]), Corners=1)
offset_curve_3 = OffsetCurve(Curve=cluster_2.tree, Distance=[cluster_input_2, subtraction], Corners=1)
trim_tree_5 = TrimTree(Tree=trim_with_regions_3.Wall_infra, Depth=1)
offset_curve_4 = OffsetCurve(Curve=graft(dash), Distance=expr("X/2", [cluster_input_2, subtraction]), Corners=1)
dash_3 = Dash(cluster_input=cluster_input, curve=move.Geometry, B=cluster_input_2)
reverse_4 = Reverse(Vector=vector_2pt_4.Vector)
reverse_5 = Reverse(Vector=vector_2pt_3.Vector)
cluster_8 = Cluster_13(tree=cluster_3.tree, A=cluster_3.s1, vector=vector_2pt_2.Vector)  # -> line_3, inside
cluster_9 = Cluster_13(tree=cluster_3.tree, A=cluster_3.s1, vector=reverse_2)  # -> line_3, inside
cluster_10 = Cluster_13(tree=cluster_4.tree, A=cluster_4.s1, vector=vector_2pt.Vector)  # -> line_3, inside
cluster_11 = Cluster_13(tree=cluster_4.tree, A=cluster_4.s1, vector=reverse_3)  # -> line_3, inside
cluster_12 = Cluster_13(tree=cluster_5.tree, A=cluster_5.s1, vector=vector_2pt_4.Vector)  # -> line_3, inside
cluster_13 = Cluster_13(tree=cluster_5.tree, A=cluster_5.s1, vector=reverse_4)  # -> line_3, inside
cluster_14 = Cluster_13(tree=cluster_6.tree, A=cluster_6.s1, vector=vector_2pt_3.Vector)  # -> line_3, inside
cluster_15 = Cluster_13(tree=cluster_6.tree, A=cluster_6.s1, vector=reverse_5)  # -> line_3, inside
_1_wall = ClusterOutput(merge_7)
_1_window = ClusterOutput(cluster.tree)
_1_below = ClusterOutput(offset_curve)
_1_door = ClusterOutput([cluster_12.line_3, cluster_14.line_3])
_2_wall = ClusterOutput(merge_7)
_2_window = ClusterOutput(offset_curve_4)
_2_door = ClusterOutput([cluster_13.line_3, cluster_15.line_3])
_3_window = ClusterOutput([move_2.Geometry, dash_3])
_3_door = ClusterOutput([cluster_9.line_3, cluster_10.line_3])
_1_wall_thin = ClusterOutput(merge_4)
_1_dash = ClusterOutput([cluster_12.inside, cluster_14.inside])
_2_wall_thin = ClusterOutput(merge_4)
_2_dash = ClusterOutput([cluster_13.inside, cluster_15.inside])
_3_wall = ClusterOutput(merge_7)
_3_wall_thin = ClusterOutput(merge_4)
_3_dash = ClusterOutput([cluster_9.inside, cluster_10.inside])
_4_wall = ClusterOutput(trim_tree_5)
_4_wall_thin = ClusterOutput(merge_4)
_4_window = ClusterOutput(cluster_2.tree)
_4_below = ClusterOutput(offset_curve_3)
_5_wall = ClusterOutput(trim_tree_5)
_5_wall_thin = ClusterOutput(merge_4)
_5_window = ClusterOutput(offset_curve_2)
_5_door = ClusterOutput(cluster_7.tree)

# ==== cluster Cluster_16
geometry = ClusterInput()
geometry_2 = ClusterInput()
cluster_input = ClusterInput()
cluster_input_2 = ClusterInput()
B = ClusterInput()
tree = ClusterInput()
geometry_3 = ClusterInput()
s1 = ClusterInput()
vector = ClusterInput()
geometry_4 = Geometry(geometry)
geometry_5 = Geometry(geometry_2)
unit_vector = UnitVector(Vector=vector)  # -> simplify(Vector)
subtraction = Subtraction(A=0, B=cluster_input_2)
divide_curve = DivideCurve(Curve=geometry_4, Count=4, Kinks=False)  # -> Points, Tangents, Parameters
divide_curve_2 = DivideCurve(Curve=geometry_5, Count=4, Kinks=False)  # -> Points, Tangents, Parameters
clean_tree = CleanTree(RemoveNulls=True, RemoveInvalid=True, RemoveEmpty=True, Tree=tree, SynchronousTree1=s1, SynchronousTree2=unit_vector)  # -> simplify(Tree), simplify(SynchronousTree1), simplify(SynchronousTree2)
clean_tree_2 = CleanTree(RemoveNulls=True, RemoveInvalid=True, RemoveEmpty=True, Tree=geometry_3)  # -> simplify(Tree)
list_item = ListItem(List=divide_curve.Points, Index=0, Wrap=True)  # -> simplify(Item)
list_item_2 = ListItem(List=divide_curve.Points, Index=-2, Wrap=True)  # -> simplify(Item)
list_item_3 = ListItem(List=divide_curve_2.Points, Index=0, Wrap=True)  # -> simplify(Item)
list_item_4 = ListItem(List=divide_curve_2.Points, Index=-2, Wrap=True)  # -> simplify(Item)
ghpython_script = GhPythonScript(x=clean_tree.Tree, z=clean_tree.SynchronousTree1, u=clean_tree.SynchronousTree2, y="intra_comp")  # -> simplify(a), b; inputs x: list, z: list of Point3d, u: list of Vector3d; same code as ghpython_script
opening_large = Opening_large_4(A="0.8", cluster_input=cluster_input_2, cluster_input_2=cluster_input, geometry=geometry_3)  # -> tree, s2, outside
trim_tree = TrimTree(Tree=list_item_2, Depth=1)
trim_tree_2 = TrimTree(Tree=list_item_4, Depth=1)
dash = Dash_2(curve=clean_tree_2, B=B)
panel = Panel(unit_vector)
clean_tree_3 = CleanTree(RemoveNulls=True, RemoveInvalid=True, RemoveEmpty=True, Tree=ghpython_script.a, SynchronousTree1=ghpython_script.b)  # -> Tree, SynchronousTree1
list_item_5 = ListItem(List=trim_tree, Index=0, Wrap=True)
list_item_6 = ListItem(List=trim_tree, Index=1, Wrap=True)
list_item_7 = ListItem(List=trim_tree_2, Index=0, Wrap=True)
list_item_8 = ListItem(List=trim_tree_2, Index=1, Wrap=True)
line = Line(StartPoint=list_item, EndPoint=list_item_2)
line_2 = Line(StartPoint=list_item_5, EndPoint=list_item_6)
line_3 = Line(StartPoint=list_item_3, EndPoint=list_item_4)
line_4 = Line(StartPoint=list_item_7, EndPoint=list_item_8)
division = Division(A=subtraction, B=2)
multiplication = Multiplication(A=clean_tree_3.SynchronousTree1, B=division)
divide_curve_3 = DivideCurve(Curve=line_2, Count=2, Kinks=False)  # -> simplify(Points), Tangents, Parameters
divide_curve_4 = DivideCurve(Curve=line_4, Count=2, Kinks=False)  # -> simplify(Points), Tangents, Parameters
reverse = Reverse(Vector=multiplication)
cull_index = CullIndex(List=divide_curve_3.Points, Indices=[0, -1], Wrap=True)  # -> simplify(List)
length = Length(Curve=line_2)
cull_index_2 = CullIndex(List=divide_curve_4.Points, Indices=[0, -1], Wrap=True)  # -> simplify(List)
length_2 = Length(Curve=line_4)
circle = Circle(Plane=cull_index, Radius=expr("0.4*x", length))  # -> simplify(Circle)
circle_2 = Circle(Plane=cull_index_2, Radius=expr("0.4*x", length_2))  # -> simplify(Circle)
trim_with_regions = TrimWithRegions(Curve=line_2, Regions=circle)  # -> simplify(Inside), simplify(Wall_infra)
trim_with_regions_2 = TrimWithRegions(Curve=line_4, Regions=circle_2)  # -> simplify(Inside), simplify(Wall_infra)
cluster = Cluster_4(A=cluster_input_2, A_2=cluster_input, geometry=trim_with_regions.Inside)  # -> tree, s1
cluster_2 = Cluster_4(A=cluster_input_2, A_2=cluster_input, geometry=trim_with_regions_2.Inside)  # -> tree, s1
move = Move(Geometry=[cluster.tree, cluster_2.tree], Motion=multiplication)  # -> Geometry, Transform
move_2 = Move(Geometry=[cluster.tree, cluster_2.tree], Motion=reverse)  # -> Geometry, Transform
dash_2 = Dash(cluster_input=cluster_input, curve=move.Geometry, B=cluster_input_2)
offset_curve = OffsetCurve(Curve=trim_with_regions.Inside, Distance=[cluster_input_2, subtraction], Corners=1)
offset_curve_2 = OffsetCurve(Curve=trim_with_regions_2.Inside, Distance=[cluster_input_2, subtraction], Corners=1)
dash_3 = Dash(cluster_input=cluster_input, curve=cluster.tree, B=cluster_input_2)
dash_4 = Dash(cluster_input=cluster_input, curve=cluster_2.tree, B=cluster_input_2)
offset_curve_3 = OffsetCurve(Curve=graft(dash_3), Distance=expr("X/2", [cluster_input_2, subtraction]), Corners=1)
offset_curve_4 = OffsetCurve(Curve=graft(dash_4), Distance=expr("X/2", [cluster_input_2, subtraction]), Corners=1)
_1_wall = ClusterOutput([trim_with_regions.Wall_infra, trim_with_regions_2.Wall_infra, dash])
_1_window = ClusterOutput([cluster.tree, cluster_2.tree])
_1_below = ClusterOutput([offset_curve, offset_curve_2])
_2_wall = ClusterOutput([trim_with_regions.Wall_infra, trim_with_regions_2.Wall_infra, dash])
_2_window = ClusterOutput([offset_curve_3, offset_curve_4])
_3_window = ClusterOutput([move_2.Geometry, dash_2])
_4_wall = ClusterOutput([opening_large.outside, trim_with_regions.Wall_infra, trim_with_regions_2.Wall_infra])
_4_window = ClusterOutput([cluster.tree, cluster_2.tree])
_4_below = ClusterOutput([offset_curve, offset_curve_2])
_5_wall = ClusterOutput([opening_large.outside, trim_with_regions_2.Wall_infra, trim_with_regions.Wall_infra])
_5_window = ClusterOutput([offset_curve_3, offset_curve_4])
_3_wall = ClusterOutput([trim_with_regions.Wall_infra, trim_with_regions_2.Wall_infra, dash])

# ==== cluster Cluster_18
geometry = ClusterInput()
geometry_2 = ClusterInput()
cluster_input = ClusterInput()
cluster_input_2 = ClusterInput()
B = ClusterInput()
tree = ClusterInput()
geometry_3 = ClusterInput()
s4 = ClusterInput()
vector = ClusterInput()
geometry_4 = Geometry(geometry_3)
geometry_5 = Geometry(geometry)
geometry_6 = Geometry(geometry_2)
unit_vector = UnitVector(Vector=vector)  # -> simplify(Vector)
clean_tree = CleanTree(
    RemoveNulls=True,
    RemoveInvalid=True,
    RemoveEmpty=True,
    Tree=tree,
    SynchronousTree1=geometry_4,
    SynchronousTree2=geometry_5,
    SynchronousTree3=geometry_6,
    SynchronousTree4=s4,
    SynchronousTree5=unit_vector)  # -> simplify(Tree), simplify(SynchronousTree1), simplify(SynchronousTree2), simplify(SynchronousTree3), simplify(SynchronousTree4), simplify(SynchronousTree5)
merge = Merge(Data1=clean_tree.SynchronousTree2, Data2=clean_tree.SynchronousTree3)
curve_middle = CurveMiddle(Curve=merge)
join_curves = JoinCurves(Curves=clean_tree.SynchronousTree2, Preserve=False)
join_curves_2 = JoinCurves(Curves=clean_tree.SynchronousTree3, Preserve=False)
ghpython_script = GhPythonScript(x=clean_tree.Tree, z=clean_tree.SynchronousTree4, u=clean_tree.SynchronousTree5, y="intra_comp")  # -> simplify(a), b; inputs x: list, z: list of Point3d, u: list of Vector3d; same code as ghpython_script
list_item = ListItem(List=curve_middle, Index=0, Wrap=True)  # -> Item, Item1, Item2, Item3
close_curve = CloseCurve(Curve=join_curves, CloseType=0, Bulge=0.5, Tolerance=0)  # -> Closed, ResultBoolean
close_curve_2 = CloseCurve(Curve=join_curves_2, CloseType=0, Bulge=0.5, Tolerance=0)  # -> Closed, ResultBoolean
clean_tree_2 = CleanTree(RemoveNulls=True, RemoveInvalid=True, RemoveEmpty=True, Tree=ghpython_script.a, SynchronousTree1=ghpython_script.b)  # -> Tree, SynchronousTree1
merge_2 = Merge(Data1=list_item.Item, Data2=list_item.Item1, Data3=list_item.Item3, Data4=list_item.Item2)
interpolate = Interpolate(Vertices=merge_2, Degree=3, Periodic=True, KnotStyle=0)  # -> Curve, Length, Domain
cluster = Cluster_17(A=cluster_input_2, curve=interpolate.Curve)  # -> simplify(tree)
trim_with_region = TrimWithRegion(Curve=clean_tree.SynchronousTree1, Region=cluster)  # -> Inside, Outside
trim_with_region_2 = TrimWithRegion(Curve=clean_tree.SynchronousTree1, Region=cluster)  # -> Inside, Outside
trim_with_region_3 = TrimWithRegion(Curve=cluster, Region=close_curve.Closed)  # -> Inside, Outside
trim_with_region_4 = TrimWithRegion(Curve=cluster, Region=close_curve_2.Closed)  # -> Inside, Outside
merge_3 = Merge(Data1=trim_with_region_3.Inside, Data2=trim_with_region_4.Inside)
curve_middle_2 = CurveMiddle(Curve=merge_3)
curve_middle_3 = CurveMiddle(Curve=clean_tree.SynchronousTree1)
length = Length(Curve=trim_with_region.Inside)
ghpython_script_2 = GhPythonScript(x=clean_tree.SynchronousTree1)  # -> a
# ---------- ghpython_script_2: Python ----------
__author__ = "altai"
__version__ = "2021.08.15"

import rhinoscriptsyntax as rs
import random

if x:
    a = random.randint(0,1)
# ---------- end ghpython_script_2 ----------
geometry_7 = Geometry(trim_with_region_2.Outside)
geometry_8 = Geometry(trim_with_region_3.Inside)
geometry_9 = Geometry(trim_with_region_4.Inside)
circle = Circle(Plane=curve_middle_3, Radius=expr("x/5", length))
closest_point = ClosestPoint(Point=clean_tree_2.Tree, Cloud=curve_middle_2)  # -> ClosestPoint, CPIndex, Distance
dash = Dash(cluster_input=cluster_input, curve=graft(geometry_8), B=B)  # -> simplify(gate_infra)
dash_2 = Dash(cluster_input=cluster_input, curve=graft(geometry_9), B=B)  # -> simplify(gate_infra)
stream_filter = StreamFilter(Gate=ghpython_script_2, Stream0=dash, Stream1=dash_2)
stream_filter_2 = StreamFilter(Gate=ghpython_script_2, Stream0=geometry_8, Stream1=geometry_9)
trim_with_region_5 = TrimWithRegion(Curve=clean_tree.SynchronousTree1, Region=circle)  # -> Inside, Outside
list_item_2 = ListItem(List=merge_3, Index=closest_point.CPIndex, Wrap=True)
dash_3 = Dash(cluster_input=cluster_input, curve=graft(list_item_2), B=B)  # -> simplify(gate_infra)
_1_wall = ClusterOutput([geometry_7, trim_with_region_5.Inside])
_1_arc = ClusterOutput([dash, dash_2])
_2_wall = ClusterOutput([geometry_7, trim_with_region_5.Inside])
_2_arc = ClusterOutput([geometry_8, geometry_9])
_4_wall = ClusterOutput(geometry_7)
_4_arc = ClusterOutput(stream_filter)
_5_wall = ClusterOutput(geometry_7)
_5_arc = ClusterOutput(stream_filter_2)
_3_wall = ClusterOutput([geometry_7, trim_with_region_5.Inside])
_3_arc = ClusterOutput(dash_3)

# ==== cluster Cluster_19
geometry = ClusterInput()
geometry_2 = ClusterInput()
cluster_input = ClusterInput()
B = ClusterInput()
B_2 = ClusterInput()
tree = ClusterInput()
geometry_3 = ClusterInput()
s4 = ClusterInput()
vector = ClusterInput()
unit_vector = UnitVector(Vector=vector)  # -> simplify(Vector)
geometry_4 = Geometry(geometry_3)
geometry_5 = Geometry(geometry)
geometry_6 = Geometry(geometry_2)
clean_tree = CleanTree(
    RemoveNulls=True,
    RemoveInvalid=True,
    RemoveEmpty=True,
    Tree=tree,
    SynchronousTree1=geometry_4,
    SynchronousTree2=geometry_5,
    SynchronousTree3=geometry_6,
    SynchronousTree4=s4,
    SynchronousTree5=unit_vector)  # -> simplify(Tree), simplify(SynchronousTree1), simplify(SynchronousTree2), simplify(SynchronousTree3), simplify(SynchronousTree4), simplify(SynchronousTree5)
divide_curve = DivideCurve(Curve=clean_tree.SynchronousTree2, Count=4, Kinks=False)  # -> simplify(Points), Tangents, Parameters
curve_middle = CurveMiddle(Curve=clean_tree.SynchronousTree1)
subtraction = Subtraction(A=0, B=B)
list_item = ListItem(List=clean_tree.SynchronousTree4, Index=-2, Wrap=True)  # -> simplify(Item), Item1
divide_curve_2 = DivideCurve(Curve=clean_tree.SynchronousTree3, Count=4, Kinks=False)  # -> Points, Tangents, Parameters
curve_middle_2 = CurveMiddle(Curve=clean_tree.SynchronousTree1)
line = Line(StartPoint=list_item.Item, EndPoint=curve_middle)
line_2 = Line(StartPoint=list_item.Item1, EndPoint=curve_middle_2)
list_item_2 = ListItem(List=divide_curve.Points, Index=-2, Wrap=True)  # -> simplify(Item)
list_item_3 = ListItem(List=divide_curve.Points, Index=-3, Wrap=True)  # -> simplify(Item)
list_item_4 = ListItem(List=divide_curve_2.Points, Index=-2, Wrap=True)  # -> simplify(Item)
list_item_5 = ListItem(List=divide_curve_2.Points, Index=-3, Wrap=True)  # -> simplify(Item)
ghpython_script = GhPythonScript(x=clean_tree.Tree, z=clean_tree.SynchronousTree4, u=clean_tree.SynchronousTree5, y="intra_comp")  # -> simplify(a), b; inputs x: list, z: list of Point3d, u: list of Vector3d; same code as ghpython_script
divide_curve_3 = DivideCurve(Curve=line, Count=5, Kinks=False)  # -> Points, Tangents, Parameters
divide_curve_4 = DivideCurve(Curve=line_2, Count=5, Kinks=False)  # -> Points, Tangents, Parameters
trim_tree = TrimTree(Tree=list_item_4, Depth=1)
trim_tree_2 = TrimTree(Tree=list_item_5, Depth=1)
clean_tree_2 = CleanTree(RemoveNulls=True, RemoveInvalid=True, RemoveEmpty=True, Tree=ghpython_script.a, SynchronousTree1=ghpython_script.b)  # -> Tree, SynchronousTree1
divide_branches = DivideBranches(DataTree=list_item_2, DivisionPattern=[0, 1], RenumberPaths=False)  # -> simplify(Data0), simplify(Data1)
divide_branches_2 = DivideBranches(DataTree=list_item_3, DivisionPattern=[0, 1], RenumberPaths=False)  # -> simplify(Data0), simplify(Data1)
list_item_6 = ListItem(List=divide_curve_3.Points, Index=2, Wrap=True)  # -> simplify(Item), simplify(Item1), simplify(Item2)
list_item_7 = ListItem(List=trim_tree, Index=0, Wrap=True)  # -> Item, Item1
list_item_8 = ListItem(List=divide_curve_4.Points, Index=2, Wrap=True)  # -> simplify(Item), simplify(Item1), simplify(Item2)
list_item_9 = ListItem(List=trim_tree_2, Index=0, Wrap=True)  # -> Item, Item1
merge = Merge(Data1=divide_branches.Data0, Data2=list_item_6.Item, Data3=divide_branches.Data1)  # -> simplify(Result)
merge_2 = Merge(Data1=divide_branches_2.Data0, Data2=list_item_6.Item1, Data3=divide_branches_2.Data1)  # -> simplify(Result)
merge_3 = Merge(Data1=list_item_7.Item, Data2=list_item_8.Item, Data3=list_item_7.Item1)
merge_4 = Merge(Data1=list_item_9.Item, Data2=list_item_8.Item1, Data3=list_item_9.Item1)
interpolate = Interpolate(Vertices=merge, Degree=3, Periodic=False, KnotStyle=1)  # -> Curve, Length, Domain
offset_curve = OffsetCurve(Curve=simplify(graft(interpolate.Curve)), Distance=expr("X/2", [B, subtraction]), Corners=1)
divide_branches_3 = DivideBranches(DataTree=offset_curve, DivisionPattern=[0, 1], RenumberPaths=False)  # -> simplify(Data0), simplify(Data1)
merge_5 = Merge(Data1=divide_branches_3.Data0, Data2=divide_branches_3.Data1)
curve_middle_3 = CurveMiddle(Curve=merge_5)
interpolate_2 = Interpolate(Vertices=merge_2, Degree=3, Periodic=False, KnotStyle=1)  # -> Curve, Length, Domain
length = Length(Curve=interpolate_2.Curve)
interpolate_3 = Interpolate(Vertices=merge_3, Degree=3, Periodic=False, KnotStyle=1)  # -> Curve, Length, Domain
offset_curve_2 = OffsetCurve(Curve=simplify(graft(interpolate_3.Curve)), Distance=expr("X/2", [B, subtraction]), Corners=1)
divide_branches_4 = DivideBranches(DataTree=offset_curve_2, DivisionPattern=[0, 1], RenumberPaths=False)  # -> simplify(Data0), simplify(Data1)
merge_6 = Merge(Data1=divide_branches_4.Data0, Data2=divide_branches_4.Data1)
curve_middle_4 = CurveMiddle(Curve=merge_6)
interpolate_4 = Interpolate(Vertices=merge_4, Degree=3, Periodic=False, KnotStyle=1)  # -> Curve, Length, Domain
length_2 = Length(Curve=interpolate_4.Curve)
average = Average(Input=[length, length_2])
multiplication = Multiplication(A=1.1, B=B_2)
geometry_7 = Geometry(clean_tree.SynchronousTree1)
geometry_8 = Geometry(clean_tree.SynchronousTree1)
division = Division(A=average, B=multiplication)
flip_curve = FlipCurve(Curve=interpolate_2.Curve, Guide=geometry_7)  # -> Curve, Flag
flip_curve_2 = FlipCurve(Curve=interpolate_4.Curve, Guide=geometry_8)  # -> Curve, Flag
closest_point = ClosestPoint(Point=clean_tree_2.Tree, Cloud=curve_middle_4)  # -> ClosestPoint, CPIndex, Distance
closest_point_2 = ClosestPoint(Point=clean_tree_2.Tree, Cloud=curve_middle_3)  # -> ClosestPoint, CPIndex, Distance
integer = Integer(division)
dash = Dash_3(cluster_input=cluster_input, curve=interpolate.Curve, B=B)
offset_curve_3 = OffsetCurve(Curve=interpolate.Curve, Distance=[B, subtraction], Corners=1)
dash_2 = Dash_3(cluster_input=cluster_input, curve=interpolate_3.Curve, B=B)
offset_curve_4 = OffsetCurve(Curve=interpolate_3.Curve, Distance=[B, subtraction], Corners=1)
divide_curve_5 = DivideCurve(Curve=flip_curve.Curve, Count=integer, Kinks=False)  # -> simplify(Points), Tangents, Parameters
divide_curve_6 = DivideCurve(Curve=geometry_7, Count=integer, Kinks=False)  # -> simplify(Points), Tangents, Parameters
divide_curve_7 = DivideCurve(Curve=flip_curve_2.Curve, Count=integer, Kinks=False)  # -> simplify(Points), Tangents, Parameters
divide_curve_8 = DivideCurve(Curve=geometry_8, Count=integer, Kinks=False)  # -> simplify(Points), Tangents, Parameters
list_item_10 = ListItem(List=merge_6, Index=closest_point.CPIndex, Wrap=True)
cull_index = CullIndex(List=merge_6, Indices=closest_point.CPIndex, Wrap=True)
list_item_11 = ListItem(List=merge_5, Index=closest_point_2.CPIndex, Wrap=True)
cull_index_2 = CullIndex(List=merge_5, Indices=closest_point_2.CPIndex, Wrap=True)
offset_curve_5 = OffsetCurve(Curve=graft(dash), Distance=expr("X/2", [B, subtraction]), Corners=1)
end_points = EndPoints(Curve=offset_curve_3)  # -> Start, End
offset_curve_6 = OffsetCurve(Curve=graft(dash_2), Distance=expr("X/2", [B, subtraction]), Corners=1)
end_points_2 = EndPoints(Curve=offset_curve_4)  # -> Start, End
line_3 = Line(StartPoint=divide_curve_5.Points, EndPoint=divide_curve_6.Points)
line_4 = Line(StartPoint=divide_curve_7.Points, EndPoint=divide_curve_8.Points)
trim_tree_3 = TrimTree(Tree=end_points.Start, Depth=1)
trim_tree_4 = TrimTree(Tree=end_points.End, Depth=1)
trim_tree_5 = TrimTree(Tree=end_points_2.Start, Depth=1)
trim_tree_6 = TrimTree(Tree=end_points_2.End, Depth=1)
merge_7 = Merge(Data1=list_item_10, Data2=list_item_11)
merge_8 = Merge(Data1=cull_index, Data2=cull_index_2)
merge_9 = Merge(Data1=line_3, Data2=line_4)
trim_tree_7 = TrimTree(Tree=offset_curve_3, Depth=1)
interpolate_5 = Interpolate(Vertices=trim_tree_3, Degree=3, Periodic=False, KnotStyle=1)  # -> Curve, Length, Domain
interpolate_6 = Interpolate(Vertices=trim_tree_4, Degree=3, Periodic=False, KnotStyle=1)  # -> Curve, Length, Domain
trim_tree_8 = TrimTree(Tree=offset_curve_4, Depth=1)
interpolate_7 = Interpolate(Vertices=trim_tree_5, Degree=3, Periodic=False, KnotStyle=1)  # -> Curve, Length, Domain
interpolate_8 = Interpolate(Vertices=trim_tree_6, Degree=3, Periodic=False, KnotStyle=1)  # -> Curve, Length, Domain
dash_3 = Dash_3(cluster_input=offset_curve_2, curve=merge_8, B=B)  # -> simplify(tree)
merge_10 = Merge(Data1=trim_tree_7, Data2=interpolate_5.Curve, Data3=interpolate_6.Curve)
merge_11 = Merge(Data1=trim_tree_8, Data2=interpolate_7.Curve, Data3=interpolate_8.Curve)
_3_window = ClusterOutput([merge_7, dash_3])
_4_window = ClusterOutput([interpolate_3.Curve, interpolate.Curve])
_4_below = ClusterOutput([merge_10, merge_11])
_5_window = ClusterOutput([offset_curve_6, offset_curve_5])
_1_wall_thin = ClusterOutput(merge_9)
_1_window = ClusterOutput([interpolate.Curve, interpolate_3.Curve])
_1_below = ClusterOutput(offset_curve_3)
_2_wall_thin = ClusterOutput(merge_9)
_2_window = ClusterOutput([offset_curve_5, offset_curve_6])
_3_wall_thin = ClusterOutput(merge_9)

# ==== cluster Cluster_20
geometry = ClusterInput()
geometry_2 = ClusterInput()
cluster_input = ClusterInput()
B = ClusterInput()
B_2 = ClusterInput()
tree = ClusterInput()
geometry_3 = ClusterInput()
s4 = ClusterInput()
vector = ClusterInput()
unit_vector = UnitVector(Vector=vector)  # -> simplify(Vector)
geometry_4 = Geometry(geometry_3)
geometry_5 = Geometry(geometry)
geometry_6 = Geometry(geometry_2)
clean_tree = CleanTree(
    RemoveNulls=True,
    RemoveInvalid=True,
    RemoveEmpty=True,
    Tree=tree,
    SynchronousTree1=geometry_4,
    SynchronousTree2=geometry_5,
    SynchronousTree3=geometry_6,
    SynchronousTree4=s4,
    SynchronousTree5=unit_vector)  # -> simplify(Tree), simplify(SynchronousTree1), simplify(SynchronousTree2), simplify(SynchronousTree3), simplify(SynchronousTree4), simplify(SynchronousTree5)
curve_middle = CurveMiddle(Curve=clean_tree.SynchronousTree1)
divide_curve = DivideCurve(Curve=clean_tree.SynchronousTree3, Count=4, Kinks=False)  # -> Points, Tangents, Parameters
curve_middle_2 = CurveMiddle(Curve=clean_tree.SynchronousTree1)
divide_curve_2 = DivideCurve(Curve=clean_tree.SynchronousTree2, Count=4, Kinks=False)  # -> simplify(Points), Tangents, Parameters
ghpython_script = GhPythonScript(x=clean_tree.Tree, z=clean_tree.SynchronousTree4, u=clean_tree.SynchronousTree5, y="intra_comp")  # -> simplify(a), c, b; inputs x: list, z: list of Point3d, u: list of Vector3d
# ---------- ghpython_script: Python ----------
__author__ = "altai"
__version__ = "2021.08.09"

import rhinoscriptsyntax as rs


if not x[0] == x[1]:
    if x[0] == "intra_comp":
        a = z[0]
        c = z[1]
        b = u[0]
    if x[1] == "intra_comp":
        a = z[1]
        c = z[0]
        b = u[1]
# ---------- end ghpython_script ----------
subtraction = Subtraction(A=0, B=B)
list_item = ListItem(List=clean_tree.SynchronousTree4, Index=-2, Wrap=True)  # -> simplify(Item), Item1
line = Line(StartPoint=list_item.Item, EndPoint=curve_middle_2)
line_2 = Line(StartPoint=list_item.Item1, EndPoint=curve_middle)
list_item_2 = ListItem(List=divide_curve_2.Points, Index=-3, Wrap=True)  # -> simplify(Item)
list_item_3 = ListItem(List=divide_curve.Points, Index=-3, Wrap=True)  # -> simplify(Item)
clean_tree_2 = CleanTree(
    RemoveNulls=True,
    RemoveInvalid=True,
    RemoveEmpty=True,
    Tree=ghpython_script.a,
    SynchronousTree1=ghpython_script.c,
    SynchronousTree2=ghpython_script.b)  # -> Tree, SynchronousTree1, SynchronousTree2
divide_curve_3 = DivideCurve(Curve=line, Count=5, Kinks=False)  # -> Points, Tangents, Parameters
divide_curve_4 = DivideCurve(Curve=line_2, Count=5, Kinks=False)  # -> Points, Tangents, Parameters
trim_tree = TrimTree(Tree=list_item_3, Depth=1)
divide_branches = DivideBranches(DataTree=list_item_2, DivisionPattern=[0, 1], RenumberPaths=False)  # -> simplify(Data0), simplify(Data1)
list_item_4 = ListItem(List=divide_curve_3.Points, Index=2, Wrap=True)  # -> simplify(Item), simplify(Item1), simplify(Item2)
list_item_5 = ListItem(List=divide_curve_4.Points, Index=2, Wrap=True)  # -> simplify(Item), simplify(Item1), simplify(Item2)
list_item_6 = ListItem(List=trim_tree, Index=0, Wrap=True)  # -> Item, Item1
curve_closest_point = CurveClosestPoint(Point=clean_tree_2.SynchronousTree1, Curve=clean_tree.SynchronousTree1)  # -> Point, Parameter, Distance
end_points = EndPoints(Curve=clean_tree.SynchronousTree1)  # -> Start, End
merge = Merge(Data1=divide_branches.Data0, Data2=list_item_4.Item2, Data3=divide_branches.Data1)  # -> simplify(Result)
merge_2 = Merge(Data1=list_item_6.Item, Data2=list_item_5.Item2, Data3=list_item_6.Item1)
vector_2pt = Vector2Pt(PointA=curve_closest_point.Point, PointB=ghpython_script.c, Unitize=True)  # -> Vector, Length
merge_3 = Merge(Data1=end_points.Start, Data2=clean_tree_2.SynchronousTree1, Data3=end_points.End)
interpolate = Interpolate(Vertices=merge, Degree=3, Periodic=False, KnotStyle=1)  # -> Curve, Length, Domain
length = Length(Curve=interpolate.Curve)
interpolate_2 = Interpolate(Vertices=merge_2, Degree=3, Periodic=False, KnotStyle=1)  # -> Curve, Length, Domain
length_2 = Length(Curve=interpolate_2.Curve)
merge_4 = Merge(Data1=interpolate.Curve, Data2=interpolate_2.Curve)
average = Average(Input=[length, length_2])
geometry_7 = Geometry(clean_tree.SynchronousTree1)
curve_middle_3 = CurveMiddle(Curve=merge_4)
polyline = PolyLine(Vertices=merge_3, Closed=False)
geometry_8 = Geometry(clean_tree.SynchronousTree1)
division = Division(A=average, B=B_2)
flip_curve = FlipCurve(Curve=interpolate.Curve, Guide=geometry_7)  # -> Curve, Flag
flip_curve_2 = FlipCurve(Curve=interpolate_2.Curve, Guide=geometry_8)  # -> Curve, Flag
integer = Integer(expr("x-1", division))
closest_point = ClosestPoint(Point=clean_tree_2.Tree, Cloud=curve_middle_3)  # -> ClosestPoint, CPIndex, Distance
divide_curve_5 = DivideCurve(Curve=flip_curve.Curve, Count=integer, Kinks=False)  # -> simplify(Points), Tangents, Parameters
divide_curve_6 = DivideCurve(Curve=geometry_7, Count=integer, Kinks=False)  # -> simplify(Points), Tangents, Parameters
divide_curve_7 = DivideCurve(Curve=flip_curve_2.Curve, Count=integer, Kinks=False)  # -> simplify(Points), Tangents, Parameters
divide_curve_8 = DivideCurve(Curve=geometry_8, Count=integer, Kinks=False)  # -> simplify(Points), Tangents, Parameters
list_item_7 = ListItem(List=merge_4, Index=closest_point.CPIndex, Wrap=True)
line_3 = Line(StartPoint=divide_curve_5.Points, EndPoint=divide_curve_6.Points)
cull_index = CullIndex(List=divide_curve_6.Points, Indices=-1, Wrap=True)  # -> simplify(List)
shift_list = ShiftList(List=divide_curve_6.Points, Shift=1, Wrap=False)  # -> simplify(List)
line_4 = Line(StartPoint=divide_curve_7.Points, EndPoint=divide_curve_8.Points)
cull_index_2 = CullIndex(List=divide_curve_7.Points, Indices=-1, Wrap=True)  # -> simplify(List)
shift_list_2 = ShiftList(List=divide_curve_7.Points, Shift=1, Wrap=False)  # -> simplify(List)
divide_curve_9 = DivideCurve(Curve=list_item_7, Count=integer, Kinks=False)  # -> simplify(Points), Tangents, Parameters
divide_curve_10 = DivideCurve(Curve=geometry_8, Count=integer, Kinks=False)  # -> simplify(Points), Tangents, Parameters
cull_index_3 = CullIndex(List=divide_curve_5.Points, Indices=-1, Wrap=True)  # -> simplify(List)
shift_list_3 = ShiftList(List=divide_curve_5.Points, Shift=1, Wrap=False)  # -> simplify(List)
cull_index_4 = CullIndex(List=divide_curve_9.Points, Indices=-1, Wrap=True)  # -> simplify(List)
shift_list_4 = ShiftList(List=divide_curve_9.Points, Shift=1, Wrap=False)  # -> simplify(List)
line_5 = Line(StartPoint=cull_index, EndPoint=shift_list)
line_6 = Line(StartPoint=cull_index_2, EndPoint=shift_list_2)
cull_index_5 = CullIndex(List=divide_curve_10.Points, Indices=[0, -1], Wrap=True)
line_7 = Line(StartPoint=cull_index_3, EndPoint=shift_list_3)
line_8 = Line(StartPoint=cull_index_4, EndPoint=shift_list_4)
list_item_8 = ListItem(List=line_3, Index=[0, -1], Wrap=True)
list_item_9 = ListItem(List=line_4, Index=[0, -1], Wrap=True)
curve_middle_4 = CurveMiddle(Curve=line_5)
length_3 = Length(Curve=line_5)
curve_middle_5 = CurveMiddle(Curve=line_6)
length_4 = Length(Curve=line_6)
move = Move(Geometry=cull_index_5, Motion=expr("100*x", vector_2pt.Vector))  # -> Geometry, Transform
curve_middle_6 = CurveMiddle(Curve=line_7)
length_5 = Length(Curve=line_7)
curve_middle_7 = CurveMiddle(Curve=line_8)
length_6 = Length(Curve=line_8)
circle = Circle(Plane=curve_middle_4, Radius=expr("x/3", length_3))
circle_2 = Circle(Plane=curve_middle_5, Radius=expr("x/3", length_4))
line_9 = Line(StartPoint=cull_index_5, EndPoint=move.Geometry)
circle_3 = Circle(Plane=curve_middle_6, Radius=expr("x/3", length_5))
circle_4 = Circle(Plane=curve_middle_7, Radius=expr("x/3", length_6))
trim_with_regions = TrimWithRegions(Curve=flip_curve_2.Curve, Regions=circle_2)  # -> Inside, simplify(Outside)
curve_curve = CurveCurve(CurveA=simplify(line_9), CurveB=polyline)  # -> Points, ParamsA, ParamsB
trim_tree_2 = TrimTree(Tree=curve_curve.Points, Depth=1)
trim_with_regions_2 = TrimWithRegions(Curve=flip_curve.Curve, Regions=circle_3)  # -> Inside, simplify(Outside)
merge_5 = Merge(Data1=flip_curve.Curve, Data2=flip_curve_2.Curve)
merge_6 = Merge(Data1=line_3, Data2=line_4)
merge_7 = Merge(Data1=list_item_8, Data2=list_item_9)
trim_with_regions_3 = TrimWithRegions(Curve=geometry_7, Regions=circle)  # -> Inside, simplify(Outside)
merge_8 = Merge(Data1=trim_with_regions_2.Outside, Data2=trim_with_regions.Outside)  # -> simplify(Result)
trim_with_regions_4 = TrimWithRegions(Curve=list_item_7, Regions=circle_4)  # -> Inside, simplify(Outside)
line_10 = Line(StartPoint=divide_curve_9.Points, EndPoint=divide_curve_10.Points)
line_11 = Line(StartPoint=simplify(cull_index_5), EndPoint=trim_tree_2)
_1_wall = ClusterOutput([merge_8, trim_with_regions_3.Outside])
_1_wall_thin = ClusterOutput(merge_6)
_2_wall = ClusterOutput([merge_5, trim_with_regions_3.Outside])
_2_wall_thin = ClusterOutput(merge_6)
_3_wall = ClusterOutput([trim_with_regions_3.Outside, trim_with_regions_4.Outside])
_3_wall_thin = ClusterOutput([line_10, line_11])
_4_wall = ClusterOutput(merge_8)
_4_wall_thin = ClusterOutput(merge_7)
_5_wall = ClusterOutput(merge_5)
_5_wall_thin = ClusterOutput(merge_7)

# ==== cluster Cluster_21
cluster_input = ClusterInput()
cluster_input_2 = ClusterInput()
radius = ClusterInput()
tree = ClusterInput()
geometry = ClusterInput()
geometry_2 = ClusterInput()
geometry_3 = ClusterInput()
geometry_4 = ClusterInput()
vector = ClusterInput()
panel = Panel(radius)
unit_vector = UnitVector(Vector=vector)  # -> simplify(Vector)
geometry_5 = Geometry(geometry)
geometry_6 = Geometry(geometry_2)
geometry_7 = Geometry(geometry_3)
geometry_8 = Geometry(geometry_4)
clean_tree = CleanTree(
    RemoveNulls=True,
    RemoveInvalid=True,
    RemoveEmpty=True,
    Tree=tree,
    SynchronousTree1=geometry_5,
    SynchronousTree2=geometry_6,
    SynchronousTree3=geometry_7,
    SynchronousTree4=geometry_8,
    SynchronousTree5=unit_vector)  # -> simplify(Tree), SynchronousTree1, SynchronousTree2, SynchronousTree3, simplify(SynchronousTree4), simplify(SynchronousTree5)
divide_curve = DivideCurve(Curve=clean_tree.SynchronousTree2, Count=4, Kinks=False)  # -> Points, Tangents, Parameters
divide_curve_2 = DivideCurve(Curve=clean_tree.SynchronousTree3, Count=4, Kinks=False)  # -> Points, Tangents, Parameters
ghpython_script = GhPythonScript(x=clean_tree.Tree, z=clean_tree.SynchronousTree4, u=clean_tree.SynchronousTree5, y="intra_comp")  # -> simplify(a), b; inputs x: list, z: list of Point3d, u: list of Vector3d; same code as ghpython_script
clean_tree_2 = CleanTree(RemoveNulls=True, RemoveInvalid=True, RemoveEmpty=True, Tree=ghpython_script.a, SynchronousTree1=ghpython_script.b)  # -> Tree, SynchronousTree1
list_item = ListItem(List=divide_curve.Points, Index=2, Wrap=True)  # -> Item2, Item1, Item
list_item_2 = ListItem(List=divide_curve_2.Points, Index=2, Wrap=True)  # -> Item2, Item1, Item
trim_tree = TrimTree(Tree=list_item.Item, Depth=1)
trim_tree_2 = TrimTree(Tree=list_item_2.Item, Depth=1)
line = Line(StartPoint=list_item.Item, EndPoint=list_item_2.Item)
list_item_3 = ListItem(List=trim_tree, Index=0, Wrap=True)
list_item_4 = ListItem(List=trim_tree, Index=1, Wrap=True)
list_item_5 = ListItem(List=trim_tree_2, Index=0, Wrap=True)
list_item_6 = ListItem(List=trim_tree_2, Index=1, Wrap=True)
trim_tree_3 = TrimTree(Tree=line, Depth=1)
line_2 = Line(StartPoint=list_item_3, EndPoint=list_item_4)
line_3 = Line(StartPoint=list_item_5, EndPoint=list_item_6)
curve_middle = CurveMiddle(Curve=simplify(line_2))
curve_middle_2 = CurveMiddle(Curve=simplify(line_3))
length = Length(Curve=line_2)
length_2 = Length(Curve=line_3)
merge = Merge(Data1=trim_tree_3, Data2=line_2, Data3=line_3)
join_curves = JoinCurves(Curves=merge, Preserve=False)
merge_2 = Merge(Data1=curve_middle, Data2=curve_middle_2)
average = Average(Input=[length, length_2])
closest_point = ClosestPoint(Point=clean_tree_2.Tree, Cloud=merge_2)  # -> ClosestPoint, CPIndex, Distance
trim_with_regions = TrimWithRegions(Curve=clean_tree.SynchronousTree1, Regions=join_curves)  # -> simplify(Inside), simplify(Wall_infra)
division = GhPythonScript(x=average, y=radius)  # -> a
# ---------- division: Python ----------
__author__ = "altai"
__version__ = "2021.08.20"

import rhinoscriptsyntax as rs

a = x//(2*y)
# ---------- end division ----------
list_item_7 = ListItem(List=[line_2, line_3], Index=closest_point.CPIndex, Wrap=True)
curve_middle_3 = CurveMiddle(Curve=trim_with_regions.Wall_infra)
divide_curve_3 = DivideCurve(Curve=line_2, Count=division, Kinks=False)  # -> simplify(Points), Tangents, Parameters
divide_curve_4 = DivideCurve(Curve=line_3, Count=division, Kinks=False)  # -> simplify(Points), Tangents, Parameters
divide_curve_5 = DivideCurve(Curve=list_item_7, Count=division, Kinks=False)  # -> simplify(Points), Tangents, Parameters
list_item_8 = ListItem(List=curve_middle_3, Index=0, Wrap=True)  # -> Item, Item1
curve_middle_4 = CurveMiddle(Curve=list_item_7)
shift_list = ShiftList(List=divide_curve_3.Points, Shift=1, Wrap=False)
cull_index = CullIndex(List=divide_curve_3.Points, Indices=-1, Wrap=True)
shift_list_2 = ShiftList(List=divide_curve_4.Points, Shift=1, Wrap=False)
cull_index_2 = CullIndex(List=divide_curve_4.Points, Indices=-1, Wrap=True)
cull_index_3 = CullIndex(List=divide_curve_5.Points, Indices=-1, Wrap=True)
shift_list_3 = ShiftList(List=divide_curve_5.Points, Shift=1, Wrap=False)
line_4 = Line(StartPoint=list_item_8.Item, EndPoint=list_item_8.Item1)
line_5 = Line(StartPoint=shift_list, EndPoint=cull_index)
line_6 = Line(StartPoint=shift_list_2, EndPoint=cull_index_2)
scale = Scale(Geometry=list_item_7, Center=curve_middle_4, Factor=10)  # -> Geometry, Transform
line_7 = Line(StartPoint=shift_list_3, EndPoint=cull_index_3)
curve_middle_5 = CurveMiddle(Curve=clean_tree.SynchronousTree1)
length_3 = Length(Curve=line_4)
curve_middle_6 = CurveMiddle(Curve=line_5)
curve_middle_7 = CurveMiddle(Curve=line_6)
curve_middle_8 = CurveMiddle(Curve=line_7)
curve_closest_point = CurveClosestPoint(Point=clean_tree_2.Tree, Curve=scale.Geometry)  # -> Point, Parameter, Distance
circle = Circle(Plane=curve_middle_5, Radius=expr("0.5*x", length_3))  # -> simplify(Circle)
circle_2 = Circle(Plane=curve_middle_6, Radius=expr("0.9*x", radius))  # -> simplify(Circle)
circle_3 = Circle(Plane=curve_middle_7, Radius=expr("0.9*x", radius))  # -> simplify(Circle)
circle_4 = Circle(Plane=curve_middle_8, Radius=expr("0.9*x", radius))  # -> simplify(Circle)
vector_2pt = Vector2Pt(PointA=clean_tree_2.Tree, PointB=curve_closest_point.Point, Unitize=True)  # -> Vector, Length
division_2 = Division(A=cluster_input_2, B=2)
trim_with_regions_2 = TrimWithRegions(Curve=clean_tree.SynchronousTree1, Regions=circle)  # -> simplify(Inside), simplify(Wall_infra)
trim_with_regions_3 = TrimWithRegions(Curve=line_2, Regions=circle_2)  # -> simplify(Inside), simplify(Wall_infra)
trim_with_regions_4 = TrimWithRegions(Curve=line_3, Regions=circle_3)  # -> simplify(Inside), simplify(Wall_infra)
trim_with_regions_5 = TrimWithRegions(Curve=list_item_7, Regions=circle_4)  # -> simplify(Inside), simplify(Wall_infra)
multiplication = Multiplication(A=vector_2pt.Vector, B=division_2)
reverse = Reverse(Vector=multiplication)
cluster = Cluster_4(A=cluster_input_2, A_2=cluster_input, geometry=trim_with_regions_5.Inside)  # -> tree, s1
line_8 = Line(StartPoint=divide_curve_3.Points, EndPoint=divide_curve_4.Points)
curve_curve = CurveCurve(CurveA=line_8, CurveB=clean_tree.SynchronousTree1)  # -> Points, ParamsA, ParamsB
distance = Distance(PointA=curve_curve.Points, PointB=graft(divide_curve_3.Points))
distance_2 = Distance(PointA=curve_curve.Points, PointB=graft(divide_curve_4.Points))
merge_3 = Merge(Data1=distance, Data2=distance_2)
sort_list = SortList(Keys=merge_3)  # -> Keys, ValuesValuesA
list_item_9 = ListItem(List=sort_list.Keys, Index=0, Wrap=True)
merge_4 = Merge(Data1=trim_with_regions.Wall_infra, Data2=trim_with_regions_3.Wall_infra, Data3=trim_with_regions_4.Wall_infra)
merge_5 = Merge(Data1=clean_tree.SynchronousTree1, Data2=trim_with_regions_3.Wall_infra, Data3=trim_with_regions_4.Wall_infra)
circle_5 = Circle(Plane=curve_curve.Points, Radius=expr("0.4*x", list_item_9))  # -> simplify(Circle)
move = Move(Geometry=cluster.tree, Motion=multiplication)  # -> Geometry, Transform
move_2 = Move(Geometry=cluster.tree, Motion=reverse)  # -> Geometry, Transform
trim_with_regions_6 = TrimWithRegions(Curve=graft(line_8), Regions=circle_5)  # -> simplify(Inside), simplify(Wall_infra)
dash = Dash(cluster_input=cluster_input, curve=move.Geometry, B=cluster_input_2)
end_points = EndPoints(Curve=trim_with_regions_6.Inside)  # -> Start, End
merge_6 = Merge(Data1=dash, Data2=move_2.Geometry)
merge_7 = Merge(Data1=trim_with_regions_2.Wall_infra, Data2=trim_with_regions_3.Wall_infra, Data3=trim_with_regions_4.Wall_infra)
trim_tree_4 = TrimTree(Tree=end_points.Start, Depth=1)
trim_tree_5 = TrimTree(Tree=end_points.End, Depth=1)
geometry_9 = Geometry(trim_with_regions_6.Wall_infra)
interpolate = Interpolate(Vertices=trim_tree_4, Degree=3, Periodic=False, KnotStyle=1)  # -> Curve, Length, Domain
interpolate_2 = Interpolate(Vertices=trim_tree_5, Degree=3, Periodic=False, KnotStyle=1)  # -> Curve, Length, Domain
merge_8 = Merge(Data1=trim_with_regions_2.Wall_infra, Data2=interpolate.Curve, Data3=interpolate_2.Curve)
_1_wall = ClusterOutput(merge_4)
_1_wall_thin = ClusterOutput(line_8)
_2_wall = ClusterOutput(merge_5)
_2_wall_thin = ClusterOutput(line_8)
_3_wall = ClusterOutput(merge_4)
_3_wall_thin = ClusterOutput(line_8)
_3_window = ClusterOutput(merge_6)
_4_wall = ClusterOutput(merge_7)
_4_wall_thin = ClusterOutput(geometry_9)
_5_wall = ClusterOutput(merge_8)
_5_wall_thin = ClusterOutput(geometry_9)

# ==== cluster Cluster_23
radius = ClusterInput()
y = ClusterInput()
tree = ClusterInput()
geometry = ClusterInput()
geometry_2 = ClusterInput()
geometry_3 = ClusterInput()
geometry_4 = ClusterInput()
vector = ClusterInput()
panel = Panel(ClusterInput())
unit_vector = UnitVector(Vector=vector)  # -> simplify(Vector)
geometry_5 = Geometry(geometry)
geometry_6 = Geometry(geometry_2)
geometry_7 = Geometry(geometry_3)
geometry_8 = Geometry(geometry_4)
clean_tree = CleanTree(
    RemoveNulls=True,
    RemoveInvalid=True,
    RemoveEmpty=True,
    Tree=tree,
    SynchronousTree1=geometry_5,
    SynchronousTree2=geometry_6,
    SynchronousTree3=geometry_7,
    SynchronousTree4=geometry_8,
    SynchronousTree5=unit_vector)  # -> simplify(Tree), SynchronousTree1, SynchronousTree2, SynchronousTree3, simplify(SynchronousTree4), simplify(SynchronousTree5)
divide_curve = DivideCurve(Curve=clean_tree.SynchronousTree2, Count=4, Kinks=False)  # -> Points, Tangents, Parameters
divide_curve_2 = DivideCurve(Curve=clean_tree.SynchronousTree3, Count=4, Kinks=False)  # -> Points, Tangents, Parameters
merge = Merge(Data1=clean_tree.SynchronousTree2, Data2=clean_tree.SynchronousTree3)
ghpython_script = GhPythonScript(x=clean_tree.Tree, z=clean_tree.SynchronousTree4, u=clean_tree.SynchronousTree5, y="intra_comp")  # -> simplify(a), b; inputs x: list, z: list of Point3d, u: list of Vector3d; same code as ghpython_script
list_item = ListItem(List=divide_curve.Points, Index=0, Wrap=True)  # -> Item2, Item1, Item, Item1_2, Item2_2
list_item_2 = ListItem(List=divide_curve_2.Points, Index=0, Wrap=True)  # -> Item2, Item1, Item, Item1_2, Item2_2
clean_tree_2 = CleanTree(RemoveNulls=True, RemoveInvalid=True, RemoveEmpty=True, Tree=ghpython_script.a, SynchronousTree1=ghpython_script.b)  # -> Tree, SynchronousTree1
curve_middle = CurveMiddle(Curve=merge)
trim_tree = TrimTree(Tree=list_item.Item2, Depth=1)
trim_tree_2 = TrimTree(Tree=list_item.Item2_2, Depth=1)
trim_tree_3 = TrimTree(Tree=list_item.Item1_2, Depth=1)
trim_tree_4 = TrimTree(Tree=list_item_2.Item2, Depth=1)
trim_tree_5 = TrimTree(Tree=list_item_2.Item2_2, Depth=1)
trim_tree_6 = TrimTree(Tree=list_item_2.Item1_2, Depth=1)
closest_points = ClosestPoints(Point=clean_tree_2.Tree, Cloud=curve_middle, Count=2)  # -> ClosestPoint, CPIndex, Distance
list_item_3 = ListItem(List=trim_tree, Index=0, Wrap=True)
list_item_4 = ListItem(List=trim_tree, Index=1, Wrap=True)
list_item_5 = ListItem(List=trim_tree_2, Index=0, Wrap=True)
list_item_6 = ListItem(List=trim_tree_2, Index=1, Wrap=True)
list_item_7 = ListItem(List=trim_tree_3, Index=0, Wrap=True)
list_item_8 = ListItem(List=trim_tree_3, Index=1, Wrap=True)
list_item_9 = ListItem(List=trim_tree_4, Index=0, Wrap=True)
list_item_10 = ListItem(List=trim_tree_4, Index=1, Wrap=True)
list_item_11 = ListItem(List=trim_tree_5, Index=0, Wrap=True)
list_item_12 = ListItem(List=trim_tree_5, Index=1, Wrap=True)
list_item_13 = ListItem(List=trim_tree_6, Index=0, Wrap=True)
list_item_14 = ListItem(List=trim_tree_6, Index=1, Wrap=True)
line = Line(StartPoint=list_item_3, EndPoint=list_item_4)
line_2 = Line(StartPoint=list_item_5, EndPoint=list_item_6)
line_3 = Line(StartPoint=list_item_7, EndPoint=list_item_8)
line_4 = Line(StartPoint=list_item_9, EndPoint=list_item_10)
line_5 = Line(StartPoint=list_item_11, EndPoint=list_item_12)
line_6 = Line(StartPoint=list_item_13, EndPoint=list_item_14)
list_item_15 = ListItem(List=merge, Index=closest_points.CPIndex, Wrap=True)
flip_curve = FlipCurve(Curve=line, Guide=clean_tree.SynchronousTree1)  # -> Curve, Flag
flip_curve_2 = FlipCurve(Curve=line_2, Guide=clean_tree.SynchronousTree1)  # -> Curve, Flag
flip_curve_3 = FlipCurve(Curve=line_3, Guide=clean_tree.SynchronousTree1)  # -> Curve, Flag
flip_curve_4 = FlipCurve(Curve=line_4, Guide=clean_tree.SynchronousTree1)  # -> Curve, Flag
flip_curve_5 = FlipCurve(Curve=line_5, Guide=clean_tree.SynchronousTree1)  # -> Curve, Flag
flip_curve_6 = FlipCurve(Curve=line_6, Guide=clean_tree.SynchronousTree1)  # -> Curve, Flag
divide_curve_3 = DivideCurve(Curve=list_item_15, Count=4, Kinks=False)  # -> Points, Tangents, Parameters
list_item_16 = ListItem(List=divide_curve_3.Points, Index=0, Wrap=True)  # -> Item2, Item1, Item, Item1_2, Item2_2
length = Length(Curve=flip_curve.Curve)
length_2 = Length(Curve=flip_curve_4.Curve)
trim_tree_7 = TrimTree(Tree=list_item_16.Item2, Depth=1)
trim_tree_8 = TrimTree(Tree=list_item_16.Item2_2, Depth=1)
trim_tree_9 = TrimTree(Tree=list_item_16.Item1_2, Depth=1)
division = GhPythonScript(x=length, y=y)  # -> a; same code as division
division_2 = GhPythonScript(x=length_2, y=y)  # -> a
# ---------- division_2: Python ----------
__author__ = "altai"
__version__ = "2021.08.20"

import rhinoscriptsyntax as rs

a = x//(y*2)
# ---------- end division_2 ----------
divide_curve_4 = DivideCurve(Curve=flip_curve.Curve, Count=division, Kinks=False)  # -> simplify(Points), Tangents, Parameters
divide_curve_5 = DivideCurve(Curve=flip_curve_2.Curve, Count=expr("x+2", division), Kinks=False)  # -> simplify(Points), Tangents, Parameters
divide_curve_6 = DivideCurve(Curve=flip_curve_3.Curve, Count=expr("x+4", division), Kinks=False)  # -> simplify(Points), Tangents, Parameters
divide_curve_7 = DivideCurve(Curve=clean_tree.SynchronousTree1, Count=expr("x+6", division), Kinks=False)  # -> simplify(Points), Tangents, Parameters
divide_curve_8 = DivideCurve(Curve=flip_curve_4.Curve, Count=division_2, Kinks=False)  # -> simplify(Points), Tangents, Parameters
divide_curve_9 = DivideCurve(Curve=flip_curve_5.Curve, Count=expr("x+2", division_2), Kinks=False)  # -> simplify(Points), Tangents, Parameters
divide_curve_10 = DivideCurve(Curve=flip_curve_6.Curve, Count=expr("x+4", division_2), Kinks=False)  # -> simplify(Points), Tangents, Parameters
divide_curve_11 = DivideCurve(Curve=clean_tree.SynchronousTree1, Count=expr("x+6", division_2), Kinks=False)  # -> simplify(Points), Tangents, Parameters
list_item_17 = ListItem(List=trim_tree_7, Index=0, Wrap=True)
list_item_18 = ListItem(List=trim_tree_7, Index=1, Wrap=True)
list_item_19 = ListItem(List=trim_tree_8, Index=0, Wrap=True)
list_item_20 = ListItem(List=trim_tree_8, Index=1, Wrap=True)
list_item_21 = ListItem(List=trim_tree_9, Index=0, Wrap=True)
list_item_22 = ListItem(List=trim_tree_9, Index=1, Wrap=True)
circle = Circle(Plane=[divide_curve_4.Points, divide_curve_5.Points, divide_curve_6.Points], Radius=expr("x/4", radius))
circle_2 = Circle(Plane=[divide_curve_8.Points, divide_curve_9.Points, divide_curve_10.Points], Radius=expr("x/4", radius))
line_7 = Line(StartPoint=list_item_17, EndPoint=list_item_18)
line_8 = Line(StartPoint=list_item_19, EndPoint=list_item_20)
line_9 = Line(StartPoint=list_item_21, EndPoint=list_item_22)
cull_index = CullIndex(List=divide_curve_5.Points, Indices=[0, -1], Wrap=True)
cull_index_2 = CullIndex(List=divide_curve_9.Points, Indices=[0, -1], Wrap=True)
cull_index_3 = CullIndex(List=divide_curve_7.Points, Indices=[0, -1], Wrap=True)
cull_index_4 = CullIndex(List=divide_curve_11.Points, Indices=[0, -1], Wrap=True)
cull_index_5 = CullIndex(List=divide_curve_6.Points, Indices=[0, -1], Wrap=True)
cull_index_6 = CullIndex(List=divide_curve_10.Points, Indices=[0, -1], Wrap=True)
flip_curve_7 = FlipCurve(Curve=line_7, Guide=clean_tree.SynchronousTree1)  # -> Curve, Flag
flip_curve_8 = FlipCurve(Curve=line_8, Guide=clean_tree.SynchronousTree1)  # -> Curve, Flag
flip_curve_9 = FlipCurve(Curve=line_9, Guide=clean_tree.SynchronousTree1)  # -> Curve, Flag
trim_with_regions = TrimWithRegions(Curve=[flip_curve.Curve, flip_curve_2.Curve, flip_curve_3.Curve], Regions=circle)  # -> simplify(Inside), simplify(Wall_infra)
trim_with_regions_2 = TrimWithRegions(Curve=[flip_curve_4.Curve, flip_curve_5.Curve, flip_curve_6.Curve], Regions=circle_2)  # -> simplify(Inside), simplify(Wall_infra)
line_10 = Line(StartPoint=divide_curve_4.Points, EndPoint=cull_index)
line_11 = Line(StartPoint=divide_curve_5.Points, EndPoint=cull_index_5)
line_12 = Line(StartPoint=divide_curve_6.Points, EndPoint=cull_index_3)
line_13 = Line(StartPoint=divide_curve_8.Points, EndPoint=cull_index_2)
line_14 = Line(StartPoint=divide_curve_9.Points, EndPoint=cull_index_6)
line_15 = Line(StartPoint=divide_curve_10.Points, EndPoint=cull_index_4)
length_3 = Length(Curve=flip_curve_7.Curve)
division_3 = GhPythonScript(x=length_3, y=y)  # -> a
# ---------- division_3: Python ----------
__author__ = "altai"
__version__ = "2021.08.20"

import rhinoscriptsyntax as rs

a = x//y
# ---------- end division_3 ----------
divide_curve_12 = DivideCurve(Curve=flip_curve_7.Curve, Count=division_3, Kinks=False)  # -> simplify(Points), Tangents, Parameters
divide_curve_13 = DivideCurve(Curve=flip_curve_8.Curve, Count=expr("x+2", division_3), Kinks=False)  # -> simplify(Points), Tangents, Parameters
divide_curve_14 = DivideCurve(Curve=flip_curve_9.Curve, Count=expr("x+4", division_3), Kinks=False)  # -> simplify(Points), Tangents, Parameters
divide_curve_15 = DivideCurve(Curve=clean_tree.SynchronousTree1, Count=expr("x+6", division_3), Kinks=False)  # -> simplify(Points), Tangents, Parameters
cull_index_7 = CullIndex(List=divide_curve_13.Points, Indices=[0, -1], Wrap=True)
circle_3 = Circle(Plane=divide_curve_11.Points, Radius=expr("x/4", radius))
cull_index_8 = CullIndex(List=divide_curve_15.Points, Indices=[0, -1], Wrap=True)
cull_index_9 = CullIndex(List=divide_curve_14.Points, Indices=[0, -1], Wrap=True)
line_16 = Line(StartPoint=divide_curve_12.Points, EndPoint=cull_index_7)
line_17 = Line(StartPoint=divide_curve_13.Points, EndPoint=cull_index_9)
line_18 = Line(StartPoint=divide_curve_14.Points, EndPoint=cull_index_8)
trim_with_regions_3 = TrimWithRegions(Curve=clean_tree.SynchronousTree1, Regions=circle_3)  # -> simplify(Inside), simplify(Wall_infra)
curve_middle_2 = CurveMiddle(Curve=trim_with_regions_3.Wall_infra)
length_4 = Length(Curve=trim_with_regions_3.Wall_infra)
circle_4 = Circle(Plane=curve_middle_2, Radius=expr("x/3", length_4))
trim_with_regions_4 = TrimWithRegions(Curve=trim_with_regions_3.Wall_infra, Regions=circle_4)  # -> simplify(Inside), simplify(Wall_infra)
merge_2 = Merge(Data1=line_10, Data2=line_11, Data3=line_12)
merge_3 = Merge(Data1=flip_curve.Curve, Data2=flip_curve_2.Curve, Data3=flip_curve_3.Curve)
merge_4 = Merge(Data1=line_13, Data2=line_14, Data3=line_15)
merge_5 = Merge(Data1=flip_curve_4.Curve, Data2=flip_curve_5.Curve, Data3=flip_curve_6.Curve)
geometry_9 = Geometry(trim_with_regions.Inside)
geometry_10 = Geometry(trim_with_regions_2.Inside)
merge_6 = Merge(Data1=line_16, Data2=line_17, Data3=line_18)
merge_7 = Merge(Data1=flip_curve_7.Curve, Data2=flip_curve_8.Curve, Data3=flip_curve_9.Curve)
geometry_11 = Geometry(trim_with_regions_3.Inside)
geometry_12 = Geometry(trim_with_regions_4.Wall_infra)
merge_8 = Merge(Data1=geometry_9, Data2=geometry_10, Data3=geometry_11)
merge_9 = Merge(Data1=merge_2, Data2=merge_3, Data3=merge_4, Data4=merge_5, Data5=geometry_12)
merge_10 = Merge(Data1=merge_6, Data2=merge_7)
merge_11 = Merge(Data1=merge_2, Data2=merge_4)
_1_wall = ClusterOutput(merge_8)
_1_wall_thin = ClusterOutput(geometry_12)
_2_wall = ClusterOutput(merge_8)
_2_wall_thin = ClusterOutput(merge_9)
_3_wall = ClusterOutput(merge_8)
_3_wall_thin = ClusterOutput(merge_10)
_4_wall = ClusterOutput(merge_8)
_5_wall = ClusterOutput(merge_8)
_5_wall_thin = ClusterOutput(merge_11)

# ==== cluster Cluster_24
radius = ClusterInput()
y = ClusterInput()
tree = ClusterInput()
geometry = ClusterInput()
geometry_2 = ClusterInput()
geometry_3 = ClusterInput()
geometry_4 = ClusterInput()
vector = ClusterInput()
panel = Panel(ClusterInput())
unit_vector = UnitVector(Vector=vector)  # -> simplify(Vector)
geometry_5 = Geometry(geometry)
geometry_6 = Geometry(geometry_2)
geometry_7 = Geometry(geometry_3)
geometry_8 = Geometry(geometry_4)
clean_tree = CleanTree(
    RemoveNulls=True,
    RemoveInvalid=True,
    RemoveEmpty=True,
    Tree=tree,
    SynchronousTree1=geometry_5,
    SynchronousTree2=geometry_6,
    SynchronousTree3=geometry_7,
    SynchronousTree4=geometry_8,
    SynchronousTree5=unit_vector)  # -> simplify(Tree), SynchronousTree1, SynchronousTree2, SynchronousTree3, simplify(SynchronousTree4), simplify(SynchronousTree5)
divide_curve = DivideCurve(Curve=clean_tree.SynchronousTree2, Count=4, Kinks=False)  # -> Points, Tangents, Parameters
divide_curve_2 = DivideCurve(Curve=clean_tree.SynchronousTree3, Count=4, Kinks=False)  # -> Points, Tangents, Parameters
list_item = ListItem(List=divide_curve.Points, Index=0, Wrap=True)  # -> Item2, Item1, Item, Item1_2, Item2_2
list_item_2 = ListItem(List=divide_curve_2.Points, Index=0, Wrap=True)  # -> Item2, Item1, Item, Item1_2, Item2_2
trim_tree = TrimTree(Tree=list_item.Item2, Depth=1)
trim_tree_2 = TrimTree(Tree=list_item.Item2_2, Depth=1)
trim_tree_3 = TrimTree(Tree=list_item.Item1_2, Depth=1)
trim_tree_4 = TrimTree(Tree=list_item_2.Item2, Depth=1)
trim_tree_5 = TrimTree(Tree=list_item_2.Item2_2, Depth=1)
trim_tree_6 = TrimTree(Tree=list_item_2.Item1_2, Depth=1)
list_item_3 = ListItem(List=trim_tree, Index=0, Wrap=True)
list_item_4 = ListItem(List=trim_tree, Index=1, Wrap=True)
list_item_5 = ListItem(List=trim_tree_2, Index=0, Wrap=True)
list_item_6 = ListItem(List=trim_tree_2, Index=1, Wrap=True)
list_item_7 = ListItem(List=trim_tree_3, Index=0, Wrap=True)
list_item_8 = ListItem(List=trim_tree_3, Index=1, Wrap=True)
list_item_9 = ListItem(List=trim_tree_4, Index=0, Wrap=True)
list_item_10 = ListItem(List=trim_tree_4, Index=1, Wrap=True)
list_item_11 = ListItem(List=trim_tree_5, Index=0, Wrap=True)
list_item_12 = ListItem(List=trim_tree_5, Index=1, Wrap=True)
list_item_13 = ListItem(List=trim_tree_6, Index=0, Wrap=True)
list_item_14 = ListItem(List=trim_tree_6, Index=1, Wrap=True)
line = Line(StartPoint=list_item_3, EndPoint=list_item_4)
line_2 = Line(StartPoint=list_item_5, EndPoint=list_item_6)
line_3 = Line(StartPoint=list_item_7, EndPoint=list_item_8)
line_4 = Line(StartPoint=list_item_9, EndPoint=list_item_10)
line_5 = Line(StartPoint=list_item_11, EndPoint=list_item_12)
line_6 = Line(StartPoint=list_item_13, EndPoint=list_item_14)
flip_curve = FlipCurve(Curve=line, Guide=clean_tree.SynchronousTree1)  # -> Curve, Flag
flip_curve_2 = FlipCurve(Curve=line_2, Guide=clean_tree.SynchronousTree1)  # -> Curve, Flag
flip_curve_3 = FlipCurve(Curve=line_3, Guide=clean_tree.SynchronousTree1)  # -> Curve, Flag
flip_curve_4 = FlipCurve(Curve=line_4, Guide=clean_tree.SynchronousTree1)  # -> Curve, Flag
flip_curve_5 = FlipCurve(Curve=line_5, Guide=clean_tree.SynchronousTree1)  # -> Curve, Flag
flip_curve_6 = FlipCurve(Curve=line_6, Guide=clean_tree.SynchronousTree1)  # -> Curve, Flag
divide_curve_3 = DivideCurve(Curve=flip_curve.Curve, Count=2, Kinks=False)  # -> simplify(Points), Tangents, Parameters
divide_curve_4 = DivideCurve(Curve=flip_curve_2.Curve, Count=expr("x+2", 2), Kinks=False)  # -> simplify(Points), Tangents, Parameters
divide_curve_5 = DivideCurve(Curve=flip_curve_3.Curve, Count=expr("x+4", 2), Kinks=False)  # -> simplify(Points), Tangents, Parameters
divide_curve_6 = DivideCurve(Curve=clean_tree.SynchronousTree1, Count=expr("x+6", 2), Kinks=False)  # -> simplify(Points), Tangents, Parameters
divide_curve_7 = DivideCurve(Curve=flip_curve_4.Curve, Count=2, Kinks=False)  # -> simplify(Points), Tangents, Parameters
divide_curve_8 = DivideCurve(Curve=flip_curve_5.Curve, Count=expr("x+2", 2), Kinks=False)  # -> simplify(Points), Tangents, Parameters
divide_curve_9 = DivideCurve(Curve=flip_curve_6.Curve, Count=expr("x+4", 2), Kinks=False)  # -> simplify(Points), Tangents, Parameters
divide_curve_10 = DivideCurve(Curve=clean_tree.SynchronousTree1, Count=expr("x+6", 2), Kinks=False)  # -> simplify(Points), Tangents, Parameters
list_item_15 = ListItem(List=divide_curve_4.Points, Index=0, Wrap=True)  # -> Item, Item1
list_item_16 = ListItem(List=divide_curve_4.Points, Index=-1, Wrap=True)  # -> Item1, Item
list_item_17 = ListItem(List=divide_curve_5.Points, Index=0, Wrap=True)  # -> Item, Item1
list_item_18 = ListItem(List=divide_curve_5.Points, Index=-1, Wrap=True)  # -> Item1, Item
list_item_19 = ListItem(List=divide_curve_6.Points, Index=0, Wrap=True)  # -> Item, Item1
list_item_20 = ListItem(List=divide_curve_6.Points, Index=-1, Wrap=True)  # -> Item1, Item
list_item_21 = ListItem(List=divide_curve_4.Points, Index=2, Wrap=True)
list_item_22 = ListItem(List=divide_curve_5.Points, Index=3, Wrap=True)  # -> Item1, Item, Item1_2
list_item_23 = ListItem(List=divide_curve_6.Points, Index=3, Wrap=True)  # -> Item, Item1, Item2
list_item_24 = ListItem(List=divide_curve_6.Points, Index=3, Wrap=True)  # -> Item1, Item, Item1_2, Item2, Item3
list_item_25 = ListItem(List=divide_curve_8.Points, Index=0, Wrap=True)  # -> Item, Item1
list_item_26 = ListItem(List=divide_curve_8.Points, Index=-1, Wrap=True)  # -> Item1, Item
list_item_27 = ListItem(List=divide_curve_9.Points, Index=0, Wrap=True)  # -> Item, Item1
list_item_28 = ListItem(List=divide_curve_9.Points, Index=-1, Wrap=True)  # -> Item1, Item
list_item_29 = ListItem(List=divide_curve_8.Points, Index=2, Wrap=True)
list_item_30 = ListItem(List=divide_curve_9.Points, Index=3, Wrap=True)  # -> Item1, Item, Item1_2
list_item_31 = ListItem(List=divide_curve_10.Points, Index=3, Wrap=True)  # -> Item, Item1, Item2
list_item_32 = ListItem(List=divide_curve_3.Points, Index=[0, -1], Wrap=True)
list_item_33 = ListItem(List=divide_curve_4.Points, Index=[1, -2], Wrap=True)
list_item_34 = ListItem(List=divide_curve_4.Points, Index=[0, -1], Wrap=True)
list_item_35 = ListItem(List=divide_curve_5.Points, Index=[1, -2], Wrap=True)
list_item_36 = ListItem(List=divide_curve_5.Points, Index=[0, -1], Wrap=True)
list_item_37 = ListItem(List=divide_curve_6.Points, Index=[1, -2], Wrap=True)
list_item_38 = ListItem(List=divide_curve_7.Points, Index=[0, -1], Wrap=True)
list_item_39 = ListItem(List=divide_curve_8.Points, Index=[1, -2], Wrap=True)
list_item_40 = ListItem(List=divide_curve_8.Points, Index=[0, -1], Wrap=True)
list_item_41 = ListItem(List=divide_curve_9.Points, Index=[1, -2], Wrap=True)
list_item_42 = ListItem(List=divide_curve_9.Points, Index=[0, -1], Wrap=True)
list_item_43 = ListItem(List=divide_curve_10.Points, Index=[1, -2], Wrap=True)
ghpython_script = GhPythonScript(x=clean_tree.Tree, z=clean_tree.SynchronousTree4, u=clean_tree.SynchronousTree5, y="intra_comp")  # -> simplify(a), b; inputs x: list, z: list of Point3d, u: list of Vector3d; same code as ghpython_script
clean_tree_2 = CleanTree(RemoveNulls=True, RemoveInvalid=True, RemoveEmpty=True, Tree=ghpython_script.a, SynchronousTree1=ghpython_script.b)  # -> Tree, SynchronousTree1
line_7 = Line(StartPoint=list_item_32, EndPoint=list_item_33)
line_8 = Line(StartPoint=list_item_34, EndPoint=list_item_35)
line_9 = Line(StartPoint=list_item_36, EndPoint=list_item_37)
line_10 = Line(StartPoint=list_item_15.Item, EndPoint=list_item_15.Item1)
line_11 = Line(StartPoint=list_item_16.Item1, EndPoint=list_item_16.Item)
line_12 = Line(StartPoint=list_item_17.Item, EndPoint=list_item_17.Item1)
line_13 = Line(StartPoint=list_item_18.Item1, EndPoint=list_item_18.Item)
line_14 = Line(StartPoint=list_item_19.Item, EndPoint=list_item_19.Item1)
line_15 = Line(StartPoint=list_item_20.Item1, EndPoint=list_item_20.Item)
line_16 = Line(StartPoint=list_item_21, EndPoint=list_item_22.Item)
line_17 = Line(StartPoint=list_item_22.Item1, EndPoint=list_item_23.Item)
line_18 = Line(StartPoint=list_item_22.Item1_2, EndPoint=list_item_23.Item2)
line_19 = Line(StartPoint=list_item_24.Item1, EndPoint=list_item_24.Item1_2)
line_20 = Line(StartPoint=list_item_24.Item1_2, EndPoint=list_item_24.Item3)
line_21 = Line(StartPoint=list_item_38, EndPoint=list_item_39)
line_22 = Line(StartPoint=list_item_40, EndPoint=list_item_41)
line_23 = Line(StartPoint=list_item_42, EndPoint=list_item_43)
line_24 = Line(StartPoint=list_item_25.Item, EndPoint=list_item_25.Item1)
line_25 = Line(StartPoint=list_item_26.Item1, EndPoint=list_item_26.Item)
line_26 = Line(StartPoint=list_item_27.Item, EndPoint=list_item_27.Item1)
line_27 = Line(StartPoint=list_item_28.Item1, EndPoint=list_item_28.Item)
line_28 = Line(StartPoint=list_item_29, EndPoint=list_item_30.Item)
line_29 = Line(StartPoint=list_item_30.Item1, EndPoint=list_item_31.Item)
line_30 = Line(StartPoint=list_item_30.Item1_2, EndPoint=list_item_31.Item2)
geometry_9 = Geometry(line)
geometry_10 = Geometry(line_4)
merge = Merge(Data1=geometry_9, Data2=geometry_10)
curve_middle = CurveMiddle(Curve=merge)
curve_middle_2 = CurveMiddle(Curve=line_19)
curve_middle_3 = CurveMiddle(Curve=line_20)
closest_points = ClosestPoints(Point=clean_tree_2.Tree, Cloud=curve_middle, Count=1)  # -> ClosestPoint, CPIndex, Distance
scale = Scale(Geometry=line_19, Center=curve_middle_2, Factor=0.5)  # -> Geometry, Transform
scale_2 = Scale(Geometry=line_20, Center=curve_middle_3, Factor=0.5)  # -> Geometry, Transform
list_item_44 = ListItem(List=merge, Index=closest_points.CPIndex, Wrap=True)
merge_2 = Merge(
    Data1=line_7,
    Data2=line_8,
    Data3=line_9,
    Data4=line_10,
    Data5=line_11,
    Data6=line_12,
    Data7=line_13,
    Data8=line_16,
    Data9=line_17,
    Data10=line_18)
merge_3 = Merge(
    Data1=line_7,
    Data2=line_8,
    Data3=line_10,
    Data4=line_11,
    Data5=line_12,
    Data6=line_13,
    Data7=line_16,
    Data8=line_17,
    Data9=line_18)
merge_4 = Merge(Data1=line_14, Data2=line_15, Data3=scale.Geometry, Data4=scale_2.Geometry)
merge_5 = Merge(
    Data1=line_21,
    Data2=line_22,
    Data3=line_23,
    Data4=line_24,
    Data5=line_25,
    Data6=line_26,
    Data7=line_27,
    Data8=line_28,
    Data9=line_29,
    Data10=line_30)
merge_6 = Merge(
    Data1=line_21,
    Data2=line_22,
    Data3=line_24,
    Data4=line_25,
    Data5=line_26,
    Data6=line_27,
    Data7=line_28,
    Data8=line_29,
    Data9=line_30)
merge_7 = Merge(Data1=merge_2, Data2=merge_5)
merge_8 = Merge(Data1=merge_2, Data2=merge_5, Data3=geometry_9, Data4=geometry_10)
merge_9 = Merge(Data1=merge_2, Data2=merge_5, Data3=list_item_44)
merge_10 = Merge(Data1=merge_3, Data2=merge_6)
merge_11 = Merge(Data1=geometry_9, Data2=geometry_10, Data3=merge_3, Data4=merge_6)
_1_wall = ClusterOutput(merge_4)
_1_wall_thin = ClusterOutput(merge_7)
_2_wall = ClusterOutput(merge_4)
_2_wall_thin = ClusterOutput(merge_8)
_3_wall = ClusterOutput(merge_4)
_3_wall_thin = ClusterOutput(merge_9)
_4_wall_thin = ClusterOutput(merge_10)
_5_wall_thin = ClusterOutput(merge_11)

# ==== cluster Cluster_25
panel = ClusterInput()
radius = ClusterInput()
radius_2 = ClusterInput()
tree = ClusterInput()
geometry = ClusterInput()
geometry_2 = ClusterInput()
geometry_3 = ClusterInput()
geometry_4 = ClusterInput()
vector = ClusterInput()
unit_vector = UnitVector(Vector=vector)  # -> simplify(Vector)
geometry_5 = Geometry(geometry)
geometry_6 = Geometry(geometry_2)
geometry_7 = Geometry(geometry_3)
geometry_8 = Geometry(geometry_4)
clean_tree = CleanTree(
    RemoveNulls=True,
    RemoveInvalid=True,
    RemoveEmpty=True,
    Tree=tree,
    SynchronousTree1=geometry_5,
    SynchronousTree2=geometry_6,
    SynchronousTree3=geometry_7,
    SynchronousTree4=geometry_8,
    SynchronousTree5=unit_vector)  # -> simplify(Tree), SynchronousTree1, SynchronousTree2, SynchronousTree3, simplify(SynchronousTree4), simplify(SynchronousTree5)
join_curves = JoinCurves(Curves=clean_tree.SynchronousTree2, Preserve=False)  # -> simplify(Curves)
join_curves_2 = JoinCurves(Curves=clean_tree.SynchronousTree3, Preserve=False)  # -> simplify(Curves)
end_points = EndPoints(Curve=clean_tree.SynchronousTree1)  # -> Start, End
curve_middle = CurveMiddle(Curve=clean_tree.SynchronousTree1)
length = Length(Curve=clean_tree.SynchronousTree1)
circle = Circle(Plane=curve_middle, Radius=expr("x/2", radius_2))
circle_2 = Circle(Plane=curve_middle, Radius=expr("0.25*x", length))
flip_curve = FlipCurve(Curve=join_curves, Guide=clean_tree.SynchronousTree1)  # -> Curve, Flag
flip_curve_2 = FlipCurve(Curve=join_curves_2, Guide=clean_tree.SynchronousTree1)  # -> Curve, Flag
trim_with_region = TrimWithRegion(Curve=clean_tree.SynchronousTree1, Region=circle)  # -> simplify(Inside), simplify(Outside)
trim_with_region_2 = TrimWithRegion(Curve=clean_tree.SynchronousTree1, Region=circle_2)  # -> simplify(Inside), simplify(Outside)
ghpython_script = GhPythonScript(x=clean_tree.Tree, z=clean_tree.SynchronousTree4, u=clean_tree.SynchronousTree5, y="intra_comp")  # -> simplify(a), b; inputs x: list, z: list of Point3d, u: list of Vector3d; same code as ghpython_script
explode = Explode(Curve=flip_curve.Curve, Recursive=True)  # -> Segments, Vertices
explode_2 = Explode(Curve=flip_curve_2.Curve, Recursive=True)  # -> Segments, Vertices
clean_tree_2 = CleanTree(RemoveNulls=True, RemoveInvalid=True, RemoveEmpty=True, Tree=ghpython_script.a, SynchronousTree1=ghpython_script.b)  # -> Tree, SynchronousTree1
end_points_2 = EndPoints(Curve=trim_with_region.Inside)  # -> Start, End
end_points_3 = EndPoints(Curve=trim_with_region_2.Inside)  # -> Start, End
divide_curve = DivideCurve(Curve=explode.Segments, Count=4, Kinks=False)  # -> Points, Tangents, Parameters
divide_curve_2 = DivideCurve(Curve=explode_2.Segments, Count=4, Kinks=False)  # -> Points, Tangents, Parameters
list_item = ListItem(List=simplify(divide_curve.Points), Index=0, Wrap=True)  # -> Item, Item1, Item2, Item3, Item4
list_item_2 = ListItem(List=simplify(divide_curve_2.Points), Index=0, Wrap=True)  # -> Item, Item1, Item2, Item3, Item4
trim_tree = TrimTree(Tree=simplify(divide_curve.Points), Depth=1)
trim_tree_2 = TrimTree(Tree=simplify(divide_curve_2.Points), Depth=1)
trim_tree_3 = TrimTree(Tree=list_item.Item2, Depth=1)
polyline = PolyLine(Vertices=trim_tree_3, Closed=False)
trim_tree_4 = TrimTree(Tree=list_item_2.Item2, Depth=1)
polyline_2 = PolyLine(Vertices=trim_tree_4, Closed=False)
merge = Merge(Data1=polyline, Data2=polyline_2)  # -> simplify(Result)
curve_middle_2 = CurveMiddle(Curve=merge)
closest_points = ClosestPoints(Point=clean_tree_2.Tree, Cloud=curve_middle_2, Count=1)  # -> ClosestPoint, CPIndex, Distance
cull_index = CullIndex(List=merge, Indices=closest_points.CPIndex, Wrap=True)  # -> simplify(List)
list_item_3 = ListItem(List=merge, Index=closest_points.CPIndex, Wrap=True)  # -> simplify(Item)
curve_middle_3 = CurveMiddle(Curve=list_item_3)
list_item_4 = ListItem(List=trim_tree_3, Index=0, Wrap=True)  # -> Item, Item1
list_item_5 = ListItem(List=trim_tree_4, Index=0, Wrap=True)  # -> Item, Item1
list_item_6 = ListItem(List=trim_tree, Index=0, Wrap=True)  # -> Item, Item1, Item2, Item3, Item4, Item5, Item6, Item7, Item8
list_item_7 = ListItem(List=trim_tree_2, Index=0, Wrap=True)  # -> Item, Item1, Item2, Item3, Item4, Item5, Item6, Item7, Item8
circle_3 = Circle(Plane=curve_middle_3, Radius=expr("x/2", radius_2))
trim_with_region_3 = TrimWithRegion(Curve=list_item_3, Region=circle_3)  # -> simplify(Inside), simplify(Outside)
merge_2 = Merge(
    Data1=simplify(list_item_4.Item),
    Data2=simplify(end_points.Start),
    Data3=simplify(list_item_5.Item),
    Data4=simplify(end_points_2.Start))
merge_3 = Merge(
    Data1=simplify(list_item_4.Item1),
    Data2=simplify(end_points.End),
    Data3=simplify(list_item_5.Item1),
    Data4=simplify(end_points_2.End))
merge_4 = Merge(
    Data1=simplify(list_item_6.Item1),
    Data2=simplify(end_points.Start),
    Data3=simplify(list_item_7.Item1),
    Data4=simplify(end_points_3.Start))
merge_5 = Merge(
    Data1=simplify(list_item_6.Item8),
    Data2=simplify(end_points.End),
    Data3=simplify(list_item_7.Item8),
    Data4=simplify(end_points_3.End))
polyline_3 = PolyLine(Vertices=merge_2, Closed=True)
polyline_4 = PolyLine(Vertices=merge_3, Closed=True)
polyline_5 = PolyLine(Vertices=merge_4, Closed=True)
polyline_6 = PolyLine(Vertices=merge_5, Closed=True)
flip_curve_3 = FlipCurve(
    Curve=simplify([cull_index, list_item_3, trim_with_region_3.Inside, clean_tree.SynchronousTree1]),
    Guide=clean_tree.SynchronousTree1)  # -> Curve, Flag
explode_3 = Explode(Curve=polyline_3, Recursive=True)  # -> simplify(Segments), Vertices
explode_4 = Explode(Curve=polyline_4, Recursive=True)  # -> simplify(Segments), Vertices
explode_5 = Explode(Curve=polyline_5, Recursive=True)  # -> simplify(Segments), Vertices
explode_6 = Explode(Curve=polyline_6, Recursive=True)  # -> simplify(Segments), Vertices
end_points_4 = EndPoints(Curve=flip_curve_3.Curve)  # -> Start, End
convex_hull = ConvexHull(Points=end_points_4.Start, Plane=PlaneXY(0, 0, 0))  # -> Hull, HullZ, Indices
convex_hull_2 = ConvexHull(Points=end_points_4.End, Plane=PlaneXY(0, 0, 0))  # -> Hull, HullZ, Indices
list_item_8 = ListItem(List=explode_3.Segments, Index=0, Wrap=True)  # -> Item, Item1, Item2, Item3
list_item_9 = ListItem(List=explode_4.Segments, Index=0, Wrap=True)  # -> Item, Item1, Item2, Item3
list_item_10 = ListItem(List=explode_5.Segments, Index=0, Wrap=True)  # -> Item, Item1, Item2, Item3
list_item_11 = ListItem(List=explode_6.Segments, Index=0, Wrap=True)  # -> Item, Item1, Item2, Item3
merge_6 = Merge(Data1=convex_hull.Hull, Data2=convex_hull_2.Hull)
explode_7 = Explode(Curve=merge_6, Recursive=True)  # -> Segments, Vertices
merge_7 = Merge(
    Data1=list_item_8.Item,
    Data2=list_item_8.Item1,
    Data3=list_item_8.Item2,
    Data4=list_item_8.Item3,
    Data5=list_item_9.Item,
    Data6=list_item_9.Item1,
    Data7=list_item_9.Item2,
    Data8=list_item_9.Item3)
merge_8 = Merge(
    Data1=list_item_8.Item,
    Data2=list_item_8.Item1,
    Data3=list_item_8.Item2,
    Data4=list_item_8.Item3,
    Data5=list_item_9.Item,
    Data6=list_item_9.Item1,
    Data7=list_item_9.Item2,
    Data8=list_item_9.Item3)
merge_9 = Merge(
    Data1=list_item_10.Item,
    Data2=list_item_10.Item1,
    Data3=list_item_10.Item2,
    Data4=list_item_10.Item3,
    Data5=list_item_11.Item,
    Data6=list_item_11.Item1,
    Data7=list_item_11.Item2,
    Data8=list_item_11.Item3)
merge_10 = Merge(
    Data1=list_item_10.Item,
    Data2=list_item_10.Item1,
    Data3=list_item_10.Item2,
    Data4=list_item_10.Item3,
    Data5=list_item_11.Item,
    Data6=list_item_11.Item1,
    Data7=list_item_11.Item2,
    Data8=list_item_11.Item3)
_1_wall = ClusterOutput(merge_7)
_2_wall = ClusterOutput(merge_8)
_2_wall_thin = ClusterOutput(trim_with_region.Inside)
_3_wall = ClusterOutput(explode_7.Segments)
_4_wall = ClusterOutput(merge_9)
_5_wall = ClusterOutput(merge_10)
_5_wall_thin = ClusterOutput(trim_with_region_2.Inside)

# ==== cluster Cluster_26
panel = ClusterInput()
radius = ClusterInput()
y = ClusterInput()
tree = ClusterInput()
geometry = ClusterInput()
geometry_2 = ClusterInput()
geometry_3 = ClusterInput()
geometry_4 = ClusterInput()
vector = ClusterInput()
unit_vector = UnitVector(Vector=vector)  # -> simplify(Vector)
geometry_5 = Geometry(geometry)
geometry_6 = Geometry(geometry_2)
geometry_7 = Geometry(geometry_3)
geometry_8 = Geometry(geometry_4)
clean_tree = CleanTree(
    RemoveNulls=True,
    RemoveInvalid=True,
    RemoveEmpty=True,
    Tree=tree,
    SynchronousTree1=geometry_5,
    SynchronousTree2=geometry_6,
    SynchronousTree3=geometry_7,
    SynchronousTree4=geometry_8,
    SynchronousTree5=unit_vector)  # -> simplify(Tree), SynchronousTree1, SynchronousTree2, SynchronousTree3, simplify(SynchronousTree4), simplify(SynchronousTree5)
join_curves = JoinCurves(Curves=clean_tree.SynchronousTree2, Preserve=False)  # -> simplify(Curves)
join_curves_2 = JoinCurves(Curves=clean_tree.SynchronousTree3, Preserve=False)  # -> simplify(Curves)
end_points = EndPoints(Curve=clean_tree.SynchronousTree1)  # -> Start, End
ghpython_script = GhPythonScript(x=clean_tree.Tree, z=clean_tree.SynchronousTree4, u=clean_tree.SynchronousTree5, y="intra_comp")  # -> simplify(a), b; inputs x: list, z: list of Point3d, u: list of Vector3d; same code as ghpython_script
clean_tree_2 = CleanTree(RemoveNulls=True, RemoveInvalid=True, RemoveEmpty=True, Tree=ghpython_script.a, SynchronousTree1=ghpython_script.b)  # -> Tree, SynchronousTree1
flip_curve = FlipCurve(Curve=join_curves, Guide=clean_tree.SynchronousTree1)  # -> Curve, Flag
flip_curve_2 = FlipCurve(Curve=join_curves_2, Guide=clean_tree.SynchronousTree1)  # -> Curve, Flag
explode = Explode(Curve=flip_curve.Curve, Recursive=True)  # -> Segments, Vertices
explode_2 = Explode(Curve=flip_curve_2.Curve, Recursive=True)  # -> Segments, Vertices
divide_curve = DivideCurve(Curve=explode.Segments, Count=4, Kinks=False)  # -> Points, Tangents, Parameters
divide_curve_2 = DivideCurve(Curve=explode_2.Segments, Count=4, Kinks=False)  # -> Points, Tangents, Parameters
list_item = ListItem(List=simplify(divide_curve.Points), Index=0, Wrap=True)  # -> Item, Item1, Item2, Item3, Item4
list_item_2 = ListItem(List=simplify(divide_curve_2.Points), Index=0, Wrap=True)  # -> Item, Item1, Item2, Item3, Item4
trim_tree = TrimTree(Tree=list_item.Item2, Depth=1)
average = Average(Input=trim_tree)
scale = Scale(Geometry=trim_tree, Center=average, Factor=0.7)  # -> Geometry, Transform
trim_tree_2 = TrimTree(Tree=list_item_2.Item2, Depth=1)
average_2 = Average(Input=trim_tree_2)
scale_2 = Scale(Geometry=trim_tree_2, Center=average_2, Factor=0.7)  # -> Geometry, Transform
list_item_3 = ListItem(List=scale.Geometry, Index=0, Wrap=True)  # -> Item, Item1
list_item_4 = ListItem(List=scale_2.Geometry, Index=0, Wrap=True)  # -> Item, Item1
list_item_5 = ListItem(List=trim_tree, Index=0, Wrap=True)  # -> Item, Item1
list_item_6 = ListItem(List=trim_tree_2, Index=0, Wrap=True)  # -> Item, Item1
merge = Merge(
    Data1=simplify(list_item_3.Item),
    Data2=list_item_5.Item,
    Data3=simplify(end_points.Start),
    Data4=list_item_6.Item,
    Data5=simplify(list_item_4.Item))
merge_2 = Merge(
    Data1=simplify(list_item_3.Item1),
    Data2=list_item_5.Item1,
    Data3=simplify(end_points.End),
    Data4=list_item_6.Item1,
    Data5=simplify(list_item_4.Item1))
merge_3 = Merge(Data1=simplify(list_item_5.Item), Data2=simplify(end_points.Start), Data3=simplify(list_item_6.Item))
merge_4 = Merge(Data1=simplify(list_item_5.Item1), Data2=simplify(end_points.End), Data3=simplify(list_item_6.Item1))
polyline = PolyLine(Vertices=merge, Closed=True)
polyline_2 = PolyLine(Vertices=merge_2, Closed=True)
polyline_3 = PolyLine(Vertices=merge_3, Closed=True)
polyline_4 = PolyLine(Vertices=merge_4, Closed=True)
explode_3 = Explode(Curve=polyline, Recursive=True)  # -> simplify(Segments), Vertices
explode_4 = Explode(Curve=polyline_2, Recursive=True)  # -> simplify(Segments), Vertices
explode_5 = Explode(Curve=polyline_3, Recursive=True)  # -> simplify(Segments), Vertices
explode_6 = Explode(Curve=polyline_4, Recursive=True)  # -> simplify(Segments), Vertices
list_item_7 = ListItem(List=explode_3.Segments, Index=-1, Wrap=True)
list_item_8 = ListItem(List=explode_4.Segments, Index=-1, Wrap=True)
list_item_9 = ListItem(List=explode_5.Segments, Index=-1, Wrap=True)
list_item_10 = ListItem(List=explode_6.Segments, Index=-1, Wrap=True)
length = Length(Curve=list_item_7)
length_2 = Length(Curve=list_item_8)
length_3 = Length(Curve=list_item_9)
length_4 = Length(Curve=list_item_10)
average_3 = Average(Input=[length, length_2])
average_4 = Average(Input=[length_3, length_4])
ghpython_script_2 = GhPythonScript(x=average_3, y=y)  # -> a
# ---------- ghpython_script_2: Python ----------
__author__ = "altai"
__version__ = "2021.08.21"

import rhinoscriptsyntax as rs
a = x//(1.2*y)
# ---------- end ghpython_script_2 ----------
ghpython_script_3 = GhPythonScript(x=average_4, y=y)  # -> a; same code as ghpython_script_2
divide_curve_3 = DivideCurve(Curve=list_item_7, Count=ghpython_script_2, Kinks=False)  # -> simplify(Points), Tangents, Parameters
divide_curve_4 = DivideCurve(Curve=list_item_8, Count=ghpython_script_2, Kinks=False)  # -> simplify(Points), Tangents, Parameters
divide_curve_5 = DivideCurve(Curve=list_item_9, Count=ghpython_script_3, Kinks=False)  # -> simplify(Points), Tangents, Parameters
divide_curve_6 = DivideCurve(Curve=list_item_10, Count=ghpython_script_3, Kinks=False)  # -> simplify(Points), Tangents, Parameters
line = Line(StartPoint=divide_curve_3.Points, EndPoint=divide_curve_4.Points)
cull_index = CullIndex(List=line, Indices=[0, -1], Wrap=True)
list_item_11 = ListItem(List=line, Index=[0, -1], Wrap=True)
curve_middle = CurveMiddle(Curve=list_item_11)
closest_points = ClosestPoints(Point=clean_tree_2.Tree, Cloud=curve_middle, Count=1)  # -> ClosestPoint, CPIndex, Distance
cull_index_2 = CullIndex(List=list_item_11, Indices=closest_points.CPIndex, Wrap=True)
list_item_12 = ListItem(List=list_item_11, Index=closest_points.CPIndex, Wrap=True)
curve_middle_2 = CurveMiddle(Curve=cull_index_2)
length_5 = Length(Curve=cull_index_2)
circle = Circle(Plane=curve_middle_2, Radius=expr("x/6", length_5))
trim_with_region = TrimWithRegion(Curve=cull_index_2, Region=circle)  # -> Inside, Outside
line_2 = Line(StartPoint=divide_curve_5.Points, EndPoint=divide_curve_6.Points)
cull_index_3 = CullIndex(List=line_2, Indices=[0, -1], Wrap=True)
list_item_13 = ListItem(List=line_2, Index=[0, -1], Wrap=True)
length_6 = Length(Curve=line)
curve_middle_3 = CurveMiddle(Curve=cull_index)
length_7 = Length(Curve=cull_index)
curve_middle_4 = CurveMiddle(Curve=line)
curve_middle_5 = CurveMiddle(Curve=line_2)
length_8 = Length(Curve=line_2)
curve_middle_6 = CurveMiddle(Curve=cull_index_3)
length_9 = Length(Curve=cull_index_3)
circle_2 = Circle(Plane=curve_middle_4, Radius=expr("x/6", length_6))
circle_3 = Circle(Plane=curve_middle_3, Radius=expr("x/6", length_7))
circle_4 = Circle(Plane=curve_middle_5, Radius=expr("x/6", length_8))
circle_5 = Circle(Plane=curve_middle_6, Radius=expr("x/6", length_9))
trim_with_region_2 = TrimWithRegion(Curve=line, Region=circle_2)  # -> Inside, Outside
trim_with_region_3 = TrimWithRegion(Curve=cull_index, Region=circle_3)  # -> Inside, Outside
trim_with_region_4 = TrimWithRegion(Curve=line_2, Region=circle_4)  # -> Inside, Outside
trim_with_region_5 = TrimWithRegion(Curve=cull_index_3, Region=circle_5)  # -> Inside, Outside
merge_5 = Merge(Data1=trim_with_region_5.Outside, Data2=list_item_13)
merge_6 = Merge(Data1=explode_3.Segments, Data2=explode_4.Segments)
geometry_9 = Geometry(trim_with_region_2.Outside)
merge_7 = Merge(Data1=trim_with_region_3.Outside, Data2=list_item_11)
merge_8 = Merge(Data1=trim_with_region_3.Outside, Data2=list_item_12, Data3=trim_with_region.Outside)
merge_9 = Merge(Data1=explode_5.Segments, Data2=explode_6.Segments)
geometry_10 = Geometry(trim_with_region_4.Outside)
_1_wall = ClusterOutput(merge_6)
_1_wall_thin = ClusterOutput(geometry_9)
_2_wall = ClusterOutput(merge_6)
_2_wall_thin = ClusterOutput(merge_7)
_3_wall = ClusterOutput(merge_6)
_3_wall_thin = ClusterOutput(merge_8)
_4_wall = ClusterOutput(merge_9)
_4_wall_thin = ClusterOutput(geometry_10)
_5_wall = ClusterOutput(merge_9)
_5_wall_thin = ClusterOutput(merge_5)

# ==== cluster EmptyPatches
x = ClusterInput()
geometry = ClusterInput()
pattern = ClusterInput()
geometry_2 = Geometry(geometry)
difference = GhPythonScript(x=flatten(x), y=flatten(geometry_2))  # -> flatten(a); inputs x: list of Curve, y: list of Curve
# ---------- difference: Python ----------
__author__ = "altai"
__version__ = "2021.07.31"

import rhinoscriptsyntax as rs
import Rhino

for m in x:
    for i in range(0,len(y)):
        if Rhino.Geometry.GeometryBase.GeometryEquals(m,y[i]):
            del y[i]
            break
a = y
# ---------- end difference ----------
preview = DashPattern(Curve=difference, Pattern=pattern)  # -> Dashes, Gaps
dashes = ClusterOutput(preview.Dashes)
a = ClusterOutput(difference)

# ==== cluster Patches
curve = ClusterInput()
pattern = ClusterInput()
preview = DashPattern(Curve=curve, Pattern=pattern)  # -> Dashes, Gaps
dashes = ClusterOutput(preview.Dashes)

# ==== cluster Cluster_4
A = ClusterInput()
A_2 = ClusterInput()
geometry = ClusterInput()
curve_middle = CurveMiddle(Curve=geometry)
length = Length(Curve=geometry)
multiplication = Multiplication(A=A, B=2)
subtraction = Subtraction(A=length, B=multiplication)
multiplication_2 = Multiplication(A=A_2, B=2)
subtraction_2 = Subtraction(A=subtraction, B=multiplication_2)
division = Division(A=subtraction_2, B=length)
scale = Scale(Geometry=geometry, Center=curve_middle, Factor=division)  # -> Geometry, Transform
length_2 = Length(Curve=scale.Geometry)
division_2 = Division(A=length_2, B=2)
clean_tree = CleanTree(RemoveNulls=True, RemoveInvalid=True, RemoveEmpty=True, Tree=scale.Geometry, SynchronousTree1=division_2)  # -> Tree, SynchronousTree1
tree = ClusterOutput(clean_tree.Tree)
s1 = ClusterOutput(clean_tree.SynchronousTree1)

# ==== cluster Cluster_5
tree = ClusterInput()
vector = ClusterInput()
A = ClusterInput()
unit_vector = UnitVector(Vector=vector)
clean_tree = CleanTree(RemoveNulls=True, RemoveInvalid=True, RemoveEmpty=True, Tree=tree)  # -> simplify(Tree)
multiplication = Multiplication(A=A, B=unit_vector)
move = Move(Geometry=simplify(clean_tree), Motion=multiplication)  # -> Geometry, Transform
curve_middle = CurveMiddle(Curve=graft(clean_tree))
end_points = EndPoints(Curve=graft(clean_tree))  # -> Start, End
end_points_2 = EndPoints(Curve=graft(move.Geometry))  # -> Start, End
merge = Merge(Data1=end_points.Start, Data2=end_points.End)
merge_2 = Merge(Data1=end_points_2.Start, Data2=end_points_2.End)
circle = Circle(Plane=merge, Radius=graft(A))  # -> graft(Circle)
line = Line(StartPoint=merge, EndPoint=merge_2)
line_2 = Line(StartPoint=merge_2, EndPoint=curve_middle)
line_3 = ClusterOutput(line)
curve_middle_2 = CurveMiddle(Curve=line_2)
length = Length(Curve=line_2)
circle_2 = Circle(Plane=curve_middle_2, Radius=expr("x/2", length))
trim_with_region = TrimWithRegion(Curve=circle, Region=graft(circle_2))  # -> Inside, Outside
inside = ClusterOutput(trim_with_region.Inside)

# ==== cluster Opening_large
cluster_input = ClusterInput()
cluster_input_2 = ClusterInput()
geometry = ClusterInput()
A = ClusterInput()
geometry_2 = Geometry(geometry)
curve_middle = CurveMiddle(Curve=geometry_2)
length = Length(Curve=geometry_2)
division = Division(A=length, B=2)
multiplication = Multiplication(A=A, B=division)
circle = Circle(Plane=curve_middle, Radius=multiplication)  # -> simplify(Circle)
trim_with_regions = TrimWithRegions(Curve=geometry_2, Regions=circle)  # -> simplify(Inside), simplify(Outside)
cluster = Cluster_4(A=cluster_input, A_2=cluster_input_2, geometry=trim_with_regions.Inside)  # -> tree, s1
clean_tree = CleanTree(RemoveNulls=True, RemoveInvalid=True, RemoveEmpty=True, Tree=cluster.tree)  # -> simplify(Tree)
tree = ClusterOutput(clean_tree)
outside = ClusterOutput(trim_with_regions.Outside)

# ==== cluster Opening_large_2
cluster_input = ClusterInput()
cluster_input_2 = ClusterInput()
geometry = ClusterInput()
A = ClusterInput()
geometry_2 = Geometry(geometry)
curve_middle = CurveMiddle(Curve=geometry_2)
length = Length(Curve=geometry_2)
division = Division(A=length, B=2)
multiplication = Multiplication(A=A, B=division)
circle = Circle(Plane=curve_middle, Radius=multiplication)  # -> simplify(Circle)
trim_with_regions = TrimWithRegions(Curve=graft(geometry_2), Regions=graft(circle))  # -> simplify(Inside), simplify(Outside)
cluster = Cluster_4(A=cluster_input, A_2=cluster_input_2, geometry=trim_with_regions.Inside)  # -> tree, s1
clean_tree = CleanTree(RemoveNulls=True, RemoveInvalid=True, RemoveEmpty=True, Tree=cluster.tree)  # -> simplify(Tree)
tree = ClusterOutput(clean_tree)
outside = ClusterOutput(trim_with_regions.Outside)

# ==== cluster Opening_large_3
cluster_input = ClusterInput()
cluster_input_2 = ClusterInput()
geometry = ClusterInput()
A = ClusterInput()
geometry_2 = Geometry(geometry)
curve_middle = CurveMiddle(Curve=geometry_2)
length = Length(Curve=geometry_2)
division = Division(A=length, B=2)
multiplication = Multiplication(A=A, B=division)
circle = Circle(Plane=curve_middle, Radius=multiplication)  # -> simplify(Circle)
trim_with_regions = TrimWithRegions(Curve=graft(geometry_2), Regions=graft(circle))  # -> simplify(Inside), simplify(Outside)
cluster = Cluster_4(A=cluster_input, A_2=cluster_input_2, geometry=trim_with_regions.Inside)  # -> tree, s1
clean_tree = CleanTree(RemoveNulls=True, RemoveInvalid=True, RemoveEmpty=True, Tree=cluster.tree)  # -> simplify(Tree)
tree = ClusterOutput(clean_tree)
inside = ClusterOutput(trim_with_regions.Inside)
outside = ClusterOutput(trim_with_regions.Outside)

# ==== cluster Opening_large_4
cluster_input = ClusterInput()
cluster_input_2 = ClusterInput()
geometry = ClusterInput()
A = ClusterInput()
geometry_2 = Geometry(geometry)
curve_middle = CurveMiddle(Curve=geometry_2)
length = Length(Curve=geometry_2)
division = Division(A=length, B=2)
multiplication = Multiplication(A=A, B=division)
circle = Circle(Plane=curve_middle, Radius=multiplication)  # -> simplify(Circle)
trim_with_regions = TrimWithRegions(Curve=geometry_2, Regions=circle)  # -> simplify(Inside), simplify(Outside)
cluster = Cluster_9(A=cluster_input, A_2=cluster_input_2, geometry=trim_with_regions.Inside)  # -> tree, s1, s2
clean_tree = CleanTree(RemoveNulls=True, RemoveInvalid=True, RemoveEmpty=True, Tree=cluster.tree)  # -> simplify(Tree)
panel = Panel(cluster.s2)
s2 = ClusterOutput(cluster.s2)
tree = ClusterOutput(clean_tree)
outside = ClusterOutput(trim_with_regions.Outside)

# ==== cluster Dash
cluster_input = ClusterInput()
curve = ClusterInput()
B = ClusterInput()
length = Length(Curve=curve)
division = Division(A=length, B=B)
integer = Integer(expr("x/2", division))
multiplication = Multiplication(A=integer, B=2)
addition = Addition(A=multiplication, B=1)
division_2 = Division(A=length, B=addition)
dash_pattern = DashPattern(Curve=curve, Pattern=division_2)  # -> Dashes, Gaps
trim_tree = TrimTree(Tree=dash_pattern.Dashes, Depth=1)
cluster = Cluster_10(A=cluster_input, geometry=trim_tree)  # -> tree, s1
gate_infra = ClusterOutput(cluster.tree)

# ==== cluster Cluster_12
A = ClusterInput()
A_2 = ClusterInput()
geometry = ClusterInput()
multiplication = Multiplication(A=A, B=2)
curve_middle = CurveMiddle(Curve=geometry)
length = Length(Curve=geometry)
subtraction = Subtraction(A=length, B=multiplication)
multiplication_2 = Multiplication(A=A_2, B=2)
subtraction_2 = Subtraction(A=subtraction, B=multiplication_2)
division = Division(A=subtraction_2, B=length)
scale = Scale(Geometry=geometry, Center=curve_middle, Factor=division)  # -> Geometry, Transform
length_2 = Length(Curve=scale.Geometry)
division_2 = Division(A=length_2, B=2)
clean_tree = CleanTree(RemoveNulls=True, RemoveInvalid=True, RemoveEmpty=True, Tree=scale.Geometry, SynchronousTree1=division_2)  # -> Tree, SynchronousTree1
tree = ClusterOutput(clean_tree.Tree)
s1 = ClusterOutput(clean_tree.SynchronousTree1)

# ==== cluster Cluster_13
tree = ClusterInput()
A = ClusterInput()
vector = ClusterInput()
unit_vector = UnitVector(Vector=vector)
clean_tree = CleanTree(RemoveNulls=True, RemoveInvalid=True, RemoveEmpty=True, Tree=tree)  # -> simplify(Tree)
multiplication = Multiplication(A=A, B=unit_vector)
move = Move(Geometry=simplify(graft(clean_tree)), Motion=graft(multiplication))  # -> Geometry, Transform
curve_middle = CurveMiddle(Curve=graft(clean_tree))
end_points = EndPoints(Curve=graft(clean_tree))  # -> Start, End
end_points_2 = EndPoints(Curve=graft(move.Geometry))  # -> Start, End
merge = Merge(Data1=end_points.Start, Data2=end_points.End)
merge_2 = Merge(Data1=end_points_2.Start, Data2=end_points_2.End)
circle = Circle(Plane=merge, Radius=graft(A))  # -> graft(Circle)
line = Line(StartPoint=merge, EndPoint=merge_2)
line_2 = Line(StartPoint=merge_2, EndPoint=curve_middle)
line_3 = ClusterOutput(line)
curve_middle_2 = CurveMiddle(Curve=line_2)
length = Length(Curve=line_2)
circle_2 = Circle(Plane=curve_middle_2, Radius=expr("x/2", length))
trim_with_region = TrimWithRegion(Curve=circle, Region=graft(circle_2))  # -> Inside, Outside
inside = ClusterOutput(trim_with_region.Inside)

# ==== cluster Cluster_14
B = ClusterInput()
A = ClusterInput()
geometry = ClusterInput()
multiplication = Multiplication(A=B, B=2)
curve_middle = CurveMiddle(Curve=geometry)
length = Length(Curve=geometry)
subtraction = Subtraction(A=length, B=B)
multiplication_2 = Multiplication(A=A, B=2)
subtraction_2 = Subtraction(A=subtraction, B=multiplication_2)
division = Division(A=subtraction_2, B=length)
scale = Scale(Geometry=geometry, Center=curve_middle, Factor=division)  # -> Geometry, Transform
length_2 = Length(Curve=scale.Geometry)
division_2 = Division(A=length_2, B=2)
clean_tree = CleanTree(RemoveNulls=True, RemoveInvalid=True, RemoveEmpty=True, Tree=scale.Geometry, SynchronousTree1=division_2)  # -> Tree, SynchronousTree1
panel = Panel(clean_tree.Tree)
tree = ClusterOutput(clean_tree.Tree)
s1 = ClusterOutput(clean_tree.SynchronousTree1)

# ==== cluster Dash_2
curve = ClusterInput()
B = ClusterInput()
length = Length(Curve=curve)
division = Division(A=length, B=B)
integer = Integer(expr("x/2", division))
multiplication = Multiplication(A=integer, B=2)
addition = Addition(A=multiplication, B=1)
division_2 = Division(A=length, B=addition)
dash_pattern = DashPattern(Curve=curve, Pattern=division_2)  # -> Dashes, Gaps
trim_tree = TrimTree(Tree=dash_pattern.Dashes, Depth=1)
tree = ClusterOutput(trim_tree)

# ==== cluster Cluster_17
A = ClusterInput()
curve = ClusterInput()
multiplication = Multiplication(A=A, B=2)
subtraction = Subtraction(B=multiplication)
offset_curve = OffsetCurve(Curve=curve, Distance=expr("0-x", multiplication), Corners=1)
clean_tree = CleanTree(RemoveNulls=True, RemoveInvalid=True, RemoveEmpty=True, Tree=offset_curve)  # -> Tree, SynchronousTree1, SynchronousTree2
panel = Panel(clean_tree.Tree)
tree = ClusterOutput(clean_tree.Tree)

# ==== cluster Dash_3
cluster_input = ClusterInput()
curve = ClusterInput()
B = ClusterInput()
length = Length(Curve=curve)
division = Division(A=length, B=B)
integer = Integer(expr("x/2", division))
multiplication = Multiplication(A=integer, B=2)
addition = Addition(A=multiplication, B=1)
division_2 = Division(A=length, B=addition)
dash_pattern = DashPattern(Curve=curve, Pattern=division_2)  # -> Dashes, Gaps
trim_tree = TrimTree(Tree=dash_pattern.Dashes, Depth=1)
cluster = Cluster_10(A=cluster_input, geometry=trim_tree)  # -> tree, s1
tree = ClusterOutput(trim_tree)

# ==== cluster Cluster_9
A = ClusterInput()
A_2 = ClusterInput()
geometry = ClusterInput()
curve_middle = CurveMiddle(Curve=geometry)
length = Length(Curve=geometry)
multiplication = Multiplication(A=A, B=2)
subtraction = Subtraction(A=length, B=multiplication)
multiplication_2 = Multiplication(A=A_2, B=2)
subtraction_2 = Subtraction(A=length, B=multiplication)
subtraction_3 = Subtraction(A=subtraction, B=multiplication_2)
division = Division(A=subtraction_2, B=length)
division_2 = Division(A=subtraction_3, B=length)
scale = Scale(Geometry=geometry, Center=curve_middle, Factor=division_2)  # -> Geometry, Transform
scale_2 = Scale(Geometry=geometry, Center=curve_middle, Factor=division)  # -> Geometry, Transform
length_2 = Length(Curve=scale.Geometry)
division_3 = Division(A=length_2, B=2)
clean_tree = CleanTree(
    RemoveNulls=True,
    RemoveInvalid=True,
    RemoveEmpty=True,
    Tree=scale.Geometry,
    SynchronousTree1=division_3,
    SynchronousTree2=scale_2.Geometry)  # -> Tree, SynchronousTree1, SynchronousTree2
panel = Panel(clean_tree.Tree)
s2 = ClusterOutput(clean_tree.SynchronousTree2)
tree = ClusterOutput(clean_tree.Tree)
s1 = ClusterOutput(clean_tree.SynchronousTree1)

# ==== cluster Cluster_10
A = ClusterInput()
geometry = ClusterInput()
curve_middle = CurveMiddle(Curve=geometry)
length = Length(Curve=geometry)
multiplication = Multiplication(A=A, B=2)
subtraction = Subtraction(A=length, B=multiplication)
division = Division(A=subtraction, B=length)
panel = Panel(division)
scale = Scale(Geometry=geometry, Center=curve_middle, Factor=division)  # -> Geometry, Transform
length_2 = Length(Curve=scale.Geometry)
division_2 = Division(A=length_2, B=2)
clean_tree = CleanTree(RemoveNulls=True, RemoveInvalid=True, RemoveEmpty=True, Tree=scale.Geometry, SynchronousTree1=division_2)  # -> Tree, SynchronousTree1
tree = ClusterOutput(clean_tree.Tree)
s1 = ClusterOutput(clean_tree.SynchronousTree1)
